# Grasshopper definition demo_file.ghx (Grasshopper 0.9.76)
# plug-ins: Python Interpreter

number_slider = Slider(200, range=0..1000)  # disabled
profile = PythonScript()  # -> out, a; disabled
# ---------- profile: Python ----------
passenger_profile_departing = {
    'name':'passenger',
    'status': {
        'def':'departing',
        'origin':'curbside',
        'destination': 'gate'
    },
    'properties': {
        'curbside': 100,
        'bathroom':100,
        'security': 100,
        'gate': 100,
        'restaurant':100,
        'lounge': 50,
    },
    'influence':{
        'queuing':70,
        'remainder':120
    }
    
}

a = [passenger_profile_departing]
# ---------- end profile ----------
dup = DuplicateData(Data=profile.a, Number=number_slider, Order=True)  # disabled
agent = PythonScript(profile=flatten(dup))  # -> out, a; inputs profile: list; disabled
# ---------- agent: Python ----------
import rhinoscriptsyntax as rs
import copy, random

           
if len(profile) != 0:

    entities = []
    profile.reverse()

    while len(profile) > 0:
        entity = {
            'type': 'agent',
            'profile':profile[-1]
        }
        profile.pop()
        entities.append(entity)
        
    a = entities
# ---------- end agent ----------

panel = Panel("wall")  # disabled
panel_2 = Panel("concourse")  # disabled
panel_3 = Panel("name")  # disabled
panel_4 = Panel("name")  # disabled
attr = PythonScript(name=panel_3, value=panel)  # -> out, a; disabled
# ---------- attr: Python ----------
a = [{name: value}]
# ---------- end attr ----------
attr_2 = PythonScript(name=panel_4, value=panel_2)  # -> out, a; disabled; same code as attr
profile_2 = PythonScript(attr=flatten(attr.a))  # -> out, a; inputs attr: list; disabled
# ---------- profile_2: Python ----------
profile = {
}

for attribute in attr:
    for key in attribute.keys():
        profile[key] = attribute[key]

print profile
a = [profile]
# ---------- end profile_2 ----------
profile_3 = PythonScript(attr=flatten(attr_2.a))  # -> out, a; inputs attr: list; disabled; same code as profile_2
boundary = Geometry(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)  # disabled
barriers = Geometry([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])  # disabled
barrier = PythonScript(boundary=flatten(barriers), profile=flatten(profile_2.a))  # -> out, a; inputs boundary: list, profile: list; disabled
# ---------- barrier: Python ----------
import rhinoscriptsyntax as rs
import Rhino as rc
    
if len(profile) != 0 and boundary != None:
    
    entities = []
    boundary.reverse()
    profile.reverse()
    
    for curve in boundary:
        
        crv = rs.coercecurve(curve)

        if crv.IsClosed:
            
            entity = {
                'geometry':crv,
                'type':'barrier',
                'profile':profile[-1]
            }
            if len(profile) > 1: profile.pop()
            entities.append(entity)
        
        else: print 'curve not closed... ignoring'
    
    a = entities
# ---------- end barrier ----------
floor = PythonScript(boundary=flatten(boundary), profile=flatten(profile_3.a))  # -> out, a; inputs boundary: list, profile: list; disabled
# ---------- floor: Python ----------
import rhinoscriptsyntax as rs
    
if len(profile) != 0 and boundary != None:
    
    entities = []
    boundary.reverse()
    profile.reverse()
    
    for curve in boundary:
        
        
        crv = rs.coercecurve(curve)

        if crv.IsClosed:
        
            entity = {
                'geometry':rs.coercecurve(curve),
                'type':'floor',
                'profile':profile[-1]
            }
            if len(profile) > 1: profile.pop()
            entities.append(entity)
        
        else: print 'curve not closed... ignoring'
    
    a = entities
# ---------- end floor ----------

panel_5 = Panel("bathroom")  # disabled
panel_6 = Panel("2")  # disabled
panel_7 = Panel("capacity")  # disabled
panel_8 = Panel("name")  # disabled
attr_3 = PythonScript(name=panel_7, value=panel_6)  # -> out, a; disabled; same code as attr
attr_4 = PythonScript(name=panel_8, value=panel_5)  # -> out, a; disabled; same code as attr
profile_4 = PythonScript(attr=flatten([attr_4.a, attr_3.a]))  # -> out, a; inputs attr: list; disabled; same code as profile_2
pt = Point([Point(-7.5, 62.6, 0), Point(35.9, 62.8, 0)])  # disabled
node = PythonScript(position=flatten(pt), profile=flatten(profile_4.a))  # -> out, a; inputs position: list, profile: list; disabled
# ---------- node: Python ----------
import copy
import rhinoscriptsyntax as rs

if len(profile) != 0 and position!= None:
    
    entities = []
    position.reverse()
    profile.reverse()
    
    for p in position:
        entity = {
            'position':rs.coerce3dpoint(p),
            'type': 'node',
            'profile':profile[-1]
        }
        if len(profile) > 1: attr.pop()
        entities.append(entity)

    a = entities
# ---------- end node ----------

test = Profile()  # -> out, a; disabled
# ---------- test: Python ----------
ghenv.Component.Name = "profile"
ghenv.Component.NickName = 'Profile'
ghenv.Component.Message = 'VER 0.0.1\nMAR_15_2016'
ghenv.Component.Category = "OptimalPath"
ghenv.Component.SubCategory = "00 | TEST | PATHSIM "

import Rhino as rc
import scriptcontext as sc
import rhinoscriptsyntax as rs
import os
import time
import System
import shutil
import Grasshopper.Kernel as gh
import math
from Grasshopper import DataTree
from Grasshopper.Kernel.Data import GH_Path




class Test():
    
    def __init__(self):
        pass
    
    def run(self, dict):
        ghenv.Component.NickName = dict['name']
        
        ghenv.Component.Params.Input[0].NickName = dict['prop']
        ghenv.Component.Params.Input[0].Name = dict['prop']


a = Test()
# ---------- end test ----------
number_slider_2 = Slider(376, range=0..1000)  # disabled
number_slider_3 = Slider(376, range=0..1000)  # disabled
python = PythonScript(name=number_slider_2)  # -> out, a; disabled
# ---------- python: Python ----------
profile.run({
    'name': 'test',
    'prop': 'position'
})
# ---------- end python ----------
python_2 = PythonScript(name=number_slider_3)  # -> out, a; disabled
# ---------- python_2: Python ----------
profile.run({
    'name': 'test',
    'prop': 'location'
})
# ---------- end python_2 ----------

panel_9 = Panel("""security
g1
concession""")  # disabled
panel_10 = Panel("""100
100
100""")  # disabled
profile_5 = PythonScript(attr=flatten(panel_9), val=flatten(panel_10))  # -> out, a; inputs attr: list, val: list; disabled
# ---------- profile_5: Python ----------
if len(attr) and len(val) and len(attr) == len(val):
    
    profile= {
        'properties': {
        } 
    }
    
    for i, att in enumerate(attr):
        profile['properties'][att] = val[i]
    
    for p in profile['properties']:
        print p ,":", profile['properties'][p] 

    a = [profile]
# ---------- end profile_5 ----------
panel_11 = Panel("security")  # disabled
panel_12 = Panel("dep1")  # disabled
panel_13 = Panel("g1")  # disabled
agent_2 = PythonScript(name=panel_12, origin=panel_11, destination=panel_13, profile=flatten(profile_5.a))  # -> out, a; inputs profile: list; disabled
# ---------- agent_2: Python ----------
import rhinoscriptsyntax as rs
import copy, random

           
if len(profile) != 0 and origin != None and destination != None:

    entities = []
    profile.reverse()

    while len(profile) > 0:
        
        if profile[-1] != None:
            
            entity = {
                'type': 'agent',
                'profile':profile[-1],
                'influence':{
                    'queuing':100,
                    'remainder':None # implement later
                }
            }
            """
                TODO - make class : this is not good
            """
            entity['profile']['name'] = name
            entity['profile']['origin'] = origin
            entity['profile']['destination'] = destination
            
            entity['profile']['properties'][origin] = 100
            entity['profile']['properties'][destination] = 100
            
            entities.append(entity)
        
        profile.pop()
        
        
    for e in entities: print e
    a = entities
# ---------- end agent_2 ----------

panel_14 = Panel("2")  # disabled
panel_15 = Panel("capacity")  # disabled

# ---- group: basic profile
# this should be written as a possible set for more complex agents
agent_3 = PythonScript(name="test", origin="start", destination="end")  # -> out, a; inputs nodes: list, vals: list
# ---------- agent_3: Python ----------
import rhinoscriptsyntax as rs
import copy, random

           
if name != None and origin != None and destination != None:

    nodes.reverse()
    vals.reverse()

    entity = {
        'type': 'agent',
        'profile': {
            'name': name,
            'origin': origin,
            'destination': destination,
            'properties':{
            }
        },
        'influence':{
            'queuing':50, #implement later
            'remainder':None # implement later
        }
    }
    
    if len(nodes) > 0 and len(vals) > 0:
        count=0
        while len(nodes) and count < 100:
            count+=1
            entity['profile']['properties'][nodes.pop()] = vals.pop() if len(vals) > 1 else vals[-1]
    
    
    entity['profile']['properties'][origin] = 100
    entity['profile']['properties'][destination] = 100
    
    print entity
    a = [entity]
# ---------- end agent_3 ----------

# ----
pt_2 = Point(Point(3.231175446, 9.413039561, 0))
node_2 = PythonScript(position=flatten(pt_2), name=flatten("end"))  # -> out, a; inputs position: list, name: list, capacity: list
# ---------- node_2: Python ----------
import copy
import rhinoscriptsyntax as rs

if len(name) != 0 and position!= None:
    
    entities = []
    capacity = [None] if (len(capacity) == 0 or capacity == 0) else capacity
    
    position.reverse()
    name.reverse()
    capacity.reverse()
    
    for p in position:
        
        entity = {
            'position':rs.coerce3dpoint(p),
            'type': 'node',
            'profile': {
                'name': name[-1],
                'capacity': capacity[-1]
            }
        }
        if len(name) > 1: name.pop()
        if len(capacity) > 1: capacity.pop()
        entities.append(entity)

    for e in entities: print e
    a = entities
# ---------- end node_2 ----------

pt_3 = Point(Point(0.8303859355, 0.995575123, 0))
node_3 = PythonScript(position=flatten(pt_3), name=flatten("start"))  # -> out, a; inputs position: list, name: list, capacity: list; same code as node_2

# ---- group: basic profile
panel_16 = Panel("start")  # disabled
panel_17 = Panel("test")  # disabled
panel_18 = Panel("end")  # disabled
# this should be written as a possible set for more complex agents
agent_4 = PythonScript(name=panel_17, origin=panel_16, destination=panel_18)  # -> out, a; inputs nodes: list, vals: list; disabled; same code as agent_3

# ----
boundary_2 = Geometry(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)
floor_2 = PythonScript(boundary=flatten(boundary_2), name=flatten("floor1"))  # -> out, a; inputs boundary: list, name: list
# ---------- floor_2: Python ----------
import rhinoscriptsyntax as rs
    
if len(name) != 0 and boundary != None:
    
    entities = []
    boundary.reverse()
    name.reverse()
    
    for curve in boundary:
        
        crv = rs.coercecurve(curve)
        if crv.IsClosed:
        
            entity = {
                'geometry':rs.coercecurve(curve),
                'type':'floor',
                'profile':{
                    'name': name[-1]
                }
            }
            if len(name) > 1: name.pop()
            entities.append(entity)
        
        else: print 'curve not closed... ignoring'
    
    for e in entities: print e
    a = entities
# ---------- end floor_2 ----------

panel_19 = Panel("end")  # disabled
pt_4 = Point(Point(6.563163551, 4.365379886, 0))  # disabled
node_4 = PythonScript(position=flatten(pt_4), name=flatten(panel_19))  # -> out, a; inputs position: list, name: list, capacity: list; disabled; same code as node_2

panel_20 = Panel("start")  # disabled
pt_5 = Point(Point(0.8303859355, 0.995575123, 0))  # disabled
node_5 = PythonScript(position=flatten(pt_5), name=flatten(panel_20))  # -> out, a; inputs position: list, name: list, capacity: list; disabled; same code as node_2

panel_21 = Panel("floor1")  # disabled
boundary_3 = Geometry(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)  # disabled
floor_3 = PythonScript(boundary=flatten(boundary_3), name=flatten(panel_21))  # -> out, a; inputs boundary: list, name: list; disabled; same code as floor_2

barriers_2 = Geometry([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])
barrier_2 = PythonScript(boundary=flatten(barriers_2), floor=flatten("floor1"))  # -> out, a; inputs boundary: list, floor: list
# ---------- barrier_2: Python ----------
import rhinoscriptsyntax as rs
import Rhino as rc
    
if len(floor) != 0 and boundary != None:
    
    entities = []
    boundary.reverse()
    
    for curve in boundary:
        
        crv = rs.coercecurve(curve)

        if crv.IsClosed:
            
            entity = {
                'geometry':crv,
                'type':'barrier',
                'profile':{
                    'name':None,
                    'floor':floor[-1]
                }
            }
            if len(floor) > 1: floor.pop()
            entities.append(entity)
        
        else: print 'curve not closed... ignoring'
    
    for e in entities: print e
    a = entities
# ---------- end barrier_2 ----------

barriers_3 = Geometry([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])  # disabled
barrier_3 = PythonScript(boundary=flatten(barriers_3), floor=flatten(panel_21))  # -> out, a; inputs boundary: list, floor: list; disabled; same code as barrier_2

attr_5 = PythonScript(name=panel_15, value=panel_14)  # -> out, a; disabled; same code as attr

panel_22 = Panel("curbside")  # disabled
panel_23 = Panel("security")  # disabled
panel_24 = Panel("gate")  # disabled
panel_25 = Panel("name")  # disabled
panel_26 = Panel("name")  # disabled
panel_27 = Panel("name")  # disabled
attr_6 = PythonScript(name=panel_25, value=panel_24)  # -> out, a; disabled; same code as attr
attr_7 = PythonScript(name=panel_26, value=panel_22)  # -> out, a; disabled; same code as attr
attr_8 = PythonScript(name=panel_27, value=panel_23)  # -> out, a; disabled; same code as attr
profile_6 = PythonScript(attr=flatten(attr_6.a))  # -> out, a; inputs attr: list; disabled; same code as profile_2
profile_7 = PythonScript(attr=flatten(attr_7.a))  # -> out, a; inputs attr: list; disabled; same code as profile_2
profile_8 = PythonScript(attr=flatten([attr_8.a, attr_5.a]))  # -> out, a; inputs attr: list; disabled; same code as profile_2
pt_6 = Point([Point(4.265214634, 53.54037396, 0), Point(22.98931928, 53.39255208, 0)])  # disabled
pt_7 = Point(Point(14.87710684, 79.93414297, 0))  # disabled
pt_8 = Point([Point(2.579222705, 2.45101553, 0), Point(15.42154413, 2.526116825, 0), Point(26.68673837, 2.45101553, 0)])  # disabled
node_6 = PythonScript(position=flatten(pt_6), profile=flatten(profile_8.a))  # -> out, a; inputs position: list, profile: list; disabled; same code as node
node_7 = PythonScript(position=flatten(pt_7), profile=flatten(profile_6.a))  # -> out, a; inputs position: list, profile: list; disabled; same code as node
node_8 = PythonScript(position=flatten(pt_8), profile=flatten(profile_7.a))  # -> out, a; inputs position: list, profile: list; disabled; same code as node

# ---- group: graphsearch
python_3 = PythonScript()  # -> out, a
# ---------- python_3: Python ----------
from collections import defaultdict

class Graph(object):
    
    def __init__(self, nodes=set(), edges=defaultdict(set), distances={}):
        self.nodes = nodes
        self.edges = edges
        self.distances = distances 

    def add_node(self, value):
        self.nodes.add(value)
        
    def add_edge(self, from_node, to_node, distance):
        self.add_node(from_node)
        self.add_node(to_node)
        
        self.edges[from_node].add(to_node)
        self.edges[to_node].add(from_node)
        self.distances[(from_node, to_node)] = distance
        self.distances[(to_node, from_node)] = distance


def deepsearch(key, func, depth=0, visited={}, max_depth=10):
    print 'deep search', depth
    visited[key] = None 
    if func(dict[key]): visited[key] = depth
    elif depth < max_depth:
        for edge in graph.edges[key]:
            if not edge in visited:
                visited.update(deepsearch(edge, func, depth+1, visited))
    return visited

def shallowsearch(keys, func, depth=0, visited={}, max_depth=10):
    print 'shallow search', depth
    for key in keys:
        if not key in visited: visited[key] = None 
        if func(dict[key]):
            visited[key] = depth
            return visited
    if depth < max_depth:
        keys = set([k for key in keys for k in graph.edges[key]])
        return shallowsearch(keys, func, depth+1, visited)
        
graph = Graph()
dict = {
    'a':0,
    'b':0,
    'c':0,
    'd':1,
    'e':0,
    'f':1,
    'g':0,
    'h':1
}
graph.add_edge('a','b',1 )
graph.add_edge('a','c',1 )
graph.add_edge('c','d',1 )
graph.add_edge('b','e',1 )
graph.add_edge('e','f',1 )
graph.add_edge('e','g',1 )
graph.add_edge('g','h',1 )


def _func(num):
    if num == 1:return True
    return False

print deepsearch('a', _func)
print shallowsearch('a', _func)
# ---------- end python_3 ----------

# ----
template = PythonScript()  # -> out, a; inputs lines: list of Curve
# ---------- template: Python ----------
import rhinoscriptsyntax as rs
import Rhino as rc


if len(lines):

    entities = []
    for line in lines:
        entities.append([rs.CurveEndPoint(line), rs.CurveStartPoint(line)])
    entity = {
        'type': 'template',
        'profile': {
            'edges': entities,
            'directed': False
        }
    }
    a = [entity]
# ---------- end template ----------
template_2 = PythonScript()  # -> out, a; inputs lines: list of Curve; disabled; same code as template
panel_28 = Panel(agent_3.out)
panel_29 = Panel(agent_4.out)  # disabled
number_slider_4 = Slider(1, range=0..1)
number_slider_5 = Slider(0.5, range=0..1)  # disabled
env = PythonScript(entities=flatten([barrier_2.a, floor_2.a, node_3.a, node_2.a, agent_3.a]), res=number_slider_4)  # -> out, a; inputs entities: list; disabled
# ---------- env: Python ----------
from collections import defaultdict
import rhinoscriptsyntax as rs
import Rhino as rc
import scriptcontext as sc
import random, copy
from itertools import permutations
import math as m
import Grasshopper.Kernel as gh

import ghpythonlib.parallel

class Graph(object):
    
    def __init__(self, nodes=set(), edges=defaultdict(set), distances={}):
        """
            TODO - FIX - currently resource allocation between graphs is broken
            multiple graphs share the same node set
        """
        self.nodes = nodes
        self.edges = edges
        self.distances = distances 

    def __repr__(self):
        return "Graph: {0} nodes, {1} edges".format(len(self.nodes), len(self.edges))
    
    def add_node(self, value):
        self.nodes.add(value)
        
    def add_edge(self, from_node, to_node, distance):
        self.add_node(from_node)
        self.add_node(to_node)
        
        self.edges[from_node].add(to_node)
        self.edges[to_node].add(from_node)
        self.distances[(from_node, to_node)] = distance
        self.distances[(to_node, from_node)] = distance
    
    def get_distance(self, key, gen=0):
        return self.distances[key]
    
    def get_step(self, initial, goal, route):
        return
    
    def deepsearch(key, func, depth=0, visited={}, max_depth=10):
        visited[key] = None 
        if func(dict[key]): visited[key] = depth
        elif depth < max_depth:
            for edge in graph.edges[key]:
                if not edge in visited:
                    visited.update(deepsearch(edge, func, depth+1, visited))
        return visited
    
    def shallowsearch(keys, func, depth=0, visited={}, max_depth=10):
        for key in keys:
            if not key in visited: visited[key] = None 
            if func(dict[key]):
                visited[key] = depth
                return visited
        if depth < max_depth:
            keys = set([k for key in keys for k in graph.edges[key]])
            return shallowsearch(keys, func, depth+1, visited)
            
    """
        initial dijsktra from:
        https://gist.github.com/econchick/4666413
    """
    def dijsktra(self, initial, goal=None, start_idx=0):

        visited = {initial: 0}
        path = {}
        nodes = set(self.nodes)

        while nodes:
            min_node = None
            for node in nodes:
                if node in visited:
                    if min_node is None:
                        min_node = node
                    elif visited[node] < visited[min_node]:
                        min_node = node
            if min_node is None:
                break
            nodes.remove(min_node)
            current_weight = visited[min_node]

            gen = self.get_step(min_node, initial, path)

            for edge in self.edges[min_node]:
                distance = self.get_distance((min_node, edge), gen+start_idx)
                weight = current_weight + distance
                if edge not in visited or weight < visited[edge]:
                    
                    visited[edge] = weight
                    path[edge] = min_node
                    
                if goal != None and edge == goal: return visited, path
                        
        return visited, path

    def shortest_path(self, initial_node, goal_node, start_idx=0, paths=None):
        
        if paths == None:
            distances, paths = self.dijsktra(initial_node, goal_node, start_idx)
            
        route = [goal_node]
        while goal_node != initial_node:
            route.append(paths[goal_node])
            goal_node = paths[goal_node]
        route.reverse()
        return route

class Map(Graph):
    
    def __init__(self, floor):
        super(Map, self).__init__()
        self._floor = floor
        self._barrier_map = defaultdict(float)
        self._density_map = defaultdict(lambda : defaultdict(int))
        self._occupancy_map = defaultdict(lambda : defaultdict(int))
        
    @property
    def barrier_map(self):
        return self._barrier_map
    
    def set_barrier(self, key, val):
        self.barrier_map[key] += val
   
    def get_barrier_map(self):
        return [self.barrier_map[k] for k in self.barrier_map.keys()]
        
    @property
    def density_map(self):
        return self._density_map
    
    def get_density(self, key, gen):
        return self.density_map[gen][key] / self.floor.grid_size**2
    
    def get_density_map_at(self, gen):
        return [self.get_density(k, gen) for k in range(len(self.floor.grid))]
    
    def add_density(self, key, gen):
        self.density_map[gen][key] += 1
    
    
            
    @property
    def occupancy_map(self):
        return self._occupancy_map
    
    def get_occupancy(self, key, gen):
        return self.occupancy_map[gen][key]
    
    def get_occupancy_map_at(self, gen):
        return [self.get_occupancy(k, gen) for k in range(len(self.floor.grid))]
    
    def add_occupancy(self, key, gen):
        self.occupancy_map[gen][key] += 1
    
    
        
    @property
    def floor(self):
        return self._floor
    
    def filter(self, key):
        return self.barrier_map[key]
    
    def get_step(self, initial, goal, route):
        path = [initial]
        while initial != goal:
            path.append(route[initial])
            initial = route[initial]
        curr_gen = len(path)
        return curr_gen
    
    def get_distance(self, key, gen):
        dist = self.distances[key]
        density  = self.get_density(key[1], gen)
        overlays = self.filter(key[1])
        
        return dist + overlays + density

class Bounds2d():
    
    def __init__(self, **kwargs):
        try:
            self.geo_pts = rs.CurvePoints(kwargs['geo'])

            self._bds = [self.bds_x(self.geo_pts), self.bds_y(self.geo_pts)]
            self._origin = rc.Geometry.Point3d(self.bds[0][0], self.bds[1][0], 0)
            
            self._dim_x = self._bds[0][1] - self._bds[0][0]
            self._dim_y = self._bds[1][1] - self._bds[1][0]
        
        except:
            self.geo_pts = kwargs['pts']
            
            self._bds = [self.bds_x(self.geo_pts), self.bds_y(self.geo_pts)]
            self._origin = rc.Geometry.Point3d(self.bds[0][0], self.bds[1][0], 0)
            
            self.dim_x = kwargs['dim_x']
            self.dim_y = kwargs['dim_y']
        
    
    @property
    def pts(self):
        return [ rc.Geometry.Point3d(self.bds[0][0], self.bds[1][0], 0),
            rc.Geometry.Point3d(self.bds[0][1], self.bds[1][0], 0),
            rc.Geometry.Point3d(self.bds[0][1], self.bds[1][1], 0),
            rc.Geometry.Point3d(self.bds[0][0], self.bds[1][1], 0)]
    
    @property
    def bds(self):
        return self._bds
    
    @property
    def origin(self):
        return self._origin
    
    def set_origin(self, pt):
        self._origin = pt
    
    @property
    def plane(self):
        return rc.Geometry.Plane(self.origin, rc.Geometry.Vector3d(0,0,1))
    
    @property
    def x(self):
        return self.bds[0][0]
    
    @property
    def y(self):
        return self.bds[1][0]
    
    def bds_x(self, pts):
        pts.sort(key = lambda pt: pt.X)
        return (pts[0].X, pts[-1].X)
    
    def bds_y(self, pts):
        pts.sort(key = lambda pt: pt.Y)
        return (pts[0].Y, pts[-1].Y)
   
    @property
    def dim_x(self):
        return self._dim_x
    
    @property
    def dim_y(self):
        return self._dim_y
    
    @property
    def centroid(self):
        x_average = self.x + self.dim_x/2
        y_average = self.y + self.dim_y/2
        return rc.Geometry.Point3d(x_average, y_average, 0)
    
    def to_rect(self):
        return rc.Geometry.Rectangle3d(self.plane, self.dim_x, self.dim_y)
    
    def to_grid(self, grid_size):
        
        def mesh_from_rect(rect, grid_size):

            mesh_params = rc.Geometry.MeshingParameters.Default
            mesh_params.MaximumEdgeLength = grid_size
            mesh_params.MinimumEdgeLength = grid_size
            mesh_params.GridAspectRatio = 1

            rect = rc.Geometry.Rectangle3d.ToNurbsCurve(rect)
            return rc.Geometry.Mesh.CreateFromPlanarBoundary(rect, mesh_params)
        
        return mesh_from_rect(self.to_rect(), grid_size)
    
    def contains_pt(self, pt):
        pt = rs.coerce3dpoint(pt)
        if pt.X < self.x or pt.X > (self.x + self.dim_x) or pt.Y < self.y or pt.Y > (self.y + self.dim_y):
            return False
        return True
    
    def intersects(self, other):
        """
            TODO - swap this for an implementation that just
                tests for inverval inclusion
        """
        for pt in self.geo_pts: 
            if other.contains_pt(pt): return True
        for pt in other.geo_pts: 
            if self.contains_pt(pt): return True
            
        return False
    
    @classmethod
    def from_center_pt(cls, pt, dim_x, dim_y):
        pt = rs.coerce3dpoint(pt)
            
        geo_pts = [rc.Geometry.Point3d(pt.X+dim_x/2, pt.Y+dim_y/2, pt.Z),
            rc.Geometry.Point3d(pt.X+dim_x/2, pt.Y-dim_y/2, pt.Z),
            rc.Geometry.Point3d(pt.X-dim_x/2, pt.Y-dim_y/2, pt.Z),
            rc.Geometry.Point3d(pt.X-dim_x/2, pt.Y+dim_y/2, pt.Z)]
        
        return cls(pts=geo_pts, dim_x=dim_x, dim_y=dim_y)


class Entity(object):
    
    def __init__(self, attr):
        self._pos = defaultdict(lambda: None)
        self._attr = attr
        self._type = 'entity'
    
    def __repr__(self):
        return "Environment Entity: {0} : {1} ".format(self.type, self.name)

    @property
    def name(self):
        return self.get_attribute('name')

    @property
    def position(self):
        return self._pos[0]
    
    def set_position(self, pos, gen=0):
        self._pos[gen] = pos
    
    def get_position(self, gen=0):
        return self._pos[gen]
    
    @property
    def type(self):
        return self._type
    
    def set_type(self, type):
        self._type = type
    
    @property
    def attributes(self): return self._attr
    
    def set_attribute(self, key, value):
        self._attr[key] = value
    
    def get_attribute(self, key):
        
        def _finditem(obj, key):
            if key in obj: return obj[key]
            for k, v in obj.items():
                if isinstance(v,dict):
                    item = _finditem(v, key)
                    if item is not None:
                        return item
                        
        return _finditem(self.attributes, key)
    
    def has_attribute_value(self, val):
        
        def _findvalue(obj, val):
            if val in obj.values(): return True
            for k,v in obj.items():
                if isinstance(v,dict):
                    value = _findvalue(v, val)
                    if value is not None:
                        return True
            return False
        
        return _findvalue(self.attributes, val)


class Node(Entity):
    
    def __init__(self, pos, attr={}):
        super(Node, self).__init__(attr)
        self.set_position(pos)
        self.set_type('node')

        
class Template(Entity):
    
    def __init__(self, attr={}):
        super(Template, self).__init__(attr)
        self.set_type('template')
    
    @property
    def edges(self):
        return self.get_attribute('edges')

class Floor(Entity):
    
    def __init__(self, geo, attr={}):
        super(Floor, self).__init__(attr)
        self._geo = rs.coercecurve(geo)
        self._bds = Bounds2d(geo=geo)
        self._map = None
        self._msh = None
        self._grid = None
        self._grid_size = None
        self._coords = {}
        
        self.set_position(self.bounds.origin)
        self.set_type('floor')
        
    @property
    def geo(self):
        return self._geo
    
    @property
    def bounds(self):
        return self._bds
    
    @property
    def mesh(self):
        return self._msh
        
    @property
    def map(self):
        return self._map
    
    
    @property
    def grid(self):
        return self._grid
        
    def set_grid(self, grid_size):
        
        indexes = []
        denom = m.sqrt(2*(grid_size**2))
        t_mesh = rs.coercemesh(rs.AddPlanarMesh(self.geo))
        self._msh = self.bounds.to_grid(grid_size)
        self._map = Map(self)
        self._grid_size = grid_size
        
        for i, cpt in enumerate(rs.MeshFaceCenters(self.mesh)):
            line = rc.Geometry.Line(cpt, rc.Geometry.Vector3d(0,0,1))
            if not rc.Geometry.Intersect.Intersection.MeshLine(t_mesh, line)[1]:
                indexes.append(i)

        self.mesh.Faces.DeleteFaces(indexes)
        self._grid = rs.MeshFaceCenters(self.mesh)
        
        for i, pt in enumerate(self.grid):
            self.set_coord(self.to_grid_coord(pt), i)
        
        for i, vertex in enumerate(self.mesh.Vertices):

            edges = self.mesh.TopologyVertices.ConnectedFaces(i)
            for e1 in edges:
                for e2 in edges:
                    if not e1 == e2:
                        weight = rs.Distance(self._grid[e1], self._grid[e2])/denom
                        self.map.add_edge(e1,e2, weight)
                        
        self.add_edge_map()
    
    @property
    def grid_size(self):
        return self._grid_size
    
    @property
    def coords(self):
        return self._coords
    
    def set_coord(self, key, val):
        self._coords[key] = val
    
    def get_index_at_coord(self, key):
        return self._coords[key]
    
    def to_grid_coord(self, pt):
        
        grid_x = self.bounds.dim_x / m.floor(self.bounds.dim_x / self.grid_size)
        grid_y = self.bounds.dim_y / m.floor(self.bounds.dim_y / self.grid_size)
        
        cs_x = m.floor(self.bounds.dim_x / grid_x)
        cs_y = m.floor(self.bounds.dim_y / grid_y)

        pt_x = m.floor((pt.X - self.position.X)/ grid_x)
        pt_y = m.floor((pt.Y - self.position.Y)/ grid_y)
        
        return (pt_x, pt_y)
    
    def to_grid_index(self, pt):
        
        coord = self.to_grid_coord(pt)
        return self.get_index_at_coord(coord)
    
    def to_grid_bounds(self, pt):
        return Bounds2d.from_center_pt(pt, self.grid_size, self.grid_size)
    
    
    def contains_pt(self, pt):
        if self.bounds.contains_pt(pt):
            if rs.PointInPlanarClosedCurve(pt, self.geo): return True
        return False
    
    
    def add_edge_map(self):
        
        def _func(num):
            if num == 8: return 0
            else: return 0.5
            
        for i, pt in enumerate(self.grid):
            edges = self.map.edges[i]
            self.map.set_barrier(i, _func(len(edges)))
    
    def add_barrier_map(self, barrier):
        for i, pt in enumerate(self.grid):
            if barrier.bounds.contains_pt(pt):
                if rs.PointInPlanarClosedCurve(pt, barrier.geo):
                    self.map.set_barrier(i, float('inf'))
                    for e in self.map.edges[i]:
                        self.map.set_barrier(e, 0.5)
            
            elif barrier.bounds.intersects(self.to_grid_bounds(pt)):
                self.map.set_barrier(i, 0.5)
                

        
class Barrier(Entity):
    
    def __init__(self, geo, attr={}):
        super(Barrier, self).__init__(attr)
        self._geo = rs.coercecurve(geo)
        self._bds = Bounds2d(geo=geo)
        
        self.set_position(self.bounds.origin)
        self.set_type('barrier')
        
    @property
    def geo(self):
        return self._geo
    
    @property
    def bounds(self):
        return self._bds
    
    @property
    def floor(self):
        return self.get_attribute('floor')
        

class Agent(Entity):
    
    def __init__(self, pos=None, attr={}, env=None):
        super(Agent, self).__init__(attr)
        self._attr = attr
        self._env = env
        self._state = None
        self._history = []
        self._path = []
        
        self.set_position(pos)
        self.set_type('agent')
        
        self.age = 0
        self.__hold = None
        self.is_active = True
        self.is_complete = False
                
    
    
    @property
    def position(self):
        return self.get_position(self.age)
        
    def shift(self):
        
        """
            TODO - not clean at all - Make this better
        """
        next_position = self.state[-2]
        if type(next_position) == Node:
            next_position = self.environment.floors[0].to_grid_index(next_position.position)
            
        _index =  self._path[-1].index(next_position)
        self._path[-1].insert(_index, next_position)
        self.history.append(self.position)
        
        self.environment.floors[0].map.add_occupancy(self.position, self.age)

        keys = self._pos.keys()
        keys.sort()
        keys = keys[self.age:]
        keys.reverse()
        _dict = copy.copy(self._pos)
        for ki in range(len(keys)):
            _dict[keys[ki]+1] = _dict[keys[ki]]
            self.environment.floors[0].map.density_map[keys[ki]][_dict[keys[ki]]] -=1
            self.environment.floors[0].map.density_map[keys[ki]][_dict[keys[ki]+1]] +=1
        self._pos = _dict
        
        
        
    @property
    def grid_index(self):
        return self.environment.floors[0].to_grid_index(self.position.position)
    
    @property
    def state(self):
        return self._state
    
    def set_state(self, state):
        self._state = state
    
    @property
    def destination(self):
        val = self.get_attribute('destination')
        return random.choice(self.environment.get_nodes_with_value(val))
    
    
    
    @property
    def path(self):
        _path = sum([p for p in self._path], [])
        _dict = {idx: self.environment.floors[0].grid[idx] for idx in set(_path)}
        return [_dict[p] for p in _path]
    
    def add_path(self, path):
        self._path.append(copy.deepcopy(path))    
    
    @property
    def history(self):
        return self._history
    
    @property
    def visited(self):
        return [n.name for n in self.history if not type(n) == int]
    
    
    
    @property
    def environment(self):
        return self._env
    
    def set_environment(self, env):
        self._env = env
        
    def toggle_active(self):
        self.is_active = not self.is_active
        
    def toggle_complete(self):
        self.is_complete = not self.is_complete
    
    
    
    def step(self):        
        
       
        def wait(time):
            return self.position, [self.position] * time
    
    
        def move(lst):
            
            lst = [l for l in lst if not l.get_attribute('name') in self.visited]
            
            if len(lst):
            
                properties = self.get_attribute('properties')
                keys = properties.keys()
                n_percs = [k for k in keys if random.randint(0,100) <= float(properties[k])]
                
                lst = [(l, self.environment.graph.get_distance((self.position, l))) for l in lst if l.get_attribute('name') in n_percs]
            
                if len(lst):
                    
                    lst.sort(key = lambda tup: len(tup[1]))
                    lst.reverse()
                    
                    while len(lst):
                        
                        tup = lst.pop()
                        n_choice = tup[0]
                        
                        """
                            TODO - switch agents_at_position to consider generation
                                 this currently looks at the amount of people with the same destination
                                 insead of num_people = len(self.environment.agents_at_position(n_choice, self.age))
                        """
                        num_people = len([a for a in self.environment.agents if self.__hold == a.__hold and a != self])
                        capacity = n_choice.get_attribute('capacity')

                        if capacity != None:
                            if num_people < float(capacity):
                                break
                            else:
                                if random.randint(0,100) < self.get_attribute('queuing'):
                                    break
                                else: 
                                    continue
                        else:
                            break
                else:
                    n_choice = self.destination
            else:
                n_choice = self.destination
                self.toggle_complete()
            
            """
                TODO - replace with entity.to_grid_index(environment)
                    nodes need floor property !! important
            """
            n_index = self.environment.floors[0].to_grid_index(n_choice.position)
            n_path = self.environment.floors[0].map.shortest_path(self.grid_index, n_index, start_idx=self.age)

            return n_choice, n_path


        if not len(self.history):

            start_node = self.get_attribute('origin')
            start_positions = self.environment.get_nodes_with_value(start_node)
            start_position = random.choice(start_positions)
            
            self.set_position(start_position)
            self.set_state('waiting')
            
        else:

            if self.is_active:
                
                if self.state == 'ready':
                    
                    self.__hold, path = move(self.environment.graph.edges[self.position])
                    self.add_path(path)
                    
                    for pi in range(len(path)):
                        self.environment.floors[0].map.add_density(path[pi], self.age+pi)
                        self.set_position(path[pi], self.age+pi)
                    
                    path.reverse()
                    self.set_state(path)
               
               
                if self.state == 'waiting':
                    
                    num_people = len(self.environment.agents_at_position(self.__hold, self.age))+1
                    """
                        TODO - switch to property of node/agent?
                        this is also where the intial arrival time would be implemented and swapped
                    """
                    wait_time = num_people * 1 if len(self._path) != 0 else num_people * random.randint(1,60) 
                                        
                    self.__hold, path = wait(wait_time)
                    self.add_path([self.grid_index] * wait_time)
                    
                    for pi in range(len(path)):
                        self.environment.floors[0].map.add_density(self.grid_index, self.age+pi)
                        self.set_position(path[pi], self.age+pi)
                    
                    path.reverse()
                    self.set_state(path)
               
               
                elif len(self.state) == 1:

                    next_position = self.__hold
                    capacity = next_position.get_attribute('capacity')
                    capacity = int(capacity) if capacity != None else float('inf')
                    num_people = len(self.environment.agents_at_position(next_position, self.age))

                    if num_people > capacity and type(self.position)!= Node:
                        self.state.append(self.position)
                        self.shift()
                        
                        self.age+=1
                        self.state.pop();
                    
                    else:
                        self.set_position(self.__hold, self.age)
                        
                        if self.is_complete:
                            self.set_state('complete')
                            self.toggle_active()
                        else:
                            if self.position == self.state[0]: self.set_state('ready')
                            else: self.set_state('waiting')
                            

                else:

                    next_position = self.state[-2]
                    max_density = 1 * self.environment.resolution 
                    num_people = len(self.environment.agents_at_position(next_position, self.age))
                    next_people = len(self.environment.agents_at_position(next_position, self.age+1))
                    #curr_people = len(self.environment.agents_at_position(self.position, self.age))
                    
                    """
                        TODO - handle infinite while loop, 
                            this is a temporary solution
                    
                    if curr_people > max_density and next_people > max_density:
                        if type(self.position)!= Node:
                            print 'critical density met', next_position
                            max_density += num_people
                    """
                    
                    if num_people > max_density or next_people > max_density:
                        if type(self.position)!= Node:
                            self.state.append(self.position)
                            self.shift()
                        
                    self.age+=1
                    self.state.pop()
                    


        self.history.append(self.position)
        
        
        
class Environment():
    
    def __init__(self, resolution=30):
        self._entities = defaultdict(list)
        self._agents = []
        self._graph = copy.deepcopy(Graph()) # bad - fix later
        self._graph_paths = {}
        self._resolution = resolution
    
    def __repr__(self):
        return 'Environment: {0} agents, {1} nodes, {2} floors'.format(len(self.agents), len(self.graph.nodes), len(self.floors))
    
    @property
    def resolution(self):
        return self._resolution
    
    
    @property
    def entities(self):
        return self._entities
     
    def add_entity(self, entity):
        self.entities[entity.type].append(entity)
    
    def add_entities(self, entities):
        
        
        def _add_floor(entity):
            entity = Floor(entity['geometry'], entity['profile'])
            self.add_floor(entity)
            self.add_entity(entity)
        
        def _add_node(entity):
            entity = Node(entity['position'], entity['profile'])
            self.add_node(entity)
            self.add_entity(entity)
            
        def _add_template(entity):
            entity = Template(entity['profile'])
            self.add_template(entity)
            self.add_entity(entity)
        
        def _add_barrier(entity):
            entity = Barrier(entity['geometry'], entity['profile'])
            self.add_barrier(entity)
            self.add_entity(entity)
        
        def _add_agent(entity):
            entity = Agent(attr=entity['profile'])
            self.add_agent(entity)
            self.add_entity(entity)
        
        
        dict = defaultdict(list)
        for entity in entities:
            dict[entity['type']].append(entity)
        
        if len(dict['floor']):
            for  floor in dict['floor']:
                _add_floor(floor)
        else:
            e = gh.GH_RuntimeMessageLevel.Error
            ghenv.Component.AddRuntimeMessage(e, 'component needs at least one floor')
            return
            
        if len(dict['node']) > 1:
            #ghpythonlib.parallel.run(_add_node, dict['node'], False)
            for node in dict['node']:
                _add_node(node)
        else:
            e = gh.GH_RuntimeMessageLevel.Error
            ghenv.Component.AddRuntimeMessage(e, 'component needs at least two nodes')
            return
              
        if len(dict['template']):
            for template in dict['template']:
                _add_template(template)
        else: self.add_default_template()

        if len(dict['barrier']):
            for barrier in dict['barrier']:
                _add_barrier(barrier)
            
        if len(dict['agent']):
            for agent in dict['agent']:
                _add_agent(agent)
        else:
            w = gh.GH_RuntimeMessageLevel.Warning
            ghenv.Component.AddRuntimeMessage(w, 'no agents in environment')
            
            
            
    @property
    def graph(self):
        return self._graph
    
    @property
    def graph_paths(self):
        return self._graph_paths
    
    def get_graph_path(self, n1, n2):
        
        floor = self.floors[0] # bad - fix later
        """
            TODO if n1 and n2 are on different floors - handle
        """
        idx1 = floor.to_grid_index(n1.position)
        idx2 = floor.to_grid_index(n2.position)
        return floor.map.shortest_path(idx1, idx2, paths=self.graph_paths[n1])
    
    def set_graph_path(self, key, val):
        self._graph_paths[key] = val
    
    
    
    @property
    def templates(self):
        return [n for n in self.entities['template']]
    
    def add_template(self, template):
        if template.get_attribute('directed') == False:
            for edge in template.edges:
                nodes = [n for n in self.nodes if n.position in edge]
                if len(nodes) == 2:
                    path = self.get_graph_path(nodes[0], nodes[1])
                    self.graph.add_edge(nodes[0], nodes[1], path)
    
    def add_default_template(self):
        for n1 in self.graph.nodes:
            for n2 in self.graph.nodes:
                if not n1 == n2: 
                    path = self.get_graph_path(n1, n2)
                    self.graph.add_edge(n1, n2, path)
    
    
    
    @property
    def agents(self):
        return self._agents
        
    def add_agent(self, agent, other=None):
        agent.set_environment(self)
        self.agents.append(agent)
    
    def agents_at_position(self, position, gen=0):
        return [a for a in self.agents if a.get_position(gen) == position]

    
    
    @property
    def nodes(self):
        return [n for n in self.entities['node']]
    
    def add_node(self, node):
        self.graph.add_node(node)
        """
            TODO - floors need to be referenced better
        """
        if self.floors[0].contains_pt(node.position):
            djk = self.floors[0].map.dijsktra(self.floors[0].to_grid_index(node.position))
            self.set_graph_path(node, djk[1])
        else:
            w = gh.GH_RuntimeMessageLevel.Warning
            ghenv.Component.AddRuntimeMessage(w, node.name +' was flagged as not on a floor')
            
            """
                TODO - find closest point on grid
            """
        

    
    def get_nodes_with_value(self, val):
        return [n for n in self.nodes if n.has_attribute_value(val)]
    
    
    
    @property
    def floors(self):
        return [n for n in self.entities['floor']]
    
    def add_floor(self, floor):
        floor.set_grid(self.resolution)
    
    def set_grid(self, grid_size):
        
        """
            TODO - implement more complexity
            grids will need to match up between floors
               - maybe 1 unified graph to hold graphs?
        """
        for floor in self.floors: floor.set_grid(grid_size)
    
    
    
    @property
    def barriers(self):
        return [n for n in self.entities['barriers']]
    
    def add_barrier(self, barrier):
        for floor in self.floors:
            if barrier.floor == floor.name:
                floor.add_barrier_map(barrier)
    
    
    
    @property
    def paths(self):
        return [a.path for a in self.agents]
        
    def generation(self, gen):
        return [a.get_position(gen) for a in self.agents]

    def step(self):
        
        def _func(agent):
            if agent.is_active:
                agent.step()
                   
        for i, agent in enumerate(self.agents):
            _func(agent)
            
    def run(self):
        count = 0
        while len([a for a in self.agents if a.is_active]) and count < 1000:
            self.step()
            count+=1
            
        if count == 1000: print ">>>>>>>>>>>>>>>>>>>>>>>>> broke outer while loop"
        

if len(entities) != 0 and res != None:
    environment = Environment(resolution=res)
    environment.add_entities([e for e in entities if e != None])
    
    a = environment
# ---------- end env ----------
env_2 = PythonScript(entities=flatten([barrier_2.a, floor_2.a, node_3.a, node_2.a, agent_3.a]), res=number_slider_4)  # -> out, a; inputs entities: list
# ---------- env_2: Python ----------
from collections import defaultdict
import rhinoscriptsyntax as rs
import Rhino as rc
import scriptcontext as sc
import random, copy
from itertools import permutations
import math as m
import Grasshopper.Kernel as gh

import ghpythonlib.parallel

class Graph(object):
    
    def __init__(self, nodes=set(), edges=defaultdict(set), distances={}):
        """
            TODO - FIX - currently resource allocation between graphs is broken
            multiple graphs share the same node set
        """
        self.nodes = nodes
        self.edges = edges
        self.distances = distances 

    def __repr__(self):
        return "Graph: {0} nodes, {1} edges".format(len(self.nodes), len(self.edges))
    
    def add_node(self, value):
        self.nodes.add(value)
        
    def add_edge(self, from_node, to_node, distance):
        self.add_node(from_node)
        self.add_node(to_node)
        
        self.edges[from_node].add(to_node)
        self.edges[to_node].add(from_node)
        self.distances[(from_node, to_node)] = distance
        self.distances[(to_node, from_node)] = distance
    
    def get_distance(self, key, gen=0):
        return self.distances[key]
    
    def get_step(self, initial, goal, route):
        return
    
    def deepsearch(self, key, func, depth=0, visited={}, max_depth=10):
        visited[key] = None 
        """
            remove dict!!!
        """
        if func(dict[key]): visited[key] = depth
        elif depth < max_depth:
            for edge in self.edges[key]:
                if not edge in visited:
                    visited.update(this.deepsearch(edge, func, depth+1, visited))
        return visited
    
    def shallowsearch(self, keys, func, depth=0, visited={}, max_depth=10):
        for key in keys:
            if not key in visited: visited[key] = None 
            if func(dict[key]):
                visited[key] = depth
                return visited
        if depth < max_depth:
            keys = set([k for key in keys for k in self.edges[key]])
            return this.shallowsearch(keys, func, depth+1, visited)
            
    """
        initial dijsktra from:
        https://gist.github.com/econchick/4666413
    """
    def dijsktra(self, initial, goal=None, start_idx=0):

        visited = {initial: 0}
        path = {}
        nodes = set(self.nodes)

        while nodes:
            min_node = None
            for node in nodes:
                if node in visited:
                    if min_node is None:
                        min_node = node
                    elif visited[node] < visited[min_node]:
                        min_node = node
            if min_node is None:
                break
            nodes.remove(min_node)
            current_weight = visited[min_node]

            gen = self.get_step(min_node, initial, path)

            for edge in self.edges[min_node]:
                distance = self.get_distance((min_node, edge), gen+start_idx)
                weight = current_weight + distance
                if edge not in visited or weight < visited[edge]:
                    
                    visited[edge] = weight
                    path[edge] = min_node
                    
                if goal != None and edge == goal: return visited, path
                        
        return visited, path

    def shortest_path(self, initial_node, goal_node, start_idx=0, paths=None):
        
        if paths == None:
            distances, paths = self.dijsktra(initial_node, goal_node, start_idx)
            
        route = [goal_node]
        while goal_node != initial_node:
            route.append(paths[goal_node])
            goal_node = paths[goal_node]
        route.reverse()
        return route

class Map(Graph):
    
    def __init__(self, floor):
        super(Map, self).__init__()
        self._floor = floor
        self._barrier_map = defaultdict(float)
        self._density_map = defaultdict(lambda : defaultdict(int))
        self._occupancy_map = defaultdict(lambda : defaultdict(int))
        
    @property
    def barrier_map(self):
        return self._barrier_map
    
    def set_barrier(self, key, val):
        self.barrier_map[key] += val
   
    def get_barrier_map(self):
        return [self.barrier_map[k] for k in self.barrier_map.keys()]
        
    @property
    def density_map(self):
        return self._density_map
    
    def get_density(self, key, gen):
        return self.density_map[gen][key] / self.floor.grid_size**2
    
    def get_density_map_at(self, gen):
        return [self.get_density(k, gen) for k in range(len(self.floor.grid))]
    
    def add_density(self, key, gen):
        self.density_map[gen][key] += 1
    
    
            
    @property
    def occupancy_map(self):
        return self._occupancy_map
    
    def get_occupancy(self, key, gen):
        return self.occupancy_map[gen][key]
    
    def get_occupancy_map_at(self, gen):
        return [self.get_occupancy(k, gen) for k in range(len(self.floor.grid))]
    
    def add_occupancy(self, key, gen):
        self.occupancy_map[gen][key] += 1
    
    
        
    @property
    def floor(self):
        return self._floor
    
    def filter(self, key):
        return self.barrier_map[key]
    
    def get_step(self, initial, goal, route):
        path = [initial]
        while initial != goal:
            path.append(route[initial])
            initial = route[initial]
        curr_gen = len(path)
        return curr_gen
    
    def get_distance(self, key, gen):
        dist = self.distances[key]
        density  = self.get_density(key[1], gen)
        overlays = self.filter(key[1])
        
        return dist + overlays + density

class Bounds2d():
    
    def __init__(self, **kwargs):
        try:
            self.geo_pts = rs.CurvePoints(kwargs['geo'])

            self._bds = [self.bds_x(self.geo_pts), self.bds_y(self.geo_pts)]
            self._origin = rc.Geometry.Point3d(self.bds[0][0], self.bds[1][0], 0)
            
            self._dim_x = self._bds[0][1] - self._bds[0][0]
            self._dim_y = self._bds[1][1] - self._bds[1][0]
        
        except:
            self.geo_pts = kwargs['pts']
            
            self._bds = [self.bds_x(self.geo_pts), self.bds_y(self.geo_pts)]
            self._origin = rc.Geometry.Point3d(self.bds[0][0], self.bds[1][0], 0)
            
            self.dim_x = kwargs['dim_x']
            self.dim_y = kwargs['dim_y']
        
    
    @property
    def pts(self):
        return [ rc.Geometry.Point3d(self.bds[0][0], self.bds[1][0], 0),
            rc.Geometry.Point3d(self.bds[0][1], self.bds[1][0], 0),
            rc.Geometry.Point3d(self.bds[0][1], self.bds[1][1], 0),
            rc.Geometry.Point3d(self.bds[0][0], self.bds[1][1], 0)]
    
    @property
    def bds(self):
        return self._bds
    
    @property
    def origin(self):
        return self._origin
    
    def set_origin(self, pt):
        self._origin = pt
    
    @property
    def plane(self):
        return rc.Geometry.Plane(self.origin, rc.Geometry.Vector3d(0,0,1))
    
    @property
    def x(self):
        return self.bds[0][0]
    
    @property
    def y(self):
        return self.bds[1][0]
    
    def bds_x(self, pts):
        pts.sort(key = lambda pt: pt.X)
        return (pts[0].X, pts[-1].X)
    
    def bds_y(self, pts):
        pts.sort(key = lambda pt: pt.Y)
        return (pts[0].Y, pts[-1].Y)
   
    @property
    def dim_x(self):
        return self._dim_x
    
    @property
    def dim_y(self):
        return self._dim_y
    
    @property
    def centroid(self):
        x_average = self.x + self.dim_x/2
        y_average = self.y + self.dim_y/2
        return rc.Geometry.Point3d(x_average, y_average, 0)
    
    def to_rect(self):
        return rc.Geometry.Rectangle3d(self.plane, self.dim_x, self.dim_y)
    
    def to_grid(self, grid_size):
        
        def mesh_from_rect(rect, grid_size):

            mesh_params = rc.Geometry.MeshingParameters.Default
            mesh_params.MaximumEdgeLength = grid_size
            mesh_params.MinimumEdgeLength = grid_size
            mesh_params.GridAspectRatio = 1

            rect = rc.Geometry.Rectangle3d.ToNurbsCurve(rect)
            return rc.Geometry.Mesh.CreateFromPlanarBoundary(rect, mesh_params)
        
        return mesh_from_rect(self.to_rect(), grid_size)
    
    def contains_pt(self, pt):
        pt = rs.coerce3dpoint(pt)
        if pt.X < self.x or pt.X > (self.x + self.dim_x) or pt.Y < self.y or pt.Y > (self.y + self.dim_y):
            return False
        return True
    
    def intersects(self, other):
        """
            TODO - swap this for an implementation that just
                tests for inverval inclusion
        """
        for pt in self.geo_pts: 
            if other.contains_pt(pt): return True
        for pt in other.geo_pts: 
            if self.contains_pt(pt): return True
            
        return False
    
    @classmethod
    def from_center_pt(cls, pt, dim_x, dim_y):
        pt = rs.coerce3dpoint(pt)
            
        geo_pts = [rc.Geometry.Point3d(pt.X+dim_x/2, pt.Y+dim_y/2, pt.Z),
            rc.Geometry.Point3d(pt.X+dim_x/2, pt.Y-dim_y/2, pt.Z),
            rc.Geometry.Point3d(pt.X-dim_x/2, pt.Y-dim_y/2, pt.Z),
            rc.Geometry.Point3d(pt.X-dim_x/2, pt.Y+dim_y/2, pt.Z)]
        
        return cls(pts=geo_pts, dim_x=dim_x, dim_y=dim_y)


class Entity(object):
    
    def __init__(self, attr):
        self._pos = defaultdict(lambda: None)
        self._attr = attr
        self._type = 'entity'
    
    def __repr__(self):
        return "Environment Entity: {0} : {1} ".format(self.type, self.name)

    @property
    def name(self):
        return self.get_attribute('name')

    @property
    def position(self):
        return self._pos[0]
    
    def set_position(self, pos, gen=0):
        self._pos[gen] = pos
    
    def get_position(self, gen=0):
        return self._pos[gen]
    
    @property
    def type(self):
        return self._type
    
    def set_type(self, type):
        self._type = type
    
    @property
    def attributes(self): return self._attr
    
    def set_attribute(self, key, value):
        self._attr[key] = value
    
    def get_attribute(self, key):
        
        def _finditem(obj, key):
            if key in obj: return obj[key]
            for k, v in obj.items():
                if isinstance(v,dict):
                    item = _finditem(v, key)
                    if item is not None:
                        return item
                        
        return _finditem(self.attributes, key)
    
    def has_attribute_value(self, val):
        
        def _findvalue(obj, val):
            if val in obj.values(): return True
            for k,v in obj.items():
                if isinstance(v,dict):
                    value = _findvalue(v, val)
                    if value is not None:
                        return True
            return False
        
        return _findvalue(self.attributes, val)


class Node(Entity):
    
    def __init__(self, pos, attr={}):
        super(Node, self).__init__(attr)
        self.set_position(pos)
        self.set_type('node')

        
class Template(Entity):
    
    def __init__(self, attr={}):
        super(Template, self).__init__(attr)
        self.set_type('template')
    
    @property
    def edges(self):
        return self.get_attribute('edges')

class Floor(Entity):
    
    def __init__(self, geo, attr={}):
        super(Floor, self).__init__(attr)
        self._geo = rs.coercecurve(geo)
        self._bds = Bounds2d(geo=geo)
        self._map = None
        self._msh = None
        self._grid = None
        self._grid_size = None
        self._coords = {}
        
        self.set_position(self.bounds.origin)
        self.set_type('floor')
        
    @property
    def geo(self):
        return self._geo
    
    @property
    def bounds(self):
        return self._bds
    
    @property
    def mesh(self):
        return self._msh
        
    @property
    def map(self):
        return self._map
    
    
    @property
    def grid(self):
        return self._grid
        
    def set_grid(self, grid_size):
        
        indexes = []
        denom = m.sqrt(2*(grid_size**2))
        t_mesh = rs.coercemesh(rs.AddPlanarMesh(self.geo))
        self._msh = self.bounds.to_grid(grid_size)
        self._map = Map(self)
        self._grid_size = grid_size
        
        for i, cpt in enumerate(rs.MeshFaceCenters(self.mesh)):
            line = rc.Geometry.Line(cpt, rc.Geometry.Vector3d(0,0,1))
            if not rc.Geometry.Intersect.Intersection.MeshLine(t_mesh, line)[1]:
                indexes.append(i)

        self.mesh.Faces.DeleteFaces(indexes)
        self._grid = rs.MeshFaceCenters(self.mesh)
        
        for i, pt in enumerate(self.grid):
            self.set_coord(self.to_grid_coord(pt), i)
        
        for i, vertex in enumerate(self.mesh.Vertices):

            edges = self.mesh.TopologyVertices.ConnectedFaces(i)
            for e1 in edges:
                for e2 in edges:
                    if not e1 == e2:
                        weight = rs.Distance(self._grid[e1], self._grid[e2])/denom
                        self.map.add_edge(e1,e2, weight)
                        
        self.add_edge_map()
    
    @property
    def grid_size(self):
        return self._grid_size
    
    @property
    def coords(self):
        return self._coords
    
    def set_coord(self, key, val):
        self._coords[key] = val
    
    def get_index_at_coord(self, key):
        return self._coords[key]
    
    def to_grid_coord(self, pt):
        
        grid_x = self.bounds.dim_x / m.floor(self.bounds.dim_x / self.grid_size)
        grid_y = self.bounds.dim_y / m.floor(self.bounds.dim_y / self.grid_size)
        
        cs_x = m.floor(self.bounds.dim_x / grid_x)
        cs_y = m.floor(self.bounds.dim_y / grid_y)

        pt_x = m.floor((pt.X - self.position.X)/ grid_x)
        pt_y = m.floor((pt.Y - self.position.Y)/ grid_y)
        
        return (pt_x, pt_y)
    
    def to_grid_index(self, pt):
        
        coord = self.to_grid_coord(pt)
        return self.get_index_at_coord(coord)
    
    def to_grid_bounds(self, pt):
        return Bounds2d.from_center_pt(pt, self.grid_size, self.grid_size)
    
    
    def contains_pt(self, pt):
        if self.bounds.contains_pt(pt):
            if rs.PointInPlanarClosedCurve(pt, self.geo): return True
        return False
    
    
    def add_edge_map(self):
        
        def _func(num):
            if num == 8: return 0
            else: return 0.5
            
        for i, pt in enumerate(self.grid):
            edges = self.map.edges[i]
            self.map.set_barrier(i, _func(len(edges)))
    
    def add_barrier_map(self, barrier):
        for i, pt in enumerate(self.grid):
            if barrier.bounds.contains_pt(pt):
                if rs.PointInPlanarClosedCurve(pt, barrier.geo):
                    self.map.set_barrier(i, float('inf'))
                    for e in self.map.edges[i]:
                        self.map.set_barrier(e, 0.5)
            
            elif barrier.bounds.intersects(self.to_grid_bounds(pt)):
                self.map.set_barrier(i, 0.5)
                

        
class Barrier(Entity):
    
    def __init__(self, geo, attr={}):
        super(Barrier, self).__init__(attr)
        self._geo = rs.coercecurve(geo)
        self._bds = Bounds2d(geo=geo)
        
        self.set_position(self.bounds.origin)
        self.set_type('barrier')
        
    @property
    def geo(self):
        return self._geo
    
    @property
    def bounds(self):
        return self._bds
    
    @property
    def floor(self):
        return self.get_attribute('floor')
        

class Agent(Entity):
    
    def __init__(self, pos=None, attr={}, env=None):
        super(Agent, self).__init__(attr)
        self._attr = attr
        self._env = env
        self._state = None
        self._history = []
        self._path = []
        
        self.set_position(pos)
        self.set_type('agent')
        
        self.age = 0
        self.__hold = None
        self.is_active = True
        self.is_complete = False
                
    
    
    @property
    def position(self):
        return self.get_position(self.age)
        
    def shift(self):
        
        """
            TODO - not clean at all - Make this better
        """
        next_position = self.state[-2]
        if type(next_position) == Node:
            next_position = self.environment.floors[0].to_grid_index(next_position.position)
            
        _index =  self._path[-1].index(next_position)
        self._path[-1].insert(_index, next_position)
        self.history.append(self.position)
        
        self.environment.floors[0].map.add_occupancy(self.position, self.age)

        keys = self._pos.keys()
        keys.sort()
        keys = keys[self.age:]
        keys.reverse()
        _dict = copy.copy(self._pos)
        for ki in range(len(keys)):
            _dict[keys[ki]+1] = _dict[keys[ki]]
            self.environment.floors[0].map.density_map[keys[ki]][_dict[keys[ki]]] -=1
            self.environment.floors[0].map.density_map[keys[ki]][_dict[keys[ki]+1]] +=1
        self._pos = _dict
        
        
        
    @property
    def grid_index(self):
        return self.environment.floors[0].to_grid_index(self.position.position)
    
    @property
    def state(self):
        return self._state
    
    def set_state(self, state):
        self._state = state
    
    @property
    def destination(self):
        val = self.get_attribute('destination')
        return random.choice(self.environment.get_nodes_with_value(val))
    
    
    
    @property
    def path(self):
        _path = sum([p for p in self._path], [])
        _dict = {idx: self.environment.floors[0].grid[idx] for idx in set(_path)}
        return [_dict[p] for p in _path]
    
    def add_path(self, path):
        self._path.append(copy.deepcopy(path))    
    
    @property
    def history(self):
        return self._history
    
    @property
    def visited(self):
        return [n.name for n in self.history if not type(n) == int]
    
    
    
    @property
    def environment(self):
        return self._env
    
    def set_environment(self, env):
        self._env = env
        
    def toggle_active(self):
        self.is_active = not self.is_active
        
    def toggle_complete(self):
        self.is_complete = not self.is_complete
    
    
    
    def step(self):        
        
       
        def wait(time):
            return self.position, [self.position] * time
    
    
        def move(lst):
            
            lst = [l for l in lst if not l.get_attribute('name') in self.visited]
            
            if len(lst):
            
                properties = self.get_attribute('properties')
                keys = properties.keys()
                n_percs = [k for k in keys if random.randint(0,100) <= float(properties[k])]
                
                lst = [(l, self.environment.graph.get_distance((self.position, l))) for l in lst if l.get_attribute('name') in n_percs]
            
                if len(lst):
                    
                    lst.sort(key = lambda tup: len(tup[1]))
                    lst.reverse()
                    
                    while len(lst):
                        
                        tup = lst.pop()
                        n_choice = tup[0]
                        
                        """
                            TODO - switch agents_at_position to consider generation
                                 this currently looks at the amount of people with the same destination
                                 insead of num_people = len(self.environment.agents_at_position(n_choice, self.age))
                        """
                        num_people = len([a for a in self.environment.agents if self.__hold == a.__hold and a != self])
                        capacity = n_choice.get_attribute('capacity')

                        if capacity != None:
                            if num_people < float(capacity):
                                break
                            else:
                                if random.randint(0,100) < self.get_attribute('queuing'):
                                    break
                                else: 
                                    continue
                        else:
                            break
                else:
                    n_choice = self.destination
            else:
                n_choice = self.destination
                self.toggle_complete()
            
            """
                TODO - replace with entity.to_grid_index(environment)
                    nodes need floor property !! important
            """
            n_index = self.environment.floors[0].to_grid_index(n_choice.position)
            n_path = self.environment.floors[0].map.shortest_path(self.grid_index, n_index, start_idx=self.age)

            return n_choice, n_path


        if not len(self.history):

            start_node = self.get_attribute('origin')
            start_positions = self.environment.get_nodes_with_value(start_node)
            start_position = random.choice(start_positions)
            
            self.set_position(start_position)
            self.set_state('waiting')
            
        else:

            if self.is_active:
                
                if self.state == 'ready':
                    
                    self.__hold, path = move(self.environment.graph.edges[self.position])
                    self.add_path(path)
                    
                    for pi in range(len(path)):
                        self.environment.floors[0].map.add_density(path[pi], self.age+pi)
                        self.set_position(path[pi], self.age+pi)
                    
                    path.reverse()
                    self.set_state(path)
               
               
                if self.state == 'waiting':
                    
                    num_people = len(self.environment.agents_at_position(self.__hold, self.age))+1
                    """
                        TODO - switch to property of node/agent?
                        this is also where the intial arrival time would be implemented and swapped
                    """
                    wait_time = num_people * 1 if len(self._path) != 0 else num_people * random.randint(1,60) 
                                        
                    self.__hold, path = wait(wait_time)
                    self.add_path([self.grid_index] * wait_time)
                    
                    for pi in range(len(path)):
                        self.environment.floors[0].map.add_density(self.grid_index, self.age+pi)
                        self.set_position(path[pi], self.age+pi)
                    
                    path.reverse()
                    self.set_state(path)
               
               
                elif len(self.state) == 1:

                    next_position = self.__hold
                    capacity = next_position.get_attribute('capacity')
                    capacity = int(capacity) if capacity != None else float('inf')
                    num_people = len(self.environment.agents_at_position(next_position, self.age))

                    if num_people > capacity and type(self.position)!= Node:
                        self.state.append(self.position)
                        self.shift()
                        
                        self.age+=1
                        self.state.pop();
                    
                    else:
                        self.set_position(self.__hold, self.age)
                        
                        if self.is_complete:
                            self.set_state('complete')
                            self.toggle_active()
                        else:
                            if self.position == self.state[0]: self.set_state('ready')
                            else: self.set_state('waiting')
                            

                else:

                    next_position = self.state[-2]
                    max_density = 1 * self.environment.resolution 
                    num_people = len(self.environment.agents_at_position(next_position, self.age))
                    next_people = len(self.environment.agents_at_position(next_position, self.age+1))
                    #curr_people = len(self.environment.agents_at_position(self.position, self.age))
                    
                    """
                        TODO - handle infinite while loop, 
                            this is a temporary solution
                    
                    if curr_people > max_density and next_people > max_density:
                        if type(self.position)!= Node:
                            print 'critical density met', next_position
                            max_density += num_people
                    """
                    
                    if num_people > max_density or next_people > max_density:
                        if type(self.position)!= Node:
                            self.state.append(self.position)
                            self.shift()
                        
                    self.age+=1
                    self.state.pop()
                    


        self.history.append(self.position)
        
        
        
class Environment():
    
    def __init__(self, resolution=30):
        self._entities = defaultdict(list)
        self._agents = []
        self._graph = copy.deepcopy(Graph()) # bad - fix later
        self._graph_paths = {}
        self._resolution = resolution
    
    def __repr__(self):
        return 'Environment: {0} agents, {1} nodes, {2} floors'.format(len(self.agents), len(self.graph.nodes), len(self.floors))
    
    @property
    def resolution(self):
        return self._resolution
    
    
    @property
    def entities(self):
        return self._entities
     
    def add_entity(self, entity):
        self.entities[entity.type].append(entity)
    
    def add_entities(self, entities):
        
        
        def _add_floor(entity):
            entity = Floor(entity['geometry'], entity['profile'])
            self.add_floor(entity)
            self.add_entity(entity)
        
        def _add_node(entity):
            entity = Node(entity['position'], entity['profile'])
            self.add_node(entity)
            self.add_entity(entity)
            
        def _add_template(entity):
            entity = Template(entity['profile'])
            self.add_template(entity)
            self.add_entity(entity)
        
        def _add_barrier(entity):
            entity = Barrier(entity['geometry'], entity['profile'])
            self.add_barrier(entity)
            self.add_entity(entity)
        
        def _add_agent(entity):
            entity = Agent(attr=entity['profile'])
            self.add_agent(entity)
            self.add_entity(entity)
        
        
        dict = defaultdict(list)
        for entity in entities:
            dict[entity['type']].append(entity)
        
        if len(dict['floor']):
            for  floor in dict['floor']:
                _add_floor(floor)
        else:
            e = gh.GH_RuntimeMessageLevel.Error
            ghenv.Component.AddRuntimeMessage(e, 'component needs at least one floor')
            return
            
        if len(dict['node']) > 1:
            #ghpythonlib.parallel.run(_add_node, dict['node'], False)
            for node in dict['node']:
                _add_node(node)
        else:
            e = gh.GH_RuntimeMessageLevel.Error
            ghenv.Component.AddRuntimeMessage(e, 'component needs at least two nodes')
            return
              
        if len(dict['template']):
            for template in dict['template']:
                _add_template(template)
        else: self.add_default_template()

        if len(dict['barrier']):
            for barrier in dict['barrier']:
                _add_barrier(barrier)
            
        if len(dict['agent']):
            for agent in dict['agent']:
                _add_agent(agent)
        else:
            w = gh.GH_RuntimeMessageLevel.Warning
            ghenv.Component.AddRuntimeMessage(w, 'no agents in environment')
            
            
            
    @property
    def graph(self):
        return self._graph
    
    @property
    def graph_paths(self):
        return self._graph_paths
    
    def get_graph_path(self, n1, n2):
        
        floor = self.floors[0] # bad - fix later
        """
            TODO if n1 and n2 are on different floors - handle
        """
        idx1 = floor.to_grid_index(n1.position)
        idx2 = floor.to_grid_index(n2.position)
        return floor.map.shortest_path(idx1, idx2, paths=self.graph_paths[n1])
    
    def set_graph_path(self, key, val):
        self._graph_paths[key] = val
    
    
    
    @property
    def templates(self):
        return [n for n in self.entities['template']]
    
    def add_template(self, template):
        if template.get_attribute('directed') == False:
            for edge in template.edges:
                nodes = [n for n in self.nodes if n.position in edge]
                if len(nodes) == 2:
                    path = self.get_graph_path(nodes[0], nodes[1])
                    self.graph.add_edge(nodes[0], nodes[1], path)
    
    def add_default_template(self):
        for n1 in self.graph.nodes:
            for n2 in self.graph.nodes:
                if not n1 == n2: 
                    path = self.get_graph_path(n1, n2)
                    self.graph.add_edge(n1, n2, path)
    
    
    
    @property
    def agents(self):
        return self._agents
        
    def add_agent(self, agent, other=None):
        agent.set_environment(self)
        self.agents.append(agent)
    
    def agents_at_position(self, position, gen=0):
        return [a for a in self.agents if a.get_position(gen) == position]

    
    
    @property
    def nodes(self):
        return [n for n in self.entities['node']]
    
    def add_node(self, node):
        self.graph.add_node(node)
        """
            TODO - floors need to be referenced better
        """
        if self.floors[0].contains_pt(node.position):
            djk = self.floors[0].map.dijsktra(self.floors[0].to_grid_index(node.position))
            self.set_graph_path(node, djk[1])
        else:
            w = gh.GH_RuntimeMessageLevel.Warning
            ghenv.Component.AddRuntimeMessage(w, node.name +' was flagged as not on a floor')
            
            """
                TODO - find closest point on grid
            """
        

    
    def get_nodes_with_value(self, val):
        return [n for n in self.nodes if n.has_attribute_value(val)]
    
    
    
    @property
    def floors(self):
        return [n for n in self.entities['floor']]
    
    def add_floor(self, floor):
        floor.set_grid(self.resolution)
    
    def set_grid(self, grid_size):
        
        """
            TODO - implement more complexity
            grids will need to match up between floors
               - maybe 1 unified graph to hold graphs?
        """
        for floor in self.floors: floor.set_grid(grid_size)
    
    
    
    @property
    def barriers(self):
        return [n for n in self.entities['barriers']]
    
    def add_barrier(self, barrier):
        for floor in self.floors:
            if barrier.floor == floor.name:
                floor.add_barrier_map(barrier)
    
    
    
    @property
    def paths(self):
        return [a.path for a in self.agents]
        
    def generation(self, gen):
        return [a.get_position(gen) for a in self.agents]

    def step(self):
        
        def _func(agent):
            if agent.is_active:
                agent.step()
                   
        for i, agent in enumerate(self.agents):
            _func(agent)
            
    def run(self):
        count = 0
        while len([a for a in self.agents if a.is_active]) and count < 1000:
            self.step()
            count+=1
            
        if count == 1000: print ">>>>>>>>>>>>>>>>>>>>>>>>> broke outer while loop"
        

if len(entities) != 0 and res != None:
    environment = Environment(resolution=res)
    environment.add_entities([e for e in entities if e != None])
    
    a = environment
# ---------- end env_2 ----------
env_3 = PythonScript(entities=flatten([barrier_3.a, floor_3.a, node_5.a, node_4.a, agent_4.a]), res=number_slider_5)  # -> out, a; inputs entities: list; disabled
# ---------- env_3: Python ----------
from collections import defaultdict
import rhinoscriptsyntax as rs
import Rhino as rc
import scriptcontext as sc
import random, copy
from itertools import permutations
import math as m
import Grasshopper.Kernel as gh

import ghpythonlib.parallel

class Graph(object):
    
    def __init__(self, nodes=set(), edges=defaultdict(set), distances={}):
        """
            TODO - FIX - currently resource allocation between graphs is broken
            multiple graphs share the same node set
        """
        self.nodes = nodes
        self.edges = edges
        self.distances = distances 

    def __repr__(self):
        return "Graph: {0} nodes, {1} edges".format(len(self.nodes), len(self.edges))
    
    def add_node(self, value):
        self.nodes.add(value)
        
    def add_edge(self, from_node, to_node, distance):
        self.add_node(from_node)
        self.add_node(to_node)
        
        self.edges[from_node].add(to_node)
        self.edges[to_node].add(from_node)
        self.distances[(from_node, to_node)] = distance
        self.distances[(to_node, from_node)] = distance
    
    
    def get_distance(self, key, gen=0):
        return self.distances[key]
    
    def get_step(self, initial, goal, route):
        return
    
    """
        initial dijsktra from:
        https://gist.github.com/econchick/4666413
    """
    def dijsktra(self, initial, goal=None, start_idx=0):

        visited = {initial: 0}
        path = {}
        nodes = set(self.nodes)

        while nodes:
            min_node = None
            for node in nodes:
                if node in visited:
                    if min_node is None:
                        min_node = node
                    elif visited[node] < visited[min_node]:
                        min_node = node
            if min_node is None:
                break
            nodes.remove(min_node)
            current_weight = visited[min_node]

            gen = self.get_step(min_node, initial, path)

            for edge in self.edges[min_node]:
                distance = self.get_distance((min_node, edge), gen+start_idx)
                weight = current_weight + distance
                if edge not in visited or weight < visited[edge]:
                    
                    visited[edge] = weight
                    path[edge] = min_node
                    
                if goal != None and edge == goal: return visited, path
                        
        return visited, path

    def shortest_path(self, initial_node, goal_node, start_idx=0, paths=None):
        
        if paths == None:
            distances, paths = self.dijsktra(initial_node, goal_node, start_idx)
            
        route = [goal_node]
        while goal_node != initial_node:
            route.append(paths[goal_node])
            goal_node = paths[goal_node]
        route.reverse()
        return route

class Map(Graph):
    
    def __init__(self, floor):
        super(Map, self).__init__()
        self._floor = floor
        self._barrier_map = defaultdict(float)
        self._density_map = defaultdict(lambda : defaultdict(int))
        self._occupancy_map = defaultdict(lambda : defaultdict(int))
        
    @property
    def barrier_map(self):
        return self._barrier_map
    
    def set_barrier(self, key, val):
        self.barrier_map[key] += val
   
    def get_barrier_map(self):
        return [self.barrier_map[k] for k in self.barrier_map.keys()]
        
    @property
    def density_map(self):
        return self._density_map
    
    def get_density(self, key, gen):
        """
            TODO - verify this
        """
        denom = (self.floor.grid_size / 3.28084) **2
        return self.density_map[gen][key] / denom
    
    def get_density_map_at(self, gen):
        return [self.get_density(k, gen) for k in range(len(self.floor.grid))]
    
    def add_density(self, key, gen):
        self.density_map[gen][key] += 1
    
    
            
    @property
    def occupancy_map(self):
        return self._occupancy_map
    
    def get_occupancy(self, key, gen):
        return self.occupancy_map[gen][key]
    
    def get_occupancy_map_at(self, gen):
        return [self.get_occupancy(k, gen) for k in range(len(self.floor.grid))]
    
    def add_occupancy(self, key, gen):
        self.occupancy_map[gen][key] += 1
    
    
        
    @property
    def floor(self):
        return self._floor
    
    def filter(self, key):
        return self.barrier_map[key]
    
    def get_step(self, initial, goal, route):
        path = [initial]
        while initial != goal:
            path.append(route[initial])
            initial = route[initial]
        curr_gen = len(path)
        return curr_gen
    
    def get_distance(self, key, gen):
        dist = self.distances[key]
        density  = self.get_density(key[1], gen)
        overlays = self.filter(key[1])
        
        return dist + overlays + density

class Bounds2d():
    
    def __init__(self, geo):
        self.geo_pts = rs.CurvePoints(geo)
        self._bds = [self.bds_x(self.geo_pts), self.bds_y(self.geo_pts)]
        self._origin = rc.Geometry.Point3d(self.bds[0][0], self.bds[1][0], 0)
        
        self._dim_x = self._bds[0][1] - self._bds[0][0]
        self._dim_y = self._bds[1][1] - self._bds[1][0]
        
    
    @property
    def pts(self):
        return [ rc.Geometry.Point3d(self.bds[0][0], self.bds[1][0], 0),
            rc.Geometry.Point3d(self.bds[0][1], self.bds[1][0], 0),
            rc.Geometry.Point3d(self.bds[0][1], self.bds[1][1], 0),
            rc.Geometry.Point3d(self.bds[0][0], self.bds[1][1], 0)]
    
    @property
    def bds(self):
        return self._bds
    
    @property
    def origin(self):
        return self._origin
    
    def set_origin(self, pt):
        self._origin = pt
    
    @property
    def plane(self):
        return rc.Geometry.Plane(self.origin, rc.Geometry.Vector3d(0,0,1))
    
    @property
    def x(self):
        return self.bds[0][0]
    
    @property
    def y(self):
        return self.bds[1][0]
    
    def bds_x(self, pts):
        pts.sort(key = lambda pt: pt.X)
        return (pts[0].X, pts[-1].X)
    
    def bds_y(self, pts):
        pts.sort(key = lambda pt: pt.Y)
        return (pts[0].Y, pts[-1].Y)
   
    @property
    def dim_x(self):
        return self._dim_x
    
    @property
    def dim_y(self):
        return self._dim_y
    
    @property
    def centroid(self):
        x_average = self.x + self.dim_x/2
        y_average = self.y + self.dim_y/2
        return rc.Geometry.Point3d(x_average, y_average, 0)
    
    def to_rect(self):
        return rc.Geometry.Rectangle3d(self.plane, self.dim_x, self.dim_y)
    
    def to_grid(self, grid_size):
        
        def mesh_from_rect(rect, grid_size):

            mesh_params = rc.Geometry.MeshingParameters.Default
            mesh_params.MaximumEdgeLength = grid_size
            mesh_params.MinimumEdgeLength = grid_size
            mesh_params.GridAspectRatio = 1

            rect = rc.Geometry.Rectangle3d.ToNurbsCurve(rect)
            return rc.Geometry.Mesh.CreateFromPlanarBoundary(rect, mesh_params)
        
        return mesh_from_rect(self.to_rect(), grid_size)
    
    def contains_pt(self, pt):
        pt = rs.coerce3dpoint(pt)
        if pt.X < self.x or pt.X > (self.x + self.dim_x) or pt.Y < self.y or pt.Y > (self.y + self.dim_y):
            return False
        return True


class Entity(object):
    
    def __init__(self, attr):
        self._pos = defaultdict(lambda: None)
        self._attr = attr
        self._type = 'entity'
    
    def __repr__(self):
        return "Environment Entity: {0} : {1} ".format(self.type, self.name)

    @property
    def name(self):
        return self.get_attribute('name')

    @property
    def position(self):
        return self._pos[0]
    
    def set_position(self, pos, gen=0):
        self._pos[gen] = pos
    
    def get_position(self, gen=0):
        return self._pos[gen]
    
    @property
    def type(self):
        return self._type
    
    def set_type(self, type):
        self._type = type
    
    @property
    def attributes(self): return self._attr
    
    def set_attribute(self, key, value):
        self._attr[key] = value
    
    def get_attribute(self, key):
        
        def _finditem(obj, key):
            if key in obj: return obj[key]
            for k, v in obj.items():
                if isinstance(v,dict):
                    item = _finditem(v, key)
                    if item is not None:
                        return item
                        
        return _finditem(self.attributes, key)
    
    def has_attribute_value(self, val):
        
        def _findvalue(obj, val):
            if val in obj.values(): return True
            for k,v in obj.items():
                if isinstance(v,dict):
                    value = _findvalue(v, val)
                    if value is not None:
                        return True
            return False
        
        return _findvalue(self.attributes, val)


class Node(Entity):
    
    def __init__(self, pos, attr={}):
        super(Node, self).__init__(attr)
        self.set_position(pos)
        self.set_type('node')

        
class Template(Entity):
    
    def __init__(self, attr={}):
        super(Template, self).__init__(attr)
        self.set_type('template')
    
    @property
    def edges(self):
        return self.get_attribute('edges')

class Floor(Entity):
    
    def __init__(self, geo, attr={}):
        super(Floor, self).__init__(attr)
        self._geo = rs.coercecurve(geo)
        self._bds = Bounds2d(geo)
        self._map = None
        self._msh = None
        self._grid = None
        self._grid_size = None
        self._coords = {}
        
        self.set_position(self.bounds.origin)
        self.set_type('floor')
        
    @property
    def geo(self):
        return self._geo
    
    @property
    def bounds(self):
        return self._bds
    
    @property
    def mesh(self):
        return self._msh
        
    @property
    def map(self):
        return self._map
    
    
    @property
    def grid(self):
        return self._grid
        
    def set_grid(self, grid_size):
        
        indexes = []
        denom = m.sqrt(2*(grid_size**2))
        t_mesh = rs.coercemesh(rs.AddPlanarMesh(self.geo))
        self._msh = self.bounds.to_grid(grid_size)
        self._map = Map(self)
        self._grid_size = grid_size
        
        for i, cpt in enumerate(rs.MeshFaceCenters(self.mesh)):
            line = rc.Geometry.Line(cpt, rc.Geometry.Vector3d(0,0,1))
            if not rc.Geometry.Intersect.Intersection.MeshLine(t_mesh, line)[1]:
                indexes.append(i)

        self.mesh.Faces.DeleteFaces(indexes)
        self._grid = rs.MeshFaceCenters(self.mesh)
        
        for i, pt in enumerate(self.grid):
            self.set_coord(self.to_grid_coord(pt), i)
        
        for i, vertex in enumerate(self.mesh.Vertices):

            edges = self.mesh.TopologyVertices.ConnectedFaces(i)
            for e1 in edges:
                for e2 in edges:
                    if not e1 == e2:
                        weight = rs.Distance(self._grid[e1], self._grid[e2])/denom
                        self.map.add_edge(e1,e2, weight)
                        
        self.add_edge_map()
    
    @property
    def grid_size(self):
        return self._grid_size
    
    @property
    def coords(self):
        return self._coords
    
    def set_coord(self, key, val):
        self._coords[key] = val
    
    def get_index_at_coord(self, key):
        return self._coords[key]
    
    def to_grid_coord(self, pt):
        
        grid_x = self.bounds.dim_x / m.floor(self.bounds.dim_x / self.grid_size)
        grid_y = self.bounds.dim_y / m.floor(self.bounds.dim_y / self.grid_size)
        
        cs_x = m.floor(self.bounds.dim_x / grid_x)
        cs_y = m.floor(self.bounds.dim_y / grid_y)

        pt_x = m.floor((pt.X - self.position.X)/ grid_x)
        pt_y = m.floor((pt.Y - self.position.Y)/ grid_y)
        
        return (pt_x, pt_y)
    
    def to_grid_index(self, pt):
        
        coord = self.to_grid_coord(pt)
        return self.get_index_at_coord(coord)
    
    
    def add_edge_map(self):
        
        def _func(num):
            if num == 8: return 0
            else: return 0.5
            
        for i, pt in enumerate(self.grid):
            edges = self.map.edges[i]
            self.map.set_barrier(i, _func(len(edges)))
    
    def add_barrier_map(self, barrier):
        for i, pt in enumerate(self.grid):
            if barrier.bounds.contains_pt(pt):
                if rs.PointInPlanarClosedCurve(pt, barrier.geo):
                    self.map.set_barrier(i, float('inf'))
                    for e in self.map.edges[i]:
                        self.map.set_barrier(e, 0.5)

        
class Barrier(Entity):
    
    def __init__(self, geo, attr={}):
        super(Barrier, self).__init__(attr)
        self._geo = rs.coercecurve(geo)
        self._bds = Bounds2d(geo)
        
        self.set_position(self.bounds.origin)
        self.set_type('barrier')
        
    @property
    def geo(self):
        return self._geo
    
    @property
    def bounds(self):
        return self._bds
    
    @property
    def floor(self):
        return self.get_attribute('floor')
        

class Agent(Entity):
    
    def __init__(self, pos=None, attr={}, env=None):
        super(Agent, self).__init__(attr)
        self._attr = attr
        self._env = env
        self._state = None
        self._history = []
        self._path = []
        
        self.set_position(pos)
        self.set_type('agent')
        
        self.age = 0
        self.__hold = None
        self.is_active = True
        self.is_complete = False
                
    
    
    @property
    def position(self):
        return self.get_position(self.age)
        
    def shift(self):
        
        """
            TODO - not clean at all - Make this better
        """
        next_position = self.state[-2]
        if type(next_position) == Node:
            next_position = self.environment.floors[0].to_grid_index(next_position.position)
            
        _index =  self._path[-1].index(next_position)
        self._path[-1].insert(_index, next_position)
        self.history.append(self.position)
        
        self.environment.floors[0].map.add_occupancy(self.position, self.age)

        keys = self._pos.keys()
        keys.sort()
        keys = keys[self.age:]
        keys.reverse()
        _dict = copy.copy(self._pos)
        for ki in range(len(keys)):
            _dict[keys[ki]+1] = _dict[keys[ki]]
            self.environment.floors[0].map.density_map[keys[ki]][_dict[keys[ki]]] -=1
            self.environment.floors[0].map.density_map[keys[ki]][_dict[keys[ki]+1]] +=1
        self._pos = _dict
        
        
        
    @property
    def grid_index(self):
        return self.environment.floors[0].to_grid_index(self.position.position)
    
    @property
    def state(self):
        return self._state
    
    def set_state(self, state):
        self._state = state
    
    @property
    def destination(self):
        val = self.get_attribute('destination')
        return random.choice(self.environment.get_nodes_with_value(val))
    
    
    
    @property
    def path(self):
        _path = sum([p for p in self._path], [])
        _dict = {idx: self.environment.floors[0].grid[idx] for idx in set(_path)}
        return [_dict[p] for p in _path]
    
    def add_path(self, path):
        self._path.append(copy.deepcopy(path))    
    
    @property
    def history(self):
        return self._history
    
    @property
    def visited(self):
        return [n.name for n in self.history if not type(n) == int]
    
    
    
    @property
    def environment(self):
        return self._env
    
    def set_environment(self, env):
        self._env = env
        
    def toggle_active(self):
        self.is_active = not self.is_active
        
    def toggle_complete(self):
        self.is_complete = not self.is_complete
    
    
    
    def step(self):        
        
       
        def wait(time):
            return self.position, [self.position] * time
    
    
        def move(lst):
            
            lst = [l for l in lst if not l.get_attribute('name') in self.visited]
            
            if len(lst):
            
                properties = self.get_attribute('properties')
                keys = properties.keys()
                n_percs = [k for k in keys if random.randint(0,100) <= properties[k]]
                
                lst = [(l, self.environment.graph.get_distance((self.position, l))) for l in lst if l.get_attribute('name') in n_percs]
            
                if len(lst):
                    
                    lst.sort(key = lambda tup: len(tup[1]))
                    lst.reverse()
                    ncount=0
                    while len(lst):
                        
                        ncount+=1
                        tup = lst.pop()
                        n_choice = tup[0]
                        
                        """
                            TODO - switch agents_at_position to consider generation
                                 this currently looks at the amount of people with the same destination
                                 insead of num_people = len(self.environment.agents_at_position(n_choice, self.age))
                        """
                        num_people = len([a for a in self.environment.agents if self.__hold == a.__hold and a != self])
                        capacity = n_choice.get_attribute('capacity')

                        if capacity != None:
                            if num_people < float(capacity):
                                break
                            else:
                                if random.randint(0,100) < self.get_attribute('queuing'):
                                    break
                                else: 
                                    continue
                        else:
                            break
                else:
                    n_choice = self.destination
            else:
                n_choice = self.destination
                self.toggle_complete()
            
            """
                TODO - replace with entity.to_grid_index(environment)
                    nodes need floor property !! important
            """
            n_index = self.environment.floors[0].to_grid_index(n_choice.position)
            n_path = self.environment.floors[0].map.shortest_path(self.grid_index, n_index, start_idx=self.age)

            return n_choice, n_path


        if not len(self.history):

            start_node = self.get_attribute('origin')
            start_positions = self.environment.get_nodes_with_value(start_node)
            start_position = random.choice(start_positions)
            
            self.set_position(start_position)
            self.set_state('waiting')
            
        else:

            if self.is_active:
                
                if self.state == 'ready':
                    
                    self.__hold, path = move(self.environment.graph.edges[self.position])
                    self.add_path(path)
                    
                    for pi in range(len(path)):
                        self.environment.floors[0].map.add_density(path[pi], self.age+pi)
                        self.set_position(path[pi], self.age+pi)
                    
                    path.reverse()
                    self.set_state(path)
               
               
                if self.state == 'waiting':
                    
                    num_people = len(self.environment.agents_at_position(self.__hold, self.age))+1
                    """
                        TODO - switch to property of node/agent?
                        this is also where the intial arrival time would be implemented and swapped
                    """
                    wait_time = num_people * 1 if len(self._path) != 0 else num_people * random.randint(1,60) 
                                        
                    self.__hold, path = wait(wait_time)
                    self.add_path([self.grid_index] * wait_time)
                    
                    for pi in range(len(path)):
                        self.environment.floors[0].map.add_density(self.grid_index, self.age+pi)
                        self.set_position(path[pi], self.age+pi)
                    
                    path.reverse()
                    self.set_state(path)
               
               
                elif len(self.state) == 1:

                    next_position = self.__hold
                    capacity = next_position.get_attribute('capacity')
                    capacity = int(capacity) if capacity != None else float('inf')
                    num_people = len(self.environment.agents_at_position(next_position, self.age))

                    if num_people > capacity and type(self.position)!= Node:
                        self.state.append(self.position)
                        self.shift()
                        
                        self.age+=1
                        self.state.pop();
                    
                    else:
                        self.set_position(self.__hold, self.age)
                        
                        if self.is_complete:
                            self.set_state('complete')
                            self.toggle_active()
                        else:
                            if self.position == self.state[0]: self.set_state('ready')
                            else: self.set_state('waiting')
                            

                else:

                    next_position = self.state[-2]
                    max_density = 1 * self.environment.resolution 
                    num_people = len(self.environment.agents_at_position(next_position, self.age))
                    next_people = len(self.environment.agents_at_position(next_position, self.age+1))
                    #curr_people = len(self.environment.agents_at_position(self.position, self.age))
                    
                    """
                        TODO - handle infinite while loop, 
                            this is a temporary solution
                    
                    if curr_people > max_density and next_people > max_density:
                        if type(self.position)!= Node:
                            print 'critical density met', next_position
                            max_density += num_people
                    """
                    
                    if num_people > max_density or next_people > max_density:
                        if type(self.position)!= Node:
                            self.state.append(self.position)
                            self.shift()
                        
                    self.age+=1
                    self.state.pop()
                    


        self.history.append(self.position)
        
        
        
class Environment():
    
    def __init__(self, resolution=30):
        self._entities = defaultdict(list)
        self._agents = []
        self._graph = copy.deepcopy(Graph()) # bad - fix later
        self._graph_paths = {}
        self._resolution = resolution
    
    def __repr__(self):
        return 'Environment: {0} agents, {1} nodes, {2} floors'.format(len(self.agents), len(self.graph.nodes), len(self.floors))
    
    @property
    def resolution(self):
        return self._resolution
    
    
    @property
    def entities(self):
        return self._entities
     
    def add_entity(self, entity):
        self.entities[entity.type].append(entity)
    
    def add_entities(self, entities):
        
        
        def _add_floor(entity):
            entity = Floor(entity['geometry'], entity['profile'])
            self.add_floor(entity)
            self.add_entity(entity)
        
        def _add_node(entity):
            entity = Node(entity['position'], entity['profile'])
            self.add_node(entity)
            self.add_entity(entity)
            
        def _add_template(entity):
            entity = Template(entity['profile'])
            self.add_template(entity)
            self.add_entity(entity)
        
        def _add_barrier(entity):
            entity = Barrier(entity['geometry'], entity['profile'])
            self.add_barrier(entity)
            self.add_entity(entity)
        
        def _add_agent(entity):
            entity = Agent(attr=entity['profile'])
            self.add_agent(entity)
            self.add_entity(entity)
        
        
        dict = defaultdict(list)
        for entity in entities:
            dict[entity['type']].append(entity)
        
        if len(dict['floor']):
            for  floor in dict['floor']:
                _add_floor(floor)
        else:
            e = gh.GH_RuntimeMessageLevel.Error
            ghenv.Component.AddRuntimeMessage(e, 'component needs at least one floor')
            return
            
        if len(dict['node']):
            ghpythonlib.parallel.run(_add_node, dict['node'], False)
        else:
            e = gh.GH_RuntimeMessageLevel.Error
            ghenv.Component.AddRuntimeMessage(e, 'component needs at least two nodes')
            return
        
        if len(dict['template']):
            for template in dict['template']:
                _add_template(template)
        else: self.add_default_template()

        if len(dict['barrier']):
            for barrier in dict['barrier']:
                _add_barrier(barrier)
            
        if len(dict['agent']):
            for agent in dict['agent']:
                _add_agent(agent)
        else:
            w = gh.GH_RuntimeMessageLevel.Warning
            ghenv.Component.AddRuntimeMessage(w, 'no agents in environment')
            
            
            
    @property
    def graph(self):
        return self._graph
    
    @property
    def graph_paths(self):
        return self._graph_paths
    
    def get_graph_path(self, n1, n2):
        
        floor = self.floors[0] # bad - fix later
        """
            TODO if n1 and n2 are if different floors - handle
        """
        idx1 = floor.to_grid_index(n1.position)
        idx2 = floor.to_grid_index(n2.position)
        return floor.map.shortest_path(idx1, idx2, paths=self.graph_paths[n1])
    
    def set_graph_path(self, key, val):
        self._graph_paths[key] = val
    
    
    
    @property
    def templates(self):
        return [n for n in self.entities['template']]
    
    def add_template(self, template):
        if template.get_attribute('directed') == False:
            for edge in template.edges:
                nodes = [n for n in self.nodes if n.position in edge]
                if len(nodes) == 2:
                    path = self.get_graph_path(nodes[0], nodes[1])
                    self.graph.add_edge(nodes[0], nodes[1], path)
    
    def add_default_template(self):
        for n1 in self.graph.nodes:
            for n2 in self.graph.nodes:
                if not n1 == n2: 
                    path = self.get_graph_path(n1, n2)
                    self.graph.add_edge(n1, n2, path)
    
    
    
    @property
    def agents(self):
        return self._agents
        
    def add_agent(self, agent, other=None):
        agent.set_environment(self)
        self.agents.append(agent)
    
    def agents_at_position(self, position, gen=0):
        return [a for a in self.agents if a.get_position(gen) == position]

    
    
    @property
    def nodes(self):
        return [n for n in self.entities['node']]
    
    def add_node(self, node):
        self.graph.add_node(node)
        """
            TODO - floors need to be referenced better
        """
        djk = self.floors[0].map.dijsktra(self.floors[0].to_grid_index(node.position))
        self.set_graph_path(node, djk[1])
    
    def get_nodes_with_value(self, val):
        return [n for n in self.nodes if n.has_attribute_value(val)]
    
    
    
    @property
    def floors(self):
        return [n for n in self.entities['floor']]
    
    def add_floor(self, floor):
        floor.set_grid(self.resolution)
    
    def set_grid(self, grid_size):
        
        """
            TODO - implement more complexity
            grids will need to match up between floors
               - maybe 1 unified graph to hold graphs?
        """
        for floor in self.floors: floor.set_grid(grid_size)
    
    
    
    @property
    def barriers(self):
        return [n for n in self.entities['barriers']]
    
    def add_barrier(self, barrier):
        for floor in self.floors:
            if barrier.floor == floor.name:
                floor.add_barrier_map(barrier)
    
    
    
    @property
    def paths(self):
        return [a.path for a in self.agents]
        
    def generation(self, gen):
        return [a.get_position(gen) for a in self.agents]

    def step(self):
        
        def _func(agent):
            if agent.is_active:
                agent.step()
                   
        for i, agent in enumerate(self.agents):
            _func(agent)
            
    def run(self):
        count = 0
        while len([a for a in self.agents if a.is_active]) and count < 1000:
            self.step()
            count+=1
            
        if count == 1000: print ">>>>>>>>>>>>>>>>>>>>>>>>> broke outer while loop"
        

if len(entities) != 0 and res != None:
    environment = Environment(resolution=res)
    environment.add_entities([e for e in entities if e != None])
    
    a = environment
# ---------- end env_3 ----------

geo = Geometry(flatten([pt_7, pt]))  # disabled
geo_2 = Geometry(graft([pt_7, pt]))  # disabled
ln = Line(StartPoint=graft(pt_8), EndPoint=pt_6)  # disabled
ln_2 = Line(StartPoint=geo, EndPoint=geo_2)  # disabled
ln_3 = Line(StartPoint=geo_2, EndPoint=pt_6)  # disabled
template_3 = PythonScript(lines=flatten([ln, ln_3, ln_2]))  # -> out, a; inputs lines: list of Curve; disabled
# ---------- template_3: Python ----------
import rhinoscriptsyntax as rs
import Rhino as rc


if len(lines):
    
    entities = []
    for line in lines:
        entities.append([rs.CurveEndPoint(line), rs.CurveStartPoint(line)])
    entity = {
        'type': 'template',
        'profile': {
            'edges': entities,
            'directed': False
        }
    }
    a = [entity]
# ---------- end template_3 ----------

dam = DataDam(DataA=env_2.a, BufferDelay=2500000, BufferMode=0)
dam_2 = DataDam(DataA=env_3.a, BufferDelay=2500000, BufferMode=0)  # disabled
toggle = BooleanToggle(True)  # disabled
number_slider_6 = Slider(10, range=0..100)  # disabled
profile_9 = PythonScript()  # -> out, a; disabled
# ---------- profile_9: Python ----------
passenger_profile_departing = {
    'name':'passenger',
    'status': {
        'def':'departing',
        'origin':'curbside',
        'destination': 'gate'
    },
    'properties': {
        'curbside': 100,
        'bathroom':100,
        'security': 100,
        'gate': 100
    },
    'influence':{
        'queuing':0,
        'remainder':120
    }
    
}

a = [passenger_profile_departing]
# ---------- end profile_9 ----------
run = PythonScript(env=dam, run=Toggle(True))  # -> out, paths, activity_map, occupancy_map, density_map, barrier_map, mesh
# ---------- run: Python ----------
import clr
clr.AddReference("Grasshopper")
from Grasshopper import DataTree
from Grasshopper.Kernel.Data import GH_Path
from itertools import chain
import copy

path_tree = DataTree[object]()
density_tree = DataTree[object]()

mesh = env.floors[0].mesh

if env != None:

    barrier_map = env.floors[0].map.get_barrier_map()

    if run:
    
        env = copy.deepcopy(env)
        env.run()
        
        for i, path in enumerate(env.paths):
            gh_path = GH_Path(i)
            for p in path: path_tree.Add(p, gh_path)
        
        
        activity = [0] * len(env.floors[0].grid)
        occupancy = [0] * len(env.floors[0].grid)
    
        for gen in env.floors[0].map.density_map.keys():
            
            gh_path = GH_Path(gen)
            
            d_map = env.floors[0].map.get_density_map_at(gen)
            for i, m in enumerate(d_map):
                activity[i] += m
                density_tree.Add(m, gh_path)
                
            o_map = env.floors[0].map.get_occupancy_map_at(gen)
            for j, n in enumerate(o_map):
                occupancy[j] += n
                
        
        activity_map = activity
        occupancy_map = occupancy
        density_map = density_tree
        paths = path_tree
# ---------- end run ----------
run_2 = PythonScript(env=dam_2, run=toggle)  # -> out, paths, activity_map, occupancy_map, density_map, barrier_map, mesh; disabled; same code as run
dup_2 = DuplicateData(Data=profile_9.a, Number=number_slider_6, Order=True)  # disabled
agent_5 = PythonScript(profile=flatten(dup_2))  # -> out, a; inputs profile: list; disabled; same code as agent
pline = PolyLine(Vertices=run.paths, Closed=False)
pline_2 = PolyLine(Vertices=run_2.paths, Closed=False)  # disabled

number_slider_7 = Slider(178, range=0..1000)
item = ListItem(List=run.paths, Index=0, Wrap=Toggle(False))
cullpt = CullDuplicates(Points=flatten(item), Tolerance=0.1, CullMode=3)  # -> graft(Points), Indices, graft(Valence)
rectangle = Rectangle(Plane=cullpt.Points, XSize="-1 to 1", YSize="-1 to 1", Radius=0)  # -> Rectangle, Length
bnd = Bounds(Numbers=flatten(cullpt.Valence))
panel_30 = Panel(bnd)
boundary_4 = BoundarySurfaces(Edges=rectangle.Rectangle)
lng = ListLength(List=flatten(rectangle.Rectangle))
series = Series(Start=0, Step=1, Count=lng)  # -> graft(Series)
popgeo = PopulateGeometry(Geometry=boundary_4, Count=cullpt.Valence, Seed=series)
gradient = Gradient(
    LowerLimit="1",
    UpperLimit="4",
    Parameter=cullpt.Valence,
    stops=[0: RGB(0, 128, 0), 0.5: RGB(255, 255, 0), 1: RGB(255, 0, 0)])
cir = Circle(Plane=popgeo, Radius=Slider(0.5, range=0..1))
boundary_5 = BoundarySurfaces(Edges=cir)
preview = CustomPreview(Geometry=boundary_5, Shader=gradient)

number_slider_8 = Slider(178, range=0..1000)  # disabled
toggle_2 = BooleanToggle(False)  # disabled
item_2 = ListItem(List=run_2.paths, Index=0, Wrap=toggle_2)  # disabled
cullpt_2 = CullDuplicates(Points=flatten(item_2), Tolerance=0.1, CullMode=3)  # -> graft(Points), Indices, graft(Valence); disabled
panel_31 = Panel("-1 to 1")  # disabled
rectangle_2 = Rectangle(Plane=cullpt_2.Points, XSize=panel_31, YSize=panel_31, Radius=0)  # -> Rectangle, Length; disabled
bnd_2 = Bounds(Numbers=flatten(cullpt_2.Valence))  # disabled
panel_32 = Panel(bnd_2)  # disabled
boundary_6 = BoundarySurfaces(Edges=rectangle_2.Rectangle)  # disabled
lng_2 = ListLength(List=flatten(rectangle_2.Rectangle))  # disabled
series_2 = Series(Start=0, Step=1, Count=lng_2)  # -> graft(Series); disabled
popgeo_2 = PopulateGeometry(Geometry=boundary_6, Count=cullpt_2.Valence, Seed=series_2)  # disabled
panel_33 = Panel("4")  # disabled
panel_34 = Panel("1")  # disabled
number_slider_9 = Slider(0.5, range=0..1)  # disabled
gradient_2 = Gradient(
    LowerLimit=panel_34,
    UpperLimit=panel_33,
    Parameter=cullpt_2.Valence,
    stops=[0: RGB(0, 128, 0), 0.5: RGB(255, 255, 0), 1: RGB(255, 0, 0)])  # disabled
cir_2 = Circle(Plane=popgeo_2, Radius=number_slider_9)  # disabled
boundary_7 = BoundarySurfaces(Edges=cir_2)  # disabled
preview_2 = CustomPreview(Geometry=boundary_7, Shader=gradient_2)  # disabled

button = Button()
button_2 = Button()  # disabled
timer = Timer(TimerInterval=20)
timer_2 = Timer(TimerInterval=20)  # disabled
node_count = Panel("8")
node_count_2 = Panel("8")  # disabled
series_3 = Series(Start=0, Step=1, Count=node_count)

# ---- group: activity map
Z = UnitZ(Factor=-1)
equals = Equality(FirstNumber=run.activity_map, SecondNumber="0")  # -> Equality, Inequality
move = Move(Geometry=run.mesh, Motion=Z)  # -> Geometry, Transform
cullf = CullFaces(Mesh=move.Geometry, Pattern=equals.Equality)
cull = CullPattern(List=run.activity_map, CullPattern=equals.Inequality)
sort = SortList(Keys=cull)  # -> Keys, ValuesA
cull_i = CullIndex(List=reverse(sort.Keys), Indices=series_3, Wrap=True)
bnd_3 = Bounds(Numbers=cull_i)
remap = RemapNumbers(Value=cull, Source=bnd_3, Target=Domain(0, 1))  # -> Mapped, Clipped
gradient_3 = Gradient(
    LowerLimit="1",
    UpperLimit="0",
    Parameter=remap.Mapped,
    stops=[0: RGB(234, 38, 0), 0.25: RGB(234, 126, 0), 0.5: RGB(254, 244, 84), 0.75: RGB(173, 203, 249), 1: RGB(75, 107, 169)])
preview_3 = CustomPreview(Shader=gradient_3)

# ----
series_4 = Series(Start=0, Step=1, Count=node_count_2)  # disabled

# ---- group: activity map
Z_2 = UnitZ(Factor=-1)  # disabled
panel_35 = Panel("0")  # disabled
equals_2 = Equality(FirstNumber=run_2.activity_map, SecondNumber=panel_35)  # -> Equality, Inequality; disabled
move_2 = Move(Geometry=run_2.mesh, Motion=Z_2)  # -> Geometry, Transform; disabled
cullf_2 = CullFaces(Mesh=move_2.Geometry, Pattern=equals_2.Equality)  # disabled
cull_2 = CullPattern(List=run_2.activity_map, CullPattern=equals_2.Inequality)  # disabled
sort_2 = SortList(Keys=cull_2)  # -> Keys, ValuesA; disabled
cull_i_2 = CullIndex(List=reverse(sort_2.Keys), Indices=series_4, Wrap=True)  # disabled
bnd_4 = Bounds(Numbers=cull_i_2)  # disabled
remap_2 = RemapNumbers(Value=cull_2, Source=bnd_4, Target=Domain(0, 1))  # -> Mapped, Clipped; disabled
panel_36 = Panel("1")  # disabled
panel_37 = Panel("0")  # disabled
gradient_4 = Gradient(
    LowerLimit=panel_36,
    UpperLimit=panel_37,
    Parameter=remap_2.Mapped,
    stops=[0: RGB(234, 38, 0), 0.25: RGB(234, 126, 0), 0.5: RGB(254, 244, 84), 0.75: RGB(173, 203, 249), 1: RGB(75, 107, 169)])  # disabled
preview_4 = CustomPreview(Shader=gradient_4)  # disabled

# ----
sort_3 = SortList(Keys=run.occupancy_map)  # -> Keys, ValuesA
cull_i_3 = CullIndex(List=reverse(sort_3.Keys), Indices=series_3, Wrap=True)
Z_3 = UnitZ(Factor=-1)
bnd_5 = Bounds(Numbers=cull_i_3)
move_3 = Move(Geometry=run.mesh, Motion=Z_3)  # -> Geometry, Transform
remap_3 = RemapNumbers(Value=run.occupancy_map, Source=bnd_5, Target=Domain(0, 1))  # -> Mapped, Clipped
graph = GraphMapper(remap_3.Mapped, x0=0, x1=1, y0=0, y1=1, container_name="Bezier", cpx=[0, 0.25, 0.75, 1], cpy=[0, 0.25, 0.75, 1])
gradient_5 = Gradient(
    LowerLimit="1",
    UpperLimit="0",
    Parameter=graph,
    stops=[0: RGB(234, 38, 0), 0.25: RGB(234, 126, 0), 0.5: RGB(254, 244, 84), 0.75: RGB(173, 203, 249), 1: RGB(75, 107, 169)])
preview_5 = CustomPreview(Shader=gradient_5)

sort_4 = SortList(Keys=run_2.occupancy_map)  # -> Keys, ValuesA; disabled
cull_i_4 = CullIndex(List=reverse(sort_4.Keys), Indices=series_4, Wrap=True)  # disabled
Z_4 = UnitZ(Factor=-1)  # disabled
bnd_6 = Bounds(Numbers=cull_i_4)  # disabled
move_4 = Move(Geometry=run_2.mesh, Motion=Z_4)  # -> Geometry, Transform; disabled
remap_4 = RemapNumbers(Value=run_2.occupancy_map, Source=bnd_6, Target=Domain(0, 1))  # -> Mapped, Clipped; disabled
graph_2 = GraphMapper(remap_4.Mapped, x0=0, x1=1, y0=0, y1=1, container_name="Bezier", cpx=[0, 0.25, 0.75, 1], cpy=[0, 0.25, 0.75, 1])  # disabled
panel_38 = Panel("1")  # disabled
panel_39 = Panel("0")  # disabled
gradient_6 = Gradient(
    LowerLimit=panel_38,
    UpperLimit=panel_39,
    Parameter=graph_2,
    stops=[0: RGB(234, 38, 0), 0.25: RGB(234, 126, 0), 0.5: RGB(254, 244, 84), 0.75: RGB(173, 203, 249), 1: RGB(75, 107, 169)])  # disabled
preview_6 = CustomPreview(Shader=gradient_6)  # disabled

Z_5 = UnitZ(Factor=-1)
move_5 = Move(Geometry=run.mesh, Motion=Z_5)  # -> Geometry, Transform
branch = TreeBranch(Tree=run.density_map, Path=Slider(0, range=0..100), MaintainPaths=True)
bnd_7 = Bounds(Numbers=branch)
remap_5 = RemapNumbers(Value=branch, Source=bnd_7, Target=Domain(0, 1))  # -> Mapped, Clipped
gradient_7 = Gradient(
    LowerLimit="1",
    UpperLimit="0",
    Parameter=remap_5.Mapped,
    stops=[0: RGB(234, 38, 0), 0.25: RGB(234, 126, 0), 0.5: RGB(254, 244, 84), 0.75: RGB(173, 203, 249), 1: RGB(75, 107, 169)])
preview_7 = CustomPreview(Shader=gradient_7)

Z_6 = UnitZ(Factor=-1)  # disabled
number_slider_10 = Slider(0, range=0..100)  # disabled
move_6 = Move(Geometry=run_2.mesh, Motion=Z_6)  # -> Geometry, Transform; disabled
branch_2 = TreeBranch(Tree=run_2.density_map, Path=number_slider_10, MaintainPaths=True)  # disabled
bnd_8 = Bounds(Numbers=branch_2)  # disabled
remap_6 = RemapNumbers(Value=branch_2, Source=bnd_8, Target=Domain(0, 1))  # -> Mapped, Clipped; disabled
panel_40 = Panel("1")  # disabled
panel_41 = Panel("0")  # disabled
gradient_8 = Gradient(
    LowerLimit=panel_40,
    UpperLimit=panel_41,
    Parameter=remap_6.Mapped,
    stops=[0: RGB(234, 38, 0), 0.25: RGB(234, 126, 0), 0.5: RGB(254, 244, 84), 0.75: RGB(173, 203, 249), 1: RGB(75, 107, 169)])  # disabled
preview_8 = CustomPreview(Shader=gradient_8)  # disabled

Z_7 = UnitZ(Factor=-1)  # disabled
panel_42 = Panel("1")  # disabled
panel_43 = Panel("0")  # disabled
gradient_9 = Gradient(LowerLimit=panel_42, UpperLimit=panel_43, Parameter=run_2.barrier_map, stops=[0: RGB(255, 255, 255), 1: RGB(0, 0, 0)])  # disabled
move_7 = Move(Geometry=run_2.mesh, Motion=Z_7)  # -> Geometry, Transform; disabled
preview_9 = CustomPreview(Shader=gradient_9)  # disabled

facen = FaceNormals(Mesh=move_7.Geometry)  # -> Centers, Normals; disabled
lng_3 = ListLength(List=facen.Centers)  # disabled
number_slider_11 = Slider(0.55, range=0..1)  # disabled
series_5 = Series(Start=0, Step=1, Count=lng_3)  # disabled
int = Integer(series_5)  # disabled
tag = TextTag3D(Location=facen.Centers, Text=int, Size=number_slider_11, Justification=7)  # disabled

Z_8 = UnitZ(Factor=-1)
gradient_10 = Gradient(LowerLimit="1", UpperLimit="0", Parameter=run.barrier_map, stops=[0: RGB(255, 255, 255), 1: RGB(0, 0, 0)])
move_8 = Move(Geometry=run.mesh, Motion=Z_8)  # -> Geometry, Transform

facen_2 = FaceNormals(Mesh=move_8.Geometry)  # -> Centers, Normals
lng_4 = ListLength(List=facen_2.Centers)
series_6 = Series(Start=0, Step=1, Count=lng_4)
int_2 = Integer(series_6)
tag_2 = TextTag3D(Location=facen_2.Centers, Text=int_2, Size=Slider(0.55, range=0..1), Justification=7)

demesh = DeconstructMesh(Mesh=move_8.Geometry)  # -> Vertices, Faces, Colours, Normals
conmesh = ConstructMesh(Vertices=demesh.Vertices, Faces=graft(demesh.Faces))

preview_10 = CustomPreview(Geometry=flatten(conmesh), Shader=gradient_10)
