# Grasshopper definition example_00.gh (Grasshopper 0.9.76)
# plug-ins: MeshEdit Components, Human, Circulation, Kangaroo Components

# ----
# the node name is how most of the other components refer to this set of locations
node_name = Panel("restaurant")  # disabled

# ----
# the node location is a point that determines the location of this node. it is also the access point for the node if it has a geometry attributed to it in the settings
node_location = Point()  # disabled

# ----
# node settings are optional, and allows the node to function as a zone, attribute a time to spend at this location, and track density at that node.
dwell_time_in_seconds = Panel("600 to 900")  # disabled
node_curves = Geometry()  # disabled
settings = NodeSettings(DistributionInterval=dwell_time_in_seconds, Geometry=node_curves)  # disabled

# ----
# barrier curves represent the shape of the barrier on the floor
barrier_curves = Geometry([<curve referenced from the Rhino model> x28])  # disabled

# ----
# the agent count represents how many agents of this type to produce
# agent settings are an optional component t o add functionality to the agent journey, including dwell propensities, distributions and the number of agents of this type to create
number_of_agents = Slider(1, range=0..5000)  # disabled

# ----
# the name of the nodes to visit during the journey
dwell_node_names = Panel("""bathroom
shop
restaurant""")  # disabled

# ----
# the distribution is the interval during which agents of this type are spawned
agent_initialization_distribution_in_sec = Panel("0 to 1200")  # "agent initialization distribution in seconds"; disabled

# ----
# these represent the propensity of the agent to visit nodes of this type during their journey. It works on a longest list, so if there is only one value here, it will assign it to all the nodes.
dwell_node_propensities = Panel("""0.2
0.8
0.3""")  # disabled

# ----
# the outer boundary curve of this floor entity. floor boundaries such as structural openings should be added as barriers entities on this floor
floor_boundary = Geometry(<curve referenced from the Rhino model>)  # disabled

# ----
# the likelyhood of this agent type to visit nodes with many agents
queuing_propensity = Panel("0.9")  # disabled

# ----
# the name of this floor. this is what is referenced by other entities to know where they are in the environment
floor_name = Panel("floor")  # disabled

# ----
# the name of the floor this node is on. future implementations would potentially include multiple floors with a link component for access
node_floor = Panel(floor_name)  # disabled
node_floor_2 = Panel("floor")  # disabled

dwell_time_in_seconds_2 = Panel("600 to 900")  # disabled
node_name_2 = Panel("shop")  # disabled
node_location_2 = Point()  # disabled
node_curves_2 = Geometry()  # disabled
settings_2 = NodeSettings(DistributionInterval=dwell_time_in_seconds_2, Geometry=node_curves_2)  # disabled
node = Node(Position=node_location_2, Name=node_name_2, Floor=floor_name, Settings=settings_2)  # disabled

dwell_time_in_seconds_3 = Panel("120 to 360")  # disabled
node_name_3 = Panel("bathroom")  # disabled
node_location_3 = Point()  # disabled
node_curves_3 = Geometry()  # disabled
settings_3 = NodeSettings(DistributionInterval=dwell_time_in_seconds_3, Geometry=node_curves_3)  # disabled
node_2 = Node(Position=node_location_3, Name=node_name_3, Floor=floor_name, Settings=settings_3)  # disabled

node_location_4 = Point([<point referenced from the Rhino model> x22])  # disabled
node_name_4 = Panel("access")  # disabled
node_3 = Node(Position=node_location_4, Name=node_name_4, Floor=floor_name)  # disabled

# ----
# barriers are generic obstacles that impede agent walks
barrier = Barrier(Boundary=barrier_curves, Floor=floor_name)  # disabled

# ----
# nodes are destination points for agents. they can be start/end points for the agent, or dwell locations with propensities.
node_4 = Node(Position=node_location, Name=node_name, Floor=node_floor, Settings=settings)  # disabled

# ----
# the floor entity is responsible for storing and calculating the paths and densities for all entities that are on it, and produlcing the visual output for analysis
floor = Floor(Boundary=floor_boundary, Name=floor_name)  # disabled

floor_name_2 = Panel("floor")
barrier_curves_2 = Geometry([<curve referenced from the Rhino model> x295])
floor_boundary_2 = Geometry(<curve referenced from the Rhino model>)
agent_name = Panel("agent")

# ----
# this toggles whether the template is bidirectional. if false, agents will onle be able to move from the start of the line to the end, but not the other direction - for example in security scenarios with restaurants on the airside and landside of the terminal. once through, agents should not be able to go back.
toggle = BooleanToggle(False)  # disabled

# ----
# the name of the node this agent type starts on. in this case, agents enter and exit the simulation through access nodes, but they could be two different node types, such as security and boarding for aviation
agent_origin = Panel(node_name_4)  # disabled

# ----
# template curves are representative of possible paths between nodes. if two node positions are not connected by a curve, the agents will not be able to move between them without possibly visiting an in-between node
ln = Line(StartPoint=graft(node_location_4), EndPoint=node_location)  # -> flatten(Line); disabled
ln_2 = Line(StartPoint=graft(node_location_4), EndPoint=node_location_2)  # -> flatten(Line); disabled

# ----
# the name of this agent type. multiple agent types should have unique names
agent_name_2 = Panel("agent")  # disabled

pt = Point(Point(8868.393389, -2310.413304, 0))
pt_2 = Point(Point(8740.391085, -2355.68431, 0))
barrier_2 = Barrier(Boundary=barrier_curves_2, Floor=floor_name_2)
floor_2 = Floor(Boundary=floor_boundary_2, Name=floor_name_2)
node_5 = Node(Position=pt, Name="end", Floor=floor_name_2)
node_6 = Node(Position=pt_2, Name="start", Floor=floor_name_2)

# ----
# the template entity is an optional component that offers more control of which nodes can be accessed from where. it builds a graph of node connections, allowing agent entities to move strictly between a node and its connected edges. if this component is not used, the environment will build a default bidirectional one that connects all nodes to each other
# this is an example template but will break the current scheme - it is not set up for these agents. DO NOT USE
template = Template(Lines=[ln_2, ln], Directed=toggle)  # disabled

agent = Agent(Name=agent_name, Origin="start", Destination="end")
number_slider = Slider(1000, range=0..1000)
dup = DuplicateData(Data=agent, Number=Slider(30, range=0..100), Order=True)
env = Environment(Entities=[floor_2, barrier_2, agent, node_6, node_5, dup], Resolution=Slider(1, range=0..1000), Run=Toggle(True))
panel = Panel(env)

# ----
# runs all the agent journeys.
toggle_2 = BooleanToggle(True)  # disabled

# ----
# sets the grid resolution for all the floor entities in this environment. currently resolutions should be set in metric, and should not be lower than 1 for accurate simulation
number_slider_2 = Slider(1, range=0..1000)  # disabled

button = Button()  # disabled
timer = Timer(TimerInterval=20, Target=counter)  # disabled
number_slider_3 = Slider(0, range=0..1000)  # disabled
counter = Counter(Reset=button)  # disabled

floor_name_3 = Panel("floor")

# ----
# node maps return the density values at nodes that have a geometry associated with them. the output is similar to the density map for floors
toggle_3 = BooleanToggle(False)  # disabled

node_name_5 = Panel("bathroom")  # disabled
nmap = NodeMap(Environment=env, NodeName=node_name_5, NonZero=toggle_3)  # -> Mesh, Values; disabled

node_name_6 = Panel("shop")  # disabled
nmap_2 = NodeMap(Environment=env, NodeName=node_name_6, NonZero=toggle_3)  # -> Mesh, Values; disabled

# ----
# the name of the agent to pull path information from
agent_name_3 = Panel("agent")

# ----
# the name of the floor to pull map information from
floor_name_4 = Panel("floor")

node_name_7 = Panel("restaurant")  # disabled
nmap_3 = NodeMap(Environment=env, NodeName=node_name_7, NonZero=toggle_3)  # -> Mesh, Values; disabled

button_2 = Button()  # disabled
timer_2 = Timer(TimerInterval=20, Target=counter_2)  # disabled
number_slider_4 = Slider(0, range=0..1000)  # disabled
counter_2 = Counter(Reset=button_2)  # disabled

# ----
# barrier maps pull information about collision detection on a specific floor. this is usefull for debugging resolution and barrier location geometry
bmap = BarrierMap(Environment=env, FloorName=floor_name_4)  # -> Mesh, Values

# ----
# agent paths returns a list of all the locations that an agent was at for each generation in a simulation, as indexes on the mesh. this could be output as points later, as this might be most useful
apaths = AgentPaths(Environment=env, AgentName=agent_name_3)  # -> Mesh, Indexes, Log

dmap = DensityMap(Environment=env, FloorName=floor_name_3, NonZero=Toggle(True))  # -> Mesh, Values

explode = MeshExplode(Mesh=apaths.Mesh, Interpolate=False)
facen = FaceNormals(Mesh=explode)  # -> flatten(Centers), Normals
item = ListItem(List=facen.Centers, Index=apaths.Indexes, Wrap=True)
pline = PolyLine(Vertices=item, Closed=False)
previewlw = CustomPreviewLineweights(
    Geometry=pline,
    Shader={ambient=RGB(0, 0, 0), diffuse=RGB(255, 105, 180), emission=RGB(76, 32, 54), shine=0.5, specular=RGB(255, 255, 255), transparency=0},
    Thickness=Slider(4, range=0..10),
    Absolute=False)

gradient = Gradient(
    LowerLimit=1,
    UpperLimit=0,
    Parameter=dmap.Values,
    stops=[0: RGB(255, 128, 255), 0.25: RGB(234, 126, 0), 0.5: RGB(254, 244, 84), 0.75: RGB(173, 203, 249), 1: RGB(75, 107, 169)])
explode_2 = MeshExplode(Mesh=dmap.Mesh, Interpolate=False)
preview = CustomPreview(Geometry=explode_2, Shader=gradient)

gradient_2 = Gradient(
    LowerLimit=1,
    UpperLimit=0,
    Parameter=nmap_3.Values,
    stops=[0: RGB(234, 38, 0), 0.25: RGB(234, 126, 0), 0.5: RGB(254, 244, 84), 0.75: RGB(173, 203, 249), 1: RGB(75, 107, 169)])  # disabled
preview_2 = CustomPreview(Geometry=nmap_3.Mesh, Shader=gradient_2)  # disabled

gradient_3 = Gradient(
    LowerLimit=1,
    UpperLimit=0,
    Parameter=nmap.Values,
    stops=[0: RGB(234, 38, 0), 0.25: RGB(234, 126, 0), 0.5: RGB(254, 244, 84), 0.75: RGB(173, 203, 249), 1: RGB(75, 107, 169)])  # disabled
preview_3 = CustomPreview(Geometry=nmap.Mesh, Shader=gradient_3)  # disabled

gradient_4 = Gradient(
    LowerLimit=1,
    UpperLimit=0,
    Parameter=nmap_2.Values,
    stops=[0: RGB(234, 38, 0), 0.25: RGB(234, 126, 0), 0.5: RGB(254, 244, 84), 0.75: RGB(173, 203, 249), 1: RGB(75, 107, 169)])  # disabled
preview_4 = CustomPreview(Geometry=nmap_2.Mesh, Shader=gradient_4)  # disabled

# ----
# the name of the floor to density information from
floor_name_5 = Panel("floor")  # disabled

# ----
# node maps return the density values at nodes that have a geometry associated with them. the output is similar to the density map for floors
toggle_4 = BooleanToggle(False)  # disabled

# ----
# the name of the agent to pull path information from
agent_name_4 = Panel("agent")  # disabled

# ----
# the name of the floor to pull map information from
floor_name_6 = Panel("floor")  # disabled

# ----
# toggles whether to output nonzero density values for this map. if true, the map will only average densities for generations where each grid unit was occupied
toggle_5 = BooleanToggle(True)  # disabled

gradient_5 = Gradient(LowerLimit=0, UpperLimit=1, Parameter=bmap.Values, stops=[0: RGB(0, 128, 0), 0.5: RGB(255, 255, 0), 1: RGB(255, 0, 0)])
explode_3 = MeshExplode(Mesh=bmap.Mesh, Interpolate=False)
preview_5 = CustomPreview(Geometry=explode_3, Shader=gradient_5)

# ----
# occupancy maps are similar to density maps, but outputs the number of agents rather than the density at each grid unit
omap = OccupancyMap()  # -> Mesh, Values; disabled

settings_4 = AgentSettings(
    PathNodes=dwell_node_names,
    NodePropensities=dwell_node_propensities,
    QueuingPropensity=queuing_propensity,
    DistributionInterval=agent_initialization_distribution_in_sec,
    AgentCount=number_of_agents)  # disabled

# ----
# the main agent entity. this represents a type of agent with an origin, destination and optional settings for more control of agent movement and decision making. if no settings are used, agents will walk straight to their destination - useful for egress simulation. It will default to a single agent as output.
agent_2 = Agent(Name=agent_name_2, Origin=agent_origin, Destination=agent_origin, Settings=settings_4)  # disabled

# ----
# environment entities: all environment entities get input here, and are order irrelevant, similar to kangaroo. The environment needs at least one floor, 2 nodes and an agent to run, but can output barrier maps for floors without an agent, which is good for testing resolutions prior to running the simulation
# the simulation environment handles all the calculations for simulation of the agent journeys. I attemped to build the grid resolution in such a way that the meshes could be used in conjunction with a honeybee or ladybug simulation for optimisation purposes
env_2 = Environment(Entities=[floor, node_3, agent_2, barrier], Resolution=number_slider_2, Run=toggle_2)  # disabled

panel_2 = Panel(env_2)  # disabled

node_name_8 = Panel("bathroom")  # disabled
nmap_4 = NodeMap(Environment=env_2, NodeName=node_name_8, NonZero=toggle_4)  # -> Mesh, Values; disabled

node_name_9 = Panel("shop")  # disabled
nmap_5 = NodeMap(Environment=env_2, NodeName=node_name_9, NonZero=toggle_4)  # -> Mesh, Values; disabled

node_name_10 = Panel("restaurant")  # disabled
nmap_6 = NodeMap(Environment=env_2, NodeName=node_name_10, NonZero=toggle_4)  # -> Mesh, Values; disabled

# ----
# barrier maps pull information about collision detection on a specific floor. this is usefull for debugging resolution and barrier location geometry
bmap_2 = BarrierMap(Environment=env_2, FloorName=floor_name_6)  # -> Mesh, Values; disabled

# ----
# agent paths returns a list of all the locations that an agent was at for each generation in a simulation, as indexes on the mesh. this could be output as points later, as this might be most useful
apaths_2 = AgentPaths(Environment=env_2, AgentName=agent_name_4)  # -> Mesh, Indexes, Log; disabled

# ----
# densite maps return density information about a floor for a specific generation of the simulation. if the generation input is left blank, will output an average for the entire simulation
dmap_2 = DensityMap(Environment=env_2, FloorName=floor_name_5, NonZero=toggle_5)  # -> Mesh, Values; disabled

explode_4 = MeshExplode(Mesh=apaths_2.Mesh, Interpolate=False)  # disabled
facen_2 = FaceNormals(Mesh=explode_4)  # -> flatten(Centers), Normals; disabled
item_2 = ListItem(List=facen_2.Centers, Index=apaths_2.Indexes, Wrap=True)  # disabled
number_slider_5 = Slider(4, range=0..10)  # disabled
pline_2 = PolyLine(Vertices=item_2, Closed=False)  # disabled
previewlw_2 = CustomPreviewLineweights(
    Geometry=pline_2,
    Shader={ambient=RGB(0, 0, 0), diffuse=RGB(255, 105, 180), emission=RGB(76, 32, 54), shine=0.5, specular=RGB(255, 255, 255), transparency=0},
    Thickness=number_slider_5,
    Absolute=False)  # disabled

gradient_6 = Gradient(
    LowerLimit=1,
    UpperLimit=0,
    Parameter=dmap_2.Values,
    stops=[0: RGB(255, 128, 255), 0.25: RGB(234, 126, 0), 0.5: RGB(254, 244, 84), 0.75: RGB(173, 203, 249), 1: RGB(75, 107, 169)])  # disabled
explode_5 = MeshExplode(Mesh=dmap_2.Mesh, Interpolate=False)  # disabled
preview_6 = CustomPreview(Geometry=explode_5, Shader=gradient_6)  # disabled

gradient_7 = Gradient(
    LowerLimit=1,
    UpperLimit=0,
    Parameter=nmap_6.Values,
    stops=[0: RGB(234, 38, 0), 0.25: RGB(234, 126, 0), 0.5: RGB(254, 244, 84), 0.75: RGB(173, 203, 249), 1: RGB(75, 107, 169)])  # disabled
preview_7 = CustomPreview(Geometry=nmap_6.Mesh, Shader=gradient_7)  # disabled

gradient_8 = Gradient(
    LowerLimit=1,
    UpperLimit=0,
    Parameter=nmap_4.Values,
    stops=[0: RGB(234, 38, 0), 0.25: RGB(234, 126, 0), 0.5: RGB(254, 244, 84), 0.75: RGB(173, 203, 249), 1: RGB(75, 107, 169)])  # disabled
preview_8 = CustomPreview(Geometry=nmap_4.Mesh, Shader=gradient_8)  # disabled

gradient_9 = Gradient(
    LowerLimit=1,
    UpperLimit=0,
    Parameter=nmap_5.Values,
    stops=[0: RGB(234, 38, 0), 0.25: RGB(234, 126, 0), 0.5: RGB(254, 244, 84), 0.75: RGB(173, 203, 249), 1: RGB(75, 107, 169)])  # disabled
preview_9 = CustomPreview(Geometry=nmap_5.Mesh, Shader=gradient_9)  # disabled

gradient_10 = Gradient(LowerLimit=0, UpperLimit=1, Parameter=bmap_2.Values, stops=[0: RGB(0, 128, 0), 0.5: RGB(255, 255, 0), 1: RGB(255, 0, 0)])  # disabled
explode_6 = MeshExplode(Mesh=bmap_2.Mesh, Interpolate=False)  # disabled
preview_10 = CustomPreview(Geometry=explode_6, Shader=gradient_10)  # disabled
