# Grasshopper definition example_01.gh (Grasshopper 0.9.76)
# plug-ins: MeshEdit Components, Circulation

geo = Geometry(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)
pt = Point(Point(-20, -26, 0))
pt_2 = Point(Point(11, -10, 0))
node = Node(Position=pt, Name="start", Floor="floor")
node_2 = Node(Position=pt_2, Name="end", Floor="floor")
floor = Floor(Boundary=geo, Name="floor")
agent = Agent(Name="agent", Origin="start", Destination="end")
number_slider = Slider(100, range=0..100)
dup = DuplicateData(Data=agent, Number=Slider(10, range=0..10), Order=True)
env = Environment(Entities=[floor, node, node_2, agent], Resolution=Slider(1, range=0..1), Run=Toggle(True))
apaths = AgentPaths(Environment=env, AgentName="agent")  # -> Mesh, Indexes, Log
bmap = BarrierMap(Environment=env, FloorName="floor")  # -> Mesh, Values
facen = FaceNormals(Mesh=apaths.Mesh)  # -> Centers, Normals
gradient = Gradient(
    LowerLimit=0,
    UpperLimit=1,
    Parameter=bmap.Values,
    stops=[0: RGB(234, 38, 0), 0.25: RGB(234, 126, 0), 0.5: RGB(254, 244, 84), 0.75: RGB(173, 203, 249), 1: RGB(75, 107, 169)])
explode = MeshExplode(Mesh=bmap.Mesh, Interpolate=False)
item = ListItem(List=facen.Centers, Index=apaths.Indexes, Wrap=True)
preview = CustomPreview(Geometry=explode, Shader=gradient)
