# Grasshopper definition example_02.gh (Grasshopper 0.9.76)
# plug-ins: MeshEdit Components, Circulation

geo = Geometry([<curve referenced from the Rhino model> x21])
geo_2 = Geometry(<curve referenced from the Rhino model>)
cp = ControlPoints(Curve=geo)  # -> Points, Weights, Knots
geo_3 = Geometry([<curve referenced from the Rhino model> x26])
pt = Point([Point(18.64361632, 6.691635136, 0), Point(29.84267091, 6.648227948, 0), Point(38.75916303, 6.619045033, 0), Point(45.74772035, 6.705859409, 0), Point(52.84479564, 8.63747929, 0), Point(59.6814278, 8.680886478, 0)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])
pline = PolyLine(Vertices=cp.Points, Closed=False)  # -> flatten(Polyline)
settings = NodeSettings(DistributionInterval="300 to 600", Geometry=geo_3)
pt_2 = Point([Point(28.65941379, 17.90492138, 0), Point(44.78042533, 10.87592213, 0), Point(23.63191888, 9.736142657, 0), Point(99.54007708, 11.74767654, 0), Point(103.6268791, 11.80463545, 0), Point(79.75638443, 11.68185468, 0), Point(99.65484091, 6.794693093, 0)])
node = Node(Position=pt, Name="shop", Floor="ug", Settings=settings)
node_2 = Node(Position=pt_2, Name="access", Floor="ug")
floor = Floor(Boundary=geo_2, Name="ug")
barrier = Barrier(Boundary=pline, Floor="ug")
settings_2 = AgentSettings(
    VisitNodes="shop",
    VisitNodePropensities="0.5",
    VisitNodeCount=Slider(2, range=0..10),
    DistributionInterval="0 to 300",
    AgentCount=Slider(500, range=0..1000))
agent = Agent(Name="agent", Origin="access", Destination="access", Settings=settings_2)
env = Environment(Entities=[floor, barrier, agent, node_2, node], Resolution=Slider(1, range=0..1), Run=Toggle(True))
number_slider = Slider(235, range=-1..1500)
toggle = BooleanToggle(False)
bmap = BarrierMap(Environment=env, FloorName="ug")  # -> Mesh, Values
panel = Panel(env)
nmap = NodeMap(Environment=env, NodeName="shop", Generation=number_slider, NonZero=toggle)  # -> Mesh, Values
apaths = AgentPaths(Environment=env, AgentName="agent")  # -> Mesh, Indexes, Log
dmap = DensityMap(Environment=env, FloorName="ug", Generation=number_slider, NonZero=toggle)  # -> Mesh, Values
explode = MeshExplode(Mesh=bmap.Mesh, Interpolate=False)
gradient = Gradient(
    LowerLimit=1,
    UpperLimit=0,
    Parameter=bmap.Values,
    stops=[0: RGB(234, 38, 0), 0.25: RGB(234, 126, 0), 0.5: RGB(254, 244, 84), 0.75: RGB(173, 203, 249), 1: RGB(75, 107, 169)])
bnd = Bounds(Numbers=nmap.Values)
gradient_2 = Gradient(
    LowerLimit=1,
    UpperLimit=0,
    Parameter=nmap.Values,
    stops=[0: RGB(234, 38, 0), 0.25: RGB(234, 126, 0), 0.5: RGB(254, 244, 84), 0.75: RGB(173, 203, 249), 1: RGB(75, 107, 169)])
facen = FaceNormals(Mesh=apaths.Mesh)  # -> Centers, Normals
gradient_3 = Gradient(
    LowerLimit=1,
    UpperLimit=0,
    Parameter=dmap.Values,
    stops=[0: RGB(234, 38, 0), 0.25: RGB(234, 126, 0), 0.5: RGB(254, 244, 84), 0.75: RGB(173, 203, 249), 1: RGB(75, 107, 169)])
panel_2 = Panel(bnd)
explode_2 = MeshExplode(Mesh=nmap.Mesh, Interpolate=False)
explode_3 = MeshExplode(Mesh=dmap.Mesh, Interpolate=False)
item = ListItem(List=facen.Centers, Index=apaths.Indexes, Wrap=True)
preview = CustomPreview(Geometry=explode, Shader=gradient)
preview_2 = CustomPreview(Geometry=explode_3, Shader=gradient_3)
preview_3 = CustomPreview(Geometry=explode_2, Shader=graft(gradient_2))
