# Grasshopper definition redux.ghx (Grasshopper 0.9.76)
# plug-ins: MeshEdit Components, Python Interpreter, Kangaroo Components

# ----
# this should be written as a possible set for more complex agents
panel = Panel("100")
panel_2 = Panel("""wait1
wait2""")
agent = PythonScript(name="test", origin="start", destination="end", nodes=flatten(panel_2), vals=flatten(panel))  # -> out, a; inputs nodes: list, vals: list
# ---------- agent: Python ----------
import rhinoscriptsyntax as rs
import copy, random

           
if name != None and origin != None and destination != None:

    nodes.reverse()
    vals.reverse()

    entity = {
        'type': 'agent',
        'profile': {
            'name': name,
            'origin': origin,
            'destination': destination,
            'properties':{
            },
            'speed':{
                'min':0.5, #0.65
                'max':2, #2.05
                'default':1 # 1.35
            },
            'influence':{
                'queuing':50, #implement later
                'remainder':None # implement later
            }
        }
    }
    
    if len(nodes) > 0 and len(vals) > 0:
        count=0
        while len(nodes) and count < 100:
            count+=1
            entity['profile']['properties'][nodes.pop()] = vals.pop() if len(vals) > 1 else vals[-1]
    
    
    entity['profile']['properties'][origin] = 100
    entity['profile']['properties'][destination] = 100
    
    print entity
    a = [entity]
# ---------- end agent ----------
number_slider = Slider(50, range=0..1000)
panel_3 = Panel(agent.out)
dup = DuplicateData(Data=agent.a, Number=number_slider, Order=True)

pt = Point(Point(17.60708375, 50.86264395, 0))
node = Node(position=pt, name="end")  # -> info_2, node_2

pt_2 = Point(Point(36.52199886, 37.66619155, 0))
node_2 = Node(position=pt_2, name="wait1")  # -> info_2, node_2

pt_3 = Point(Point(17.16720201, 5.334883162, 0))
node_3 = Node(position=pt_3, name="start")  # -> info_2, node_2

pt_4 = Point(Point(2.123908338, 36.27444797, 0))
node_4 = Node(position=pt_4, name="wait2")  # -> info_2, node_2

boundary = Geometry(<curve referenced from the Rhino model>)
floor = Floor(boundary=boundary, name="floor1")  # -> info_2, floor_2

barriers = Geometry(<curve referenced from the Rhino model>)
barrier = Barrier(boundary=barriers, floor="floor1")  # -> info_2, barrier_2

ln = Line(StartPoint=graft([pt_3, pt]), EndPoint=[pt_2, pt_4])
ln_2 = Line(StartPoint=pt_3, EndPoint=pt)
ln_3 = Line(StartPoint=pt_2, EndPoint=pt_4)
number_slider_2 = Slider(3, range=0..10)
template = PythonScript(lines=flatten([ln, ln_2, ln_3]), directed=Toggle(False))  # -> out, a; inputs lines: list of Curve, directed: Boolean
# ---------- template: Python ----------
import rhinoscriptsyntax as rs

template = []

if len(lines):

    entities = []
    
    for line in lines:
        entities.append([rs.CurveEndPoint(line), rs.CurveStartPoint(line)])
        
    entity = {
        'type' : 'template',
        'profile' : {
            'edges' : entities,
            'directed' : directed if directed else False
        }
    }
    
    print entity
    
    template.append(entity)
    
a = template
# ---------- end template ----------
env = PythonScript()  # -> out, a; inputs entities: list
# ---------- env: Python ----------
from collections import defaultdict
import rhinoscriptsyntax as rs
import Rhino as rc
import scriptcontext as sc
import random, copy
from itertools import permutations
import math as m
import Grasshopper.Kernel as gh

import ghpythonlib.parallel

class Graph(object):
    
    def __init__(self, nodes=None, edges=None, distances=None):
        self.nodes = nodes if nodes else set()
        self.edges = edges if edges else defaultdict(set)
        self.distances = distances if distances else dict()

    def __repr__(self):
        return "Graph: {0} nodes, {1} edges".format(len(self.nodes), len(self.edges))
    
    def add_node(self, value):
        self.nodes.add(value)
        
    def add_edge(self, from_node, to_node, distance, directed=False):
        self.add_node(from_node)
        self.add_node(to_node)
        
        self.edges[from_node].add(to_node)
        self.distances[(from_node, to_node)] = distance
        if directed:
            self.edges[to_node].add(from_node)
            self.distances[(to_node, from_node)] = distance
    
    def get_distance(self, key, gen=0):
        return self.distances[key]
    
    def get_step(self, initial, goal_position, route):
        return
    
    def deepsearch(self, key, func, depth=0, visited=None, max_depth=10):
        if not visited: visited = {}
        visited[key] = None
        if func(key): visited[key] = depth
        elif depth < max_depth:
            for edge in self.edges[key]:
                if not edge in visited:
                    visited.update(self.deepsearch(edge, func, depth+1, visited))
        return visited
    
    def shallowsearch(self, keys, func, depth=0, visited=None, max_depth=float('inf')):
        if not visited: visited = {}
        for key in keys:
            if not key in visited: visited[key] = None
            if func(key):
                visited[key] = depth
                return visited
        if depth < max_depth:
            keys = set([k for key in keys for k in self.edges[key]])
            visited.update(self.shallowsearch(keys, func, depth+1, visited))
        return visited
            
    """
        INFO - 
        dijsktra modified from:
        https://gist.github.com/econchick/4666413
    """
    def dijsktra(self, initial, goal_position=None, start_idx=0):

        visited = {initial: 0}
        path = {}
        nodes = set(self.nodes)
        
        while nodes:
            min_node = None
            for node in nodes:
                if node in visited:
                    if min_node is None:
                        min_node = node
                    elif visited[node] < visited[min_node]:
                        min_node = node
            if min_node is None:
                break
            nodes.remove(min_node)
            current_weight = visited[min_node]

            gen = self.get_step(min_node, initial, path)

            for edge in self.edges[min_node]:
                distance = self.get_distance((min_node, edge), gen+start_idx)
                weight = current_weight + distance
                if edge not in visited or weight < visited[edge]:
                    
                    visited[edge] = weight
                    path[edge] = min_node
                    
                if goal_position != None and edge == goal_position: return visited, path
                        
        return visited, path

    def shortest_path(self, initial_node, goal_position_node, start_idx=0, paths=None):
        
        if paths == None:
            distances, paths = self.dijsktra(initial_node, goal_position_node, start_idx)
            
        route = [goal_position_node]
        while goal_position_node != initial_node:
            route.append(paths[goal_position_node])
            goal_position_node = paths[goal_position_node]
        route.reverse()
        return route

class Map(Graph):
    
    def __init__(self, floor):
        super(Map, self).__init__()
        self._floor = floor
        self._barrier_map = defaultdict(float)
        self._density_map = defaultdict(lambda : defaultdict(int))
        self._occupancy_map = defaultdict(lambda : defaultdict(int))
        
    @property
    def barrier_map(self):
        return self._barrier_map
    
    def set_barrier(self, key, val):
        self.barrier_map[key] += val
   
    def get_barrier_map(self):
        return [self.barrier_map[k] for k in self.barrier_map.keys()]
        
    @property
    def density_map(self):
        return self._density_map
    
    def get_density(self, key, gen):
        if self.density_map[gen][key] != 0:
            print gen, key, self.density_map[gen][key]
        return self.density_map[gen][key]
    
    def get_density_map_at(self, gen):
        return [self.get_density(k, gen) for k in range(len(self.floor.grid))]
    
    def add_density(self, key, gen):
        self.density_map[gen][key] += 1
        
    @property
    def occupancy_map(self):
        return self._occupancy_map
    
    def get_occupancy(self, key, gen):
        return self.occupancy_map[gen][key]
    
    def get_occupancy_map_at(self, gen):
        return [self.get_occupancy(k, gen) for k in range(len(self.floor.grid))]
    
    def add_occupancy(self, key, gen):
        self.occupancy_map[gen][key] += 1
        
    @property
    def floor(self):
        return self._floor
    
    def filter(self, key):
        return self.barrier_map[key]
    
    def get_step(self, initial, goal_position, route):
        path = [initial]
        while initial != goal_position:
            path.append(route[initial])
            initial = route[initial]
        curr_gen = len(path)
        return curr_gen
    
    def get_distance(self, key, gen):
        dist = self.distances[key]
        denom = 2 * (self.floor.grid_size)**2
        density  = self.get_density(key[1], gen) / denom
        overlays = self.filter(key[1])
        return dist + overlays + density

class Bounds2d():
    
    def __init__(self, **kwargs):
                
        if 'geo' in kwargs:
            self.geo_pts = rs.CurvePoints(kwargs['geo'])

            self._bds = [self.bds_x(self.geo_pts), self.bds_y(self.geo_pts)]
            self._origin = rc.Geometry.Point3d(self.bds[0][0], self.bds[1][0], 0)
            
            self._dim_x = self._bds[0][1] - self._bds[0][0]
            self._dim_y = self._bds[1][1] - self._bds[1][0]
            
        elif 'pts' and 'dim_x' and 'dim_y' in kwargs:
            self.geo_pts = kwargs['pts']
            
            self._bds = [self.bds_x(self.geo_pts), self.bds_y(self.geo_pts)]
            self._origin = rc.Geometry.Point3d(self.bds[0][0], self.bds[1][0], 0)
            
            self.dim_x = kwargs['dim_x']
            self.dim_y = kwargs['dim_y']
        
        else : 
            pass
            """
                This needs an error
            """
            
    @property
    def pts(self):
        return [ rc.Geometry.Point3d(self.bds[0][0], self.bds[1][0], 0),
            rc.Geometry.Point3d(self.bds[0][1], self.bds[1][0], 0),
            rc.Geometry.Point3d(self.bds[0][1], self.bds[1][1], 0),
            rc.Geometry.Point3d(self.bds[0][0], self.bds[1][1], 0)]
    
    @property
    def bds(self):
        return self._bds
    
    @property
    def origin(self):
        return self._origin
    
    def set_origin(self, pt):
        self._origin = pt
    
    @property
    def plane(self):
        return rc.Geometry.Plane(self.origin, rc.Geometry.Vector3d(0,0,1))
    
    @property
    def x(self):
        return self.bds[0][0]
    
    @property
    def y(self):
        return self.bds[1][0]
    
    def bds_x(self, pts):
        pts.sort(key = lambda pt: pt.X)
        return (pts[0].X, pts[-1].X)
    
    def bds_y(self, pts):
        pts.sort(key = lambda pt: pt.Y)
        return (pts[0].Y, pts[-1].Y)
   
    @property
    def dim_x(self):
        return self._dim_x
    
    @property
    def dim_y(self):
        return self._dim_y
    
    @property
    def centroid(self):
        x_average = self.x + self.dim_x/2
        y_average = self.y + self.dim_y/2
        return rc.Geometry.Point3d(x_average, y_average, 0)
    
    def to_rect(self):
        return rc.Geometry.Rectangle3d(self.plane, self.dim_x, self.dim_y)
    
    def to_grid(self, grid_size):
        
        def mesh_from_rect(rect, grid_size):
            mesh_params = rc.Geometry.MeshingParameters.Default
            mesh_params.MaximumEdgeLength = grid_size
            mesh_params.MinimumEdgeLength = grid_size
            mesh_params.GridAspectRatio = 1

            rect = rc.Geometry.Rectangle3d.ToNurbsCurve(rect)
            return rc.Geometry.Mesh.CreateFromPlanarBoundary(rect, mesh_params)
        
        return mesh_from_rect(self.to_rect(), grid_size)
    
    def contains_pt(self, pt):
        pt = rs.coerce3dpoint(pt)
        if pt.X < self.x or pt.X > (self.x + self.dim_x) or pt.Y < self.y or pt.Y > (self.y + self.dim_y):
            return False
        return True
    
    def intersects(self, other):
        """
            TODO - push this into the Interval Class
        """
        if (((self.origin.X < other.origin.X and self.origin.X + self.dim_x > other.origin.X + other.dim_x) or 
            (other.origin.X < self.origin.X and other.origin.X + other.dim_x > self.origin.X + self.dim_x) or
            (self.origin.X < other.origin.X and self.origin.X + self.dim_x > other.origin.X) or
            (other.origin.X < self.origin.X and other.origin.X + other.dim_x > self.origin.X)) and 
            ((self.origin.Y < other.origin.Y and self.origin.Y + self.dim_y > other.origin.Y + other.dim_y) or 
            (other.origin.Y < self.origin.Y and other.origin.Y + other.dim_y > self.origin.Y + self.dim_y) or
            (self.origin.Y < other.origin.Y and self.origin.Y + self.dim_y > other.origin.Y) or
            (other.origin.Y < self.origin.Y and other.origin.Y + other.dim_y > self.origin.Y))):
                return True
        return False
        
    @classmethod
    def from_center_pt(cls, pt, dim_x, dim_y):
        pt = rs.coerce3dpoint(pt)
        geo_pts = [rc.Geometry.Point3d(pt.X+dim_x/2, pt.Y+dim_y/2, pt.Z),
            rc.Geometry.Point3d(pt.X+dim_x/2, pt.Y-dim_y/2, pt.Z),
            rc.Geometry.Point3d(pt.X-dim_x/2, pt.Y-dim_y/2, pt.Z),
            rc.Geometry.Point3d(pt.X-dim_x/2, pt.Y+dim_y/2, pt.Z)]
        
        return cls(pts=geo_pts, dim_x=dim_x, dim_y=dim_y)

class Interval():
    
    def __init__(self, a,b):
        self._a = a
        self._b = b
        
    def __repr__(self):
        return str((self.a, self.b))
    
    @property
    def a(self):
        return self._a
    
    @property
    def b(self):
        return self._b
    
    @property
    def min(self):
        return min([self.a, self.b])
    
    @property
    def max(self):
        return max([self.a, self.b])
    
    @property
    def irange(self):
        return m.fabs(self._a - self._b)
    
    def includes(self, other):
        pass
    
    def intersects(self, other):
        pass
        
    @staticmethod
    def remap(source_ival, target_ival, num, bounded=False):
        if source_ival.irange == 0: return target_ival.min
        else:
            ret = (((num - source_ival.min) * target_ival.irange) / source_ival.irange) + target_ival.min
            if bounded:
                if ret > target_ival.max : return target_ival.max
                elif ret < target_ival.min: return target_ival.min
            return ret

"""
class Entity(object):
    
    def __init__(self, attr):
        self._pos = dict()
        self._attr = attr
        self._type = 'entity'
    
    def __repr__(self):
        return "Environment Entity: {0} : {1} ".format(self.type, self.name)

    @property
    def name(self):
        return self.get_attribute('name')

    @property
    def position(self):
        return self._pos[0]
    
    def set_position(self, pos, gen=0):
        self._pos[gen] = pos
    
    def get_position(self, gen=0):
        try:
            return self._pos[gen]
        except:
            return None
    
    @property
    def type(self):
        return self._type
    
    def set_type(self, type):
        self._type = type
    
    @property
    def attributes(self): return self._attr
    
    def set_attribute(self, key, value):
        self._attr[key] = value
    
    def get_attribute(self, key):
        
        def _finditem(obj, key):
            if key in obj: return obj[key]
            for k, v in obj.items():
                if isinstance(v,dict):
                    item = _finditem(v, key)
                    if item is not None:
                        return item
                        
        return _finditem(self.attributes, key)
    
    def has_attribute_value(self, val):
        
        def _findvalue(obj, val):
            if val in obj.values(): return True
            for k,v in obj.items():
                if isinstance(v,dict):
                    value = _findvalue(v, val)
                    if value is not None:
                        return True
            return False
        
        return _findvalue(self.attributes, val)
"""

class Node(Entity):
    
    def __init__(self, pos, attr={}):
        super(Node, self).__init__(attr)
        self.set_position(pos)
        self.set_type('node')

class Template(Entity):
    
    def __init__(self, attr={}):
        super(Template, self).__init__(attr)
        self.set_type('template')
    
    @property
    def edges(self):
        return self.get_attribute('edges')

class Floor(Entity):
    
    def __init__(self, geo, attr={}):
        super(Floor, self).__init__(attr)
        self._geo = rs.coercecurve(geo)
        self._bds = Bounds2d(geo=geo)
        self._map = None
        self._msh = None
        self._grid = None
        self._grid_size = None
        self._coords = {}
        
        self.set_position(self.bounds.origin)
        self.set_type('floor')
        
    @property
    def geo(self):
        return self._geo
    
    @property
    def bounds(self):
        return self._bds
    
    @property
    def mesh(self):
        return self._msh
        
    @property
    def map(self):
        return self._map
    
    @property
    def grid(self):
        return self._grid
        
    def set_grid(self, grid_size):
        
        indexes = []
        denom = m.sqrt(2*(grid_size**2))
        t_mesh = rs.coercemesh(rs.AddPlanarMesh(self.geo))
        self._msh = self.bounds.to_grid(grid_size)
        self._map = Map(self)
        self._grid_size = grid_size
        
        for i, cpt in enumerate(rs.MeshFaceCenters(self.mesh)):
            line = rc.Geometry.Line(cpt, rc.Geometry.Vector3d(0,0,1))
            if not rc.Geometry.Intersect.Intersection.MeshLine(t_mesh, line)[1]:
                indexes.append(i)

        self.mesh.Faces.DeleteFaces(indexes)
        self._grid = rs.MeshFaceCenters(self.mesh)
        
        for i, pt in enumerate(self.grid):
            self.set_coord(self.to_grid_coord(pt), i)
        
        for i, vertex in enumerate(self.mesh.Vertices):

            edges = self.mesh.TopologyVertices.ConnectedFaces(i)
            for e1 in edges:
                for e2 in edges:
                    if not e1 == e2:
                        weight = rs.Distance(self._grid[e1], self._grid[e2])/denom
                        self.map.add_edge(e1,e2, weight)
                        
    @property
    def grid_size(self):
        return self._grid_size
    
    @property
    def coords(self):
        return self._coords
    
    def set_coord(self, key, val):
        self._coords[key] = val
    
    def get_neighbors_at_coord(self, key):
        return [(key[0]+i, key[1]+j) for i in range(-1,2) for j in range(-1, 2)]
    
    def get_index_at_coord(self, key, pt):
        
        def _search(key):
            """
                TODO - make this a full search
            """
            _neighbors = self.get_neighbors_at_coord(key)
            _vals = [(n, self.to_grid_point(n)) for n in _neighbors if n in self._coords]
            _vals.sort(key = lambda tup: rs.Distance(pt, tup[1]))
            if _vals: return _vals[0][0]
            
        if key in self._coords:
            return self._coords[key]
        else:
            return self._coords[_search(key)]
    
    def to_grid_coord(self, pt):
        
        grid_x = self.bounds.dim_x / m.floor(self.bounds.dim_x / self.grid_size)
        grid_y = self.bounds.dim_y / m.floor(self.bounds.dim_y / self.grid_size)
        
        cs_x = m.floor(self.bounds.dim_x / grid_x)
        cs_y = m.floor(self.bounds.dim_y / grid_y)

        pt_x = m.floor((pt.X - self.position.X)/ grid_x)
        pt_y = m.floor((pt.Y - self.position.Y)/ grid_y)
        
        return (pt_x, pt_y)
    
    def to_grid_index(self, pt):
        
        coord = self.to_grid_coord(pt)
        return self.get_index_at_coord(coord, pt)
    
    def to_grid_bounds(self, pt):
        return Bounds2d.from_center_pt(pt, self.grid_size, self.grid_size)
    
    def to_grid_point(self, key):
        return self.grid[self.coords[key]]
    
    def contains_pt(self, pt):
        if self.bounds.contains_pt(pt):
            if rs.PointInPlanarClosedCurve(pt, self.geo): return True
        return False
    
    def add_edge_map(self):
        
        def _func(key):
            edges = [self.map.barrier_map[k] for k in self.map.edges[key]]
            if len(edges) != 8 or float('inf') in edges:
                return True
            return False
        
        def _search(i):
            if not self.map.barrier_map[i] == float('inf'):
                _vals = [v for v in self.map.shallowsearch([i], _func).values() if not v==None]
                _vals.sort()
                if _vals:
                    _weight = 1 / (self.grid_size*(_vals[0]+1))**2
                    self.map.set_barrier(i, _weight)
                    
        if PARALLEL:
            ghpythonlib.parallel.run(_search, range(len(self.grid)), False)
        else:
            for i, pt in enumerate(self.grid):
                _search(i)
        
    def add_barrier_map(self, barrier):
        
        for i, pt in enumerate(self.grid):
            if barrier.bounds.contains_pt(pt):
                if rs.PointInPlanarClosedCurve(pt, barrier.geo):
                    self.map.set_barrier(i, float('inf'))
            
            else:
                bds = self.to_grid_bounds(pt)
                if barrier.bounds.intersects(bds):
                    for pt in bds.geo_pts:
                        """
                            TODO - this can probably be done more effectively without rhinoscript
                        """
                        if rs.PointInPlanarClosedCurve(pt, barrier.geo):
                            self.map.set_barrier(i, float('inf'))
                            break
            
class Barrier(Entity):
    
    def __init__(self, geo, attr={}):
        super(Barrier, self).__init__(attr)
        self._geo = rs.coercecurve(geo)
        self._bds = Bounds2d(geo=geo)
        
        self.set_position(self.bounds.origin)
        self.set_type('barrier')
        
    @property
    def geo(self):
        return self._geo
    
    @property
    def bounds(self):
        return self._bds
    
    @property
    def floor(self):
        return self.get_attribute('floor')
        
class Agent(Entity):
    
    def __init__(self, pos=None, attr={}, env=None):
        super(Agent, self).__init__(attr)
        self._attr = attr
        self._env = env
        
        self._history = []
        self._path = []
        
        self.set_position(pos)
        self.set_type('agent')
        
        self._speed = float(self.get_attribute('speed')['default'])
        self._velocity = int(m.floor(self.environment.resolution / self.speed)) if env else None
        self._min_velocity = None
        self._max_velocity = None
        self._state = None
        
        self.age = 0
        self.is_active = True
        self.is_complete = False
        
        self.goal_position = None
        self.next_position = None
                
    @property
    def position(self):
        return self.get_position(self.age)
        
    @property
    def speed(self):
        return self._speed
    
    @property
    def velocity(self):
        return self._velocity
        
    def shift(self, num=1):
        
        for r in range(num):
            
            self._path[-1].insert(self._path[-1].index(self.position), self.position)
            self.history.append(self.position)
            self.state.append(self.next_position)
            self.environment.floors[0].map.add_occupancy(self.position, self.age)
    
            keys = [k for k in sorted(self._pos.keys()) if k >= self.age][::-1]
            for ki in range(len(keys)):
                try: self.environment.floors[0].map.density_map[keys[ki]+1][self._pos[keys[ki]+1]] -= 1
                except: pass
                self.environment.floors[0].map.density_map[keys[ki]+1][self._pos[keys[ki]]] += 1
                self._pos[keys[ki]+1] = self._pos[keys[ki]]
    
    @property
    def grid_index(self):
        return self.environment.floors[0].to_grid_index(self.position.position)
    
    @property
    def state(self):
        return self._state
    
    def set_state(self, state):
        self._state = state
    
    @property
    def destination(self):
        val = self.get_attribute('destination')
        return random.choice(self.environment.get_nodes_with_value(val))
    
    @property
    def path(self):
        _path = sum([p for p in self._path], [])
        _dict = {idx: self.environment.floors[0].grid[idx] for idx in set(_path)}
        return [_dict[p] for p in _path]
    
    def add_path(self, path):
        self._path.append(copy.deepcopy(path))    
    
    @property
    def history(self):
        return self._history
    
    @property
    def visited(self):
        return [n.name for n in self.history if not type(n) == int]
    
    @property
    def environment(self):
        return self._env
    
    def set_environment(self, env):
        self._env = env
        self._velocity = int(m.floor(self.environment.resolution / self.speed))
        
    def toggle_active(self):
        self.is_active = not self.is_active
        
    def toggle_complete(self):
        self.is_complete = not self.is_complete
    
    def step(self):        
        
        def wait(time):
            return self.goal_position, [self.goal_position] * time
            
        def move(lst):
            
            lst = [l for l in lst if not l.get_attribute('name') in self.visited]
            
            if len(lst):
            
                properties = self.get_attribute('properties')
                keys = properties.keys()
                n_percs = [k for k in keys if random.randint(0,100) <= float(properties[k])]
                
                lst = [(l, self.environment.graph.get_distance((self.position, l))) for l in lst if l.get_attribute('name') in n_percs]
            
                if len(lst):
                    
                    lst.sort(key = lambda tup: len(tup[1]), reverse = True)
                    
                    while len(lst):
                        
                        tup = lst.pop()
                        n_choice = tup[0]
                        n_path = tup[1] # TEMP
                        num_people = len([a for a in self.environment.agents if self.goal_position == a.goal_position and a != self])
                        capacity = n_choice.get_attribute('capacity')

                        if capacity != None:
                            if num_people < float(capacity):
                                break
                            else:
                                if random.randint(0,100) < float(self.get_attribute('queuing')):
                                    break
                                else: 
                                    continue
                        else:
                            break
                else:
                    n_choice = self.destination
                    n_path = self.environment.graph.get_distance((self.position, n_choice))
            else:
                n_choice = self.destination
                try: n_path = self.environment.graph.get_distance((self.position, n_choice))
                except: n_path = self.environment.graph.get_distance((n_choice, self.position))[::-1]
                self.toggle_complete()
            
            """
                TODO - replace with entity.to_grid_index(environment)
                    nodes need floor property !! important
            """ 
            """
            n_index = self.environment.floors[0].to_grid_index(n_choice.position)
            n_path = self.environment.floors[0].map.shortest_path(self.grid_index, n_index, start_idx=self.age+1)
            """
            return n_choice, n_path

        if self.state == None:

            start_node = self.get_attribute('origin')
            start_positions = self.environment.get_nodes_with_value(start_node)
            start_position = random.choice(start_positions)
            
            self._min_velocity = int(m.floor(self.environment.resolution / float(self.get_attribute('speed')['min'])))
            self._max_velocity = int(m.floor(self.environment.resolution / float(self.get_attribute('speed')['max'])))
            
            self.goal_position = start_position
            self.set_state('waiting')
            
        else:

            if self.is_active:
                
                if self.state == 'ready':
                                        
                    self.goal_position, path = move(self.environment.graph.edges[self.position])
                    self.add_path(path)
                    path = [self.position] + path + [self.goal_position]
                    
                    for pi in range(len(path)):
                        self.environment.floors[0].map.add_density(path[pi], self.age+pi)
                        self.set_position(path[pi], self.age+pi)
                    
                    path.reverse()
                    self.set_state(path[:-1])
                    
               
                elif self.state == 'waiting':
                                        
                    wait_time = 1 if len(self._path) != 0 else random.randint(1,10)
                    
                    self.goal_position, path = wait(wait_time)
                    self.add_path([self.environment.floors[0].to_grid_index(self.goal_position.position)] * (wait_time))                    
                    path = [self.goal_position] + path + [self.goal_position]
                    
                    for pi in range(len(path)):
                        self.environment.floors[0].map.add_density(path[pi], self.age+pi)
                        self.set_position(path[pi], self.age+pi)
                    
                    path.reverse()
                    self.set_state(path[:-1])
                      
                else:

                    if len(self.state):
                                                 
                        self.next_position = self.state.pop()
                        
                        curr_people_pos = len(self.environment.agents_at_position(self.position, self.age))
                        next_people_pos = len(self.environment.agents_at_position(self.position, self.age+1))
                        
                        curr_people_npos = len(self.environment.agents_at_position(self.next_position, self.age))
                        next_people_npos = len(self.environment.agents_at_position(self.next_position, self.age+1))
                                                                       
                        
                        #print curr_people_pos, next_people_pos, curr_people_npos, next_people_npos
                        
                        if type(self.position) != Node:
                            
                            if type(self.next_position) != Node:
                                
                                source_ival = Interval(1,  2 * self.environment.resolution**2)
                                target_ival = Interval(self._max_velocity, self._min_velocity)
                                val = int(round(Interval.remap(source_ival, target_ival, curr_people_pos, bounded=True)))
                                max_density = 2 * self.environment.resolution**2
                                
                                #if next_people_pos > max_density and next_people_npos > max_density:
                                #    max_density *= 2
                                
                                if curr_people_npos >= max_density or next_people_npos >= max_density:
                                    if not next_people_pos >= max_density:
                                                                                
                                        self.shift()
                                        
                            elif type(self.next_position) == Node:
                                                              
                                capacity = self.next_position.get_attribute('capacity')
                                max_density = int(capacity) if capacity != None else float('inf')
                                
                                if curr_people_npos >= max_density or next_people_npos >= max_density:
                                    self.shift()
                        
                        
                        self.history.append(self.position)
                        self.age+=1
                        
                    else:
                        
                        if type(self.get_position(self.age-1)) != Node:
                            self.set_state('waiting')
                         
                        elif type(self.get_position(self.age-1)) == Node:
                            self.set_state('ready')
                                
                        if self.is_complete:
                            self.set_state('complete')
                            self.toggle_active()

class Environment():
    
    def __init__(self, resolution=30):
        self._entities = defaultdict(list)
        self._agents = []
        self._graph = Graph()
        self._graph_paths = {}
        self._resolution = resolution
    
    def __repr__(self):
        return 'Environment: {0} agents, {1} nodes, {2} floors'.format(len(self.agents), len(self.graph.nodes), len(self.floors))
    
    @property
    def resolution(self):
        return self._resolution
    
    @property
    def entities(self):
        return self._entities
     
    def add_entity(self, entity):
        self.entities[entity.type].append(entity)
    
    def add_entities(self, entities):
        
        def _add_floor(entity):
            entity = Floor(entity['geometry'], entity['profile'])
            self.add_floor(entity)
            self.add_entity(entity)
        
        def _add_node(entity):
            entity = Node(entity['position'], entity['profile'])
            _msg = self.add_node(entity)
            if _msg:
                return _msg
            else:
                self.add_entity(entity)
            
        def _add_template(entity):
            entity = Template(entity['profile'])
            self.add_template(entity)
            self.add_entity(entity)
        
        def _add_barrier(entity):
            entity = Barrier(entity['geometry'], entity['profile'])
            self.add_barrier(entity)
            self.add_entity(entity)
        
        def _add_agent(entity):
            entity = Agent(attr=entity['profile'])
            self.add_agent(entity)
            self.add_entity(entity)
        
        dict = defaultdict(list)
        for entity in entities:
            dict[entity['type']].append(entity)
        
        if len(dict['floor']):
            for  floor in dict['floor']:
                _add_floor(floor)
        else:
            e = gh.GH_RuntimeMessageLevel.Error
            ghenv.Component.AddRuntimeMessage(e, 'component needs at least one floor')
            return
        
        if len(dict['barrier']):
            for barrier in dict['barrier']:
                _add_barrier(barrier)
        
        for floor in self.entities['floor']:
            #pass
            floor.add_edge_map()
            
        if len(dict['node']) > 1:

            if PARALLEL: 
                _err = ghpythonlib.parallel.run(_add_node, dict['node'], False)
            else:
                _err = [_add_node(node) for node in dict['node']]
                
            if any( _err):
                for _msg in _err:
                    e = e = gh.GH_RuntimeMessageLevel.Error
                    ghenv.Component.AddRuntimeMessage(e, _msg)
                return
        else:
            e = gh.GH_RuntimeMessageLevel.Error
            ghenv.Component.AddRuntimeMessage(e, 'component needs at least two nodes')
            return
              
        if len(dict['template']):
            for template in dict['template']:
                _add_template(template)
        else: self.add_default_template()
            
        if len(dict['agent']):
            for agent in dict['agent']:
                _add_agent(agent)
        else:
            w = gh.GH_RuntimeMessageLevel.Warning
            ghenv.Component.AddRuntimeMessage(w, 'no agents in environment')
            
    @property
    def graph(self):
        return self._graph
    
    @property
    def graph_paths(self):
        return self._graph_paths
    
    def get_graph_path(self, n1, n2):
        """
            TODO - if n1 and n2 are on different floors -> handle graph links
                - nodes need a floor attribute
        """
        floor = self.floors[0]
        idx1 = floor.to_grid_index(n1.position)
        idx2 = floor.to_grid_index(n2.position)
        return floor.map.shortest_path(idx1, idx2, paths=self.graph_paths[n1])
    
    def set_graph_path(self, key, val):
        self._graph_paths[key] = val
    
    @property
    def templates(self):
        return [n for n in self.entities['template']]
    
    def add_template(self, template):
        for edge in template.edges:
            nodes = [n for n in self.nodes if n.position in edge]
            if len(nodes) == 2:
                try:
                    path = self.get_graph_path(nodes[0], nodes[1])
                except:
                    path = self.get_graph_path(nodes[1], nodes[0])
                    
                self.graph.add_edge(nodes[0], nodes[1], path,
                    directed=template.get_attribute('directed'))
    
    def add_default_template(self):
        for n1 in self.graph.nodes:
            for n2 in self.graph.nodes:
                if not n1 == n2: 
                    path = self.get_graph_path(n1, n2)
                    self.graph.add_edge(n1, n2, path)
                    
    @property
    def agents(self):
        return self._agents
        
    def add_agent(self, agent, other=None):
        agent.set_environment(self)
        self.agents.append(agent)
    
    def agents_at_position(self, position, gen=0):
        return [a for a in self.agents if a.get_position(gen) == position]
        
    @property
    def nodes(self):
        return [n for n in self.entities['node']]
    
    def add_node(self, node):
        self.graph.add_node(node)
        """
            TODO - nodes need a floor attribute
        """
        if self.floors[0].contains_pt(node.position):
            djk = self.floors[0].map.dijsktra(self.floors[0].to_grid_index(node.position))
            self.set_graph_path(node, djk[1])
        else:
            return node.name +' was flagged as not on a floor'

    def get_nodes_with_value(self, val):
        return [n for n in self.nodes if n.has_attribute_value(val)]
        
    @property
    def floors(self):
        return [n for n in self.entities['floor']]
    
    def add_floor(self, floor):
        floor.set_grid(self.resolution)
    
    def set_grid(self, grid_size):
        """
            TODO - implement more complexity
            grids will need to match up between floors
               - maybe 1 unified dictionary to hold graphs?
        """
        for floor in self.floors: floor.set_grid(grid_size)
        
    @property
    def barriers(self):
        return [n for n in self.entities['barriers']]
    
    def add_barrier(self, barrier):
        for floor in self.floors:
            if barrier.floor == floor.name:
                floor.add_barrier_map(barrier)
                
    @property
    def paths(self):
        return [a.path for a in self.agents]
        
    def generation(self, gen):
        return [a.get_position(gen) for a in self.agents]

    def step(self):
        
        def _func(agent):
            if agent.is_active:
                agent.step()
                   
        if PARALLEL:
            ghpythonlib.parallel.run(_func, self.agents, False)
        else:
            for i, agent in enumerate(self.agents):
                _func(agent)
        
    def run(self):
        count = 0
        while len([a for a in self.agents if a.is_active]) and count < 1000:
            self.step()
            count+=1
            
        if count == 1000: print ">>>>>>>>>>>>>>>>>>>>>>>>> broke outer while loop"
        
PARALLEL = False
if build :
    if len(entities) != 0 and resolution != None:
        environment = Environment(resolution=resolution)
        environment.add_entities([e for e in entities if e != None])
        
        a = environment
# ---------- end env ----------
floor_2 = Floor()  # -> info_2, floor_2
env_2 = PythonScript(
    entities=flatten([dup, template.a, node.node_2, node_2.node_2, node_4.node_2, node_3.node_2, barrier.barrier_2, floor.floor_2]),
    resolution=number_slider_2,
    build=Toggle(True))  # -> out, a; inputs entities: list
# ---------- env_2: Python ----------
from collections import defaultdict
import rhinoscriptsyntax as rs
import Rhino as rc
import scriptcontext as sc
import random, copy
from itertools import permutations
import math as m
import Grasshopper.Kernel as gh

import ghpythonlib.parallel

class Graph(object):
    
    def __init__(self, nodes=None, edges=None, distances=None):
        self.nodes = nodes if nodes else set()
        self.edges = edges if edges else defaultdict(set)
        self.distances = distances if distances else dict()

    def __repr__(self):
        return "Graph: {0} nodes, {1} edges".format(len(self.nodes), len(self.edges))
    
    def add_node(self, value):
        self.nodes.add(value)
        
    def add_edge(self, from_node, to_node, distance, directed=False):
        self.add_node(from_node)
        self.add_node(to_node)
        
        self.edges[from_node].add(to_node)
        self.distances[(from_node, to_node)] = distance
        if directed:
            self.edges[to_node].add(from_node)
            self.distances[(to_node, from_node)] = distance
    
    def get_distance(self, key, gen=0):
        return self.distances[key]
    
    def get_step(self, initial, goal_position, route):
        return
    
    def deepsearch(self, key, func, depth=0, visited=None, max_depth=10):
        if not visited: visited = {}
        visited[key] = None
        if func(key): visited[key] = depth
        elif depth < max_depth:
            for edge in self.edges[key]:
                if not edge in visited:
                    visited.update(self.deepsearch(edge, func, depth+1, visited))
        return visited
    
    def shallowsearch(self, keys, func, depth=0, visited=None, max_depth=float('inf')):
        if not visited: visited = {}
        for key in keys:
            if not key in visited: visited[key] = None
            if func(key):
                visited[key] = depth
                return visited
        if depth < max_depth:
            keys = set([k for key in keys for k in self.edges[key]])
            visited.update(self.shallowsearch(keys, func, depth+1, visited))
        return visited
            
    """
        INFO - 
        dijsktra modified from:
        https://gist.github.com/econchick/4666413
    """
    def dijsktra(self, initial, goal_position=None, start_idx=0):

        visited = {initial: 0}
        path = {}
        nodes = set(self.nodes)
        
        while nodes:
            min_node = None
            for node in nodes:
                if node in visited:
                    if min_node is None:
                        min_node = node
                    elif visited[node] < visited[min_node]:
                        min_node = node
            if min_node is None:
                break
            nodes.remove(min_node)
            current_weight = visited[min_node]

            gen = self.get_step(min_node, initial, path)

            for edge in self.edges[min_node]:
                distance = self.get_distance((min_node, edge), gen+start_idx)
                weight = current_weight + distance
                if edge not in visited or weight < visited[edge]:
                    
                    visited[edge] = weight
                    path[edge] = min_node
                    
                if goal_position != None and edge == goal_position: return visited, path
                        
        return visited, path

    def shortest_path(self, initial_node, goal_position_node, start_idx=0, paths=None):
        
        if paths == None:
            distances, paths = self.dijsktra(initial_node, goal_position_node, start_idx)
            
        route = [goal_position_node]
        while goal_position_node != initial_node:
            route.append(paths[goal_position_node])
            goal_position_node = paths[goal_position_node]
        route.reverse()
        return route

class Map(Graph):
    
    def __init__(self, floor):
        super(Map, self).__init__()
        self._floor = floor
        self._barrier_map = defaultdict(float)
        self._density_map = defaultdict(lambda : defaultdict(int))
        self._occupancy_map = defaultdict(lambda : defaultdict(int))
        
    @property
    def barrier_map(self):
        return self._barrier_map
    
    def set_barrier(self, key, val):
        self.barrier_map[key] += val
   
    def get_barrier_map(self):
        return [self.barrier_map[k] for k in self.barrier_map.keys()]
        
    @property
    def density_map(self):
        return self._density_map
    
    def get_density(self, key, gen):
        if self.density_map[gen][key] != 0:
            print gen, key, self.density_map[gen][key]
        return self.density_map[gen][key]
    
    def get_density_map_at(self, gen):
        return [self.get_density(k, gen) for k in range(len(self.floor.grid))]
    
    def add_density(self, key, gen):
        self.density_map[gen][key] += 1
        
    @property
    def occupancy_map(self):
        return self._occupancy_map
    
    def get_occupancy(self, key, gen):
        return self.occupancy_map[gen][key]
    
    def get_occupancy_map_at(self, gen):
        return [self.get_occupancy(k, gen) for k in range(len(self.floor.grid))]
    
    def add_occupancy(self, key, gen):
        self.occupancy_map[gen][key] += 1
        
    @property
    def floor(self):
        return self._floor
    
    def filter(self, key):
        return self.barrier_map[key]
    
    def get_step(self, initial, goal_position, route):
        path = [initial]
        while initial != goal_position:
            path.append(route[initial])
            initial = route[initial]
        curr_gen = len(path)
        return curr_gen
    
    def get_distance(self, key, gen):
        dist = self.distances[key]
        denom = 2 * (self.floor.grid_size)**2
        density  = self.get_density(key[1], gen) / denom
        overlays = self.filter(key[1])
        return dist + overlays + density

class Bounds2d():
    
    def __init__(self, **kwargs):
                
        if 'geo' in kwargs:
            self.geo_pts = rs.CurvePoints(kwargs['geo'])

            self._bds = [self.bds_x(self.geo_pts), self.bds_y(self.geo_pts)]
            self._origin = rc.Geometry.Point3d(self.bds[0][0], self.bds[1][0], 0)
            
            self._dim_x = self._bds[0][1] - self._bds[0][0]
            self._dim_y = self._bds[1][1] - self._bds[1][0]
            
        elif 'pts' and 'dim_x' and 'dim_y' in kwargs:
            self.geo_pts = kwargs['pts']
            
            self._bds = [self.bds_x(self.geo_pts), self.bds_y(self.geo_pts)]
            self._origin = rc.Geometry.Point3d(self.bds[0][0], self.bds[1][0], 0)
            
            self.dim_x = kwargs['dim_x']
            self.dim_y = kwargs['dim_y']
        
        else : 
            pass
            """
                This needs an error
            """
            
    @property
    def pts(self):
        return [ rc.Geometry.Point3d(self.bds[0][0], self.bds[1][0], 0),
            rc.Geometry.Point3d(self.bds[0][1], self.bds[1][0], 0),
            rc.Geometry.Point3d(self.bds[0][1], self.bds[1][1], 0),
            rc.Geometry.Point3d(self.bds[0][0], self.bds[1][1], 0)]
    
    @property
    def bds(self):
        return self._bds
    
    @property
    def origin(self):
        return self._origin
    
    def set_origin(self, pt):
        self._origin = pt
    
    @property
    def plane(self):
        return rc.Geometry.Plane(self.origin, rc.Geometry.Vector3d(0,0,1))
    
    @property
    def x(self):
        return self.bds[0][0]
    
    @property
    def y(self):
        return self.bds[1][0]
    
    def bds_x(self, pts):
        pts.sort(key = lambda pt: pt.X)
        return (pts[0].X, pts[-1].X)
    
    def bds_y(self, pts):
        pts.sort(key = lambda pt: pt.Y)
        return (pts[0].Y, pts[-1].Y)
   
    @property
    def dim_x(self):
        return self._dim_x
    
    @property
    def dim_y(self):
        return self._dim_y
    
    @property
    def centroid(self):
        x_average = self.x + self.dim_x/2
        y_average = self.y + self.dim_y/2
        return rc.Geometry.Point3d(x_average, y_average, 0)
    
    def to_rect(self):
        return rc.Geometry.Rectangle3d(self.plane, self.dim_x, self.dim_y)
    
    def to_grid(self, grid_size):
        
        def mesh_from_rect(rect, grid_size):
            mesh_params = rc.Geometry.MeshingParameters.Default
            mesh_params.MaximumEdgeLength = grid_size
            mesh_params.MinimumEdgeLength = grid_size
            mesh_params.GridAspectRatio = 1

            rect = rc.Geometry.Rectangle3d.ToNurbsCurve(rect)
            return rc.Geometry.Mesh.CreateFromPlanarBoundary(rect, mesh_params)
        
        return mesh_from_rect(self.to_rect(), grid_size)
    
    def contains_pt(self, pt):
        pt = rs.coerce3dpoint(pt)
        if pt.X < self.x or pt.X > (self.x + self.dim_x) or pt.Y < self.y or pt.Y > (self.y + self.dim_y):
            return False
        return True
    
    def intersects(self, other):
        """
            TODO - push this into the Interval Class
        """
        if (((self.origin.X < other.origin.X and self.origin.X + self.dim_x > other.origin.X + other.dim_x) or 
            (other.origin.X < self.origin.X and other.origin.X + other.dim_x > self.origin.X + self.dim_x) or
            (self.origin.X < other.origin.X and self.origin.X + self.dim_x > other.origin.X) or
            (other.origin.X < self.origin.X and other.origin.X + other.dim_x > self.origin.X)) and 
            ((self.origin.Y < other.origin.Y and self.origin.Y + self.dim_y > other.origin.Y + other.dim_y) or 
            (other.origin.Y < self.origin.Y and other.origin.Y + other.dim_y > self.origin.Y + self.dim_y) or
            (self.origin.Y < other.origin.Y and self.origin.Y + self.dim_y > other.origin.Y) or
            (other.origin.Y < self.origin.Y and other.origin.Y + other.dim_y > self.origin.Y))):
                return True
        return False
        
    @classmethod
    def from_center_pt(cls, pt, dim_x, dim_y):
        pt = rs.coerce3dpoint(pt)
        geo_pts = [rc.Geometry.Point3d(pt.X+dim_x/2, pt.Y+dim_y/2, pt.Z),
            rc.Geometry.Point3d(pt.X+dim_x/2, pt.Y-dim_y/2, pt.Z),
            rc.Geometry.Point3d(pt.X-dim_x/2, pt.Y-dim_y/2, pt.Z),
            rc.Geometry.Point3d(pt.X-dim_x/2, pt.Y+dim_y/2, pt.Z)]
        
        return cls(pts=geo_pts, dim_x=dim_x, dim_y=dim_y)

class Interval():
    
    def __init__(self, a,b):
        self._a = a
        self._b = b
        
    def __repr__(self):
        return str((self.a, self.b))
    
    @property
    def a(self):
        return self._a
    
    @property
    def b(self):
        return self._b
    
    @property
    def min(self):
        return min([self.a, self.b])
    
    @property
    def max(self):
        return max([self.a, self.b])
    
    @property
    def irange(self):
        return m.fabs(self._a - self._b)
    
    def includes(self, other):
        pass
    
    def intersects(self, other):
        pass
        
    @staticmethod
    def remap(source_ival, target_ival, num, bounded=False):
        if source_ival.irange == 0: return target_ival.min
        else:
            ret = (((num - source_ival.min) * target_ival.irange) / source_ival.irange) + target_ival.min
            if bounded:
                if ret > target_ival.max : return target_ival.max
                elif ret < target_ival.min: return target_ival.min
            return ret

class Entity(object):
    
    def __init__(self, attr):
        self._pos = dict()
        self._attr = attr
        self._type = 'entity'
    
    def __repr__(self):
        return "Environment Entity: {0} : {1} ".format(self.type, self.name)

    @property
    def name(self):
        return self.get_attribute('name')

    @property
    def position(self):
        return self._pos[0]
    
    def set_position(self, pos, gen=0):
        self._pos[gen] = pos
    
    def get_position(self, gen=0):
        try:
            return self._pos[gen]
        except:
            return None
    
    @property
    def type(self):
        return self._type
    
    def set_type(self, type):
        self._type = type
    
    @property
    def attributes(self): return self._attr
    
    def set_attribute(self, key, value):
        self._attr[key] = value
    
    def get_attribute(self, key):
        
        def _finditem(obj, key):
            if key in obj: return obj[key]
            for k, v in obj.items():
                if isinstance(v,dict):
                    item = _finditem(v, key)
                    if item is not None:
                        return item
                        
        return _finditem(self.attributes, key)
    
    def has_attribute_value(self, val):
        
        def _findvalue(obj, val):
            if val in obj.values(): return True
            for k,v in obj.items():
                if isinstance(v,dict):
                    value = _findvalue(v, val)
                    if value is not None:
                        return True
            return False
        
        return _findvalue(self.attributes, val)

class Node(Entity):
    
    def __init__(self, pos, attr={}):
        super(Node, self).__init__(attr)
        self.set_position(pos)
        self.set_type('node')

class Template(Entity):
    
    def __init__(self, attr={}):
        super(Template, self).__init__(attr)
        self.set_type('template')
    
    @property
    def edges(self):
        return self.get_attribute('edges')

class Floor(Entity):
    
    def __init__(self, geo, attr={}):
        super(Floor, self).__init__(attr)
        self._geo = rs.coercecurve(geo)
        self._bds = Bounds2d(geo=geo)
        self._map = None
        self._msh = None
        self._grid = None
        self._grid_size = None
        self._coords = {}
        
        self.set_position(self.bounds.origin)
        self.set_type('floor')
        
    @property
    def geo(self):
        return self._geo
    
    @property
    def bounds(self):
        return self._bds
    
    @property
    def mesh(self):
        return self._msh
        
    @property
    def map(self):
        return self._map
    
    @property
    def grid(self):
        return self._grid
        
    def set_grid(self, grid_size):
        
        indexes = []
        denom = m.sqrt(2*(grid_size**2))
        t_mesh = rs.coercemesh(rs.AddPlanarMesh(self.geo))
        self._msh = self.bounds.to_grid(grid_size)
        self._map = Map(self)
        self._grid_size = grid_size
        
        for i, cpt in enumerate(rs.MeshFaceCenters(self.mesh)):
            line = rc.Geometry.Line(cpt, rc.Geometry.Vector3d(0,0,1))
            if not rc.Geometry.Intersect.Intersection.MeshLine(t_mesh, line)[1]:
                indexes.append(i)

        self.mesh.Faces.DeleteFaces(indexes)
        self._grid = rs.MeshFaceCenters(self.mesh)
        
        for i, pt in enumerate(self.grid):
            self.set_coord(self.to_grid_coord(pt), i)
        
        for i, vertex in enumerate(self.mesh.Vertices):

            edges = self.mesh.TopologyVertices.ConnectedFaces(i)
            for e1 in edges:
                for e2 in edges:
                    if not e1 == e2:
                        weight = rs.Distance(self._grid[e1], self._grid[e2])/denom
                        self.map.add_edge(e1,e2, weight)
                        
    @property
    def grid_size(self):
        return self._grid_size
    
    @property
    def coords(self):
        return self._coords
    
    def set_coord(self, key, val):
        self._coords[key] = val
    
    def get_neighbors_at_coord(self, key):
        return [(key[0]+i, key[1]+j) for i in range(-1,2) for j in range(-1, 2)]
    
    def get_index_at_coord(self, key, pt):
        
        def _search(key):
            """
                TODO - make this a full search
            """
            _neighbors = self.get_neighbors_at_coord(key)
            _vals = [(n, self.to_grid_point(n)) for n in _neighbors if n in self._coords]
            _vals.sort(key = lambda tup: rs.Distance(pt, tup[1]))
            if _vals: return _vals[0][0]
            
        if key in self._coords:
            return self._coords[key]
        else:
            return self._coords[_search(key)]
    
    def to_grid_coord(self, pt):
        
        grid_x = self.bounds.dim_x / m.floor(self.bounds.dim_x / self.grid_size)
        grid_y = self.bounds.dim_y / m.floor(self.bounds.dim_y / self.grid_size)
        
        cs_x = m.floor(self.bounds.dim_x / grid_x)
        cs_y = m.floor(self.bounds.dim_y / grid_y)

        pt_x = m.floor((pt.X - self.position.X)/ grid_x)
        pt_y = m.floor((pt.Y - self.position.Y)/ grid_y)
        
        return (pt_x, pt_y)
    
    def to_grid_index(self, pt):
        
        coord = self.to_grid_coord(pt)
        return self.get_index_at_coord(coord, pt)
    
    def to_grid_bounds(self, pt):
        return Bounds2d.from_center_pt(pt, self.grid_size, self.grid_size)
    
    def to_grid_point(self, key):
        return self.grid[self.coords[key]]
    
    def contains_pt(self, pt):
        if self.bounds.contains_pt(pt):
            if rs.PointInPlanarClosedCurve(pt, self.geo): return True
        return False
    
    def add_edge_map(self):
        
        def _func(key):
            edges = [self.map.barrier_map[k] for k in self.map.edges[key]]
            if len(edges) != 8 or float('inf') in edges:
                return True
            return False
        
        def _search(i):
            if not self.map.barrier_map[i] == float('inf'):
                _vals = [v for v in self.map.shallowsearch([i], _func).values() if not v==None]
                _vals.sort()
                if _vals:
                    _weight = 1 / (self.grid_size*(_vals[0]+1))**2
                    self.map.set_barrier(i, _weight)
                    
        if PARALLEL:
            ghpythonlib.parallel.run(_search, range(len(self.grid)), False)
        else:
            for i, pt in enumerate(self.grid):
                _search(i)
        
    def add_barrier_map(self, barrier):
        
        for i, pt in enumerate(self.grid):
            if barrier.bounds.contains_pt(pt):
                if rs.PointInPlanarClosedCurve(pt, barrier.geo):
                    self.map.set_barrier(i, float('inf'))
            
            else:
                bds = self.to_grid_bounds(pt)
                if barrier.bounds.intersects(bds):
                    for pt in bds.geo_pts:
                        """
                            TODO - this can probably be done more effectively without rhinoscript
                        """
                        if rs.PointInPlanarClosedCurve(pt, barrier.geo):
                            self.map.set_barrier(i, float('inf'))
                            break
            
class Barrier(Entity):
    
    def __init__(self, geo, attr={}):
        super(Barrier, self).__init__(attr)
        self._geo = rs.coercecurve(geo)
        self._bds = Bounds2d(geo=geo)
        
        self.set_position(self.bounds.origin)
        self.set_type('barrier')
        
    @property
    def geo(self):
        return self._geo
    
    @property
    def bounds(self):
        return self._bds
    
    @property
    def floor(self):
        return self.get_attribute('floor')
        
class Agent(Entity):
    
    def __init__(self, pos=None, attr={}, env=None):
        super(Agent, self).__init__(attr)
        self._attr = attr
        self._env = env
        
        self._history = []
        self._path = []
        
        self.set_position(pos)
        self.set_type('agent')
        
        self._speed = float(self.get_attribute('speed')['default'])
        self._velocity = int(m.floor(self.environment.resolution / self.speed)) if env else None
        self._min_velocity = None
        self._max_velocity = None
        self._state = None
        
        self.age = 0
        self.is_active = True
        self.is_complete = False
        
        self.goal_position = None
        self.next_position = None
                
    @property
    def position(self):
        return self.get_position(self.age)
        
    @property
    def speed(self):
        return self._speed
    
    @property
    def velocity(self):
        return self._velocity
        
    def shift(self, num=1):
        
        for r in range(num):
            
            self._path[-1].insert(self._path[-1].index(self.position), self.position)
            self.history.append(self.position)
            self.state.append(self.next_position)
            self.environment.floors[0].map.add_occupancy(self.position, self.age)
    
            keys = [k for k in sorted(self._pos.keys()) if k >= self.age][::-1]
            for ki in range(len(keys)):
                try: self.environment.floors[0].map.density_map[keys[ki]+1][self._pos[keys[ki]+1]] -= 1
                except: pass
                self.environment.floors[0].map.density_map[keys[ki]+1][self._pos[keys[ki]]] += 1
                self._pos[keys[ki]+1] = self._pos[keys[ki]]
    
    @property
    def grid_index(self):
        return self.environment.floors[0].to_grid_index(self.position.position)
    
    @property
    def state(self):
        return self._state
    
    def set_state(self, state):
        self._state = state
    
    @property
    def destination(self):
        val = self.get_attribute('destination')
        return random.choice(self.environment.get_nodes_with_value(val))
    
    @property
    def path(self):
        _path = sum([p for p in self._path], [])
        _dict = {idx: self.environment.floors[0].grid[idx] for idx in set(_path)}
        return [_dict[p] for p in _path]
    
    def add_path(self, path):
        self._path.append(copy.deepcopy(path))    
    
    @property
    def history(self):
        return self._history
    
    @property
    def visited(self):
        return [n.name for n in self.history if not type(n) == int]
    
    @property
    def environment(self):
        return self._env
    
    def set_environment(self, env):
        self._env = env
        self._velocity = int(m.floor(self.environment.resolution / self.speed))
        
    def toggle_active(self):
        self.is_active = not self.is_active
        
    def toggle_complete(self):
        self.is_complete = not self.is_complete
    
    def step(self):        
        
        def wait(time):
            return self.goal_position, [self.goal_position] * time
            
        def move(lst):
            
            lst = [l for l in lst if not l.get_attribute('name') in self.visited]
            
            if len(lst):
            
                properties = self.get_attribute('properties')
                keys = properties.keys()
                n_percs = [k for k in keys if random.randint(0,100) <= float(properties[k])]
                
                lst = [(l, self.environment.graph.get_distance((self.position, l))) for l in lst if l.get_attribute('name') in n_percs]
            
                if len(lst):
                    
                    lst.sort(key = lambda tup: len(tup[1]), reverse = True)
                    
                    while len(lst):
                        
                        tup = lst.pop()
                        n_choice = tup[0]
                        n_path = tup[1] # TEMP
                        num_people = len([a for a in self.environment.agents if self.goal_position == a.goal_position and a != self])
                        capacity = n_choice.get_attribute('capacity')

                        if capacity != None:
                            if num_people < float(capacity):
                                break
                            else:
                                if random.randint(0,100) < float(self.get_attribute('queuing')):
                                    break
                                else: 
                                    continue
                        else:
                            break
                else:
                    n_choice = self.destination
                    n_path = self.environment.graph.get_distance((self.position, n_choice))
            else:
                n_choice = self.destination
                try: n_path = self.environment.graph.get_distance((self.position, n_choice))
                except: n_path = self.environment.graph.get_distance((n_choice, self.position))[::-1]
                self.toggle_complete()
            
            """
                TODO - replace with entity.to_grid_index(environment)
                    nodes need floor property !! important
            """ 
            """
            n_index = self.environment.floors[0].to_grid_index(n_choice.position)
            n_path = self.environment.floors[0].map.shortest_path(self.grid_index, n_index, start_idx=self.age+1)
            """
            return n_choice, n_path

        if self.state == None:

            start_node = self.get_attribute('origin')
            start_positions = self.environment.get_nodes_with_value(start_node)
            start_position = random.choice(start_positions)
            
            self._min_velocity = int(m.floor(self.environment.resolution / float(self.get_attribute('speed')['min'])))
            self._max_velocity = int(m.floor(self.environment.resolution / float(self.get_attribute('speed')['max'])))
            
            self.goal_position = start_position
            self.set_state('waiting')
            
        else:

            if self.is_active:
                
                if self.state == 'ready':
                                        
                    self.goal_position, path = move(self.environment.graph.edges[self.position])
                    self.add_path(path)
                    path = [self.position] + path + [self.goal_position]
                    
                    for pi in range(len(path)):
                        self.environment.floors[0].map.add_density(path[pi], self.age+pi)
                        self.set_position(path[pi], self.age+pi)
                    
                    path.reverse()
                    self.set_state(path[:-1])
                    
               
                elif self.state == 'waiting':
                                        
                    wait_time = 1 if len(self._path) != 0 else random.randint(1,10)
                    
                    self.goal_position, path = wait(wait_time)
                    self.add_path([self.environment.floors[0].to_grid_index(self.goal_position.position)] * (wait_time))                    
                    path = [self.goal_position] + path + [self.goal_position]
                    
                    for pi in range(len(path)):
                        self.environment.floors[0].map.add_density(path[pi], self.age+pi)
                        self.set_position(path[pi], self.age+pi)
                    
                    path.reverse()
                    self.set_state(path[:-1])
                      
                else:

                    if len(self.state):
                                                 
                        self.next_position = self.state.pop()
                        
                        curr_people_pos = len(self.environment.agents_at_position(self.position, self.age))
                        next_people_pos = len(self.environment.agents_at_position(self.position, self.age+1))
                        
                        curr_people_npos = len(self.environment.agents_at_position(self.next_position, self.age))
                        next_people_npos = len(self.environment.agents_at_position(self.next_position, self.age+1))
                                                                       
                        
                        #print curr_people_pos, next_people_pos, curr_people_npos, next_people_npos
                        
                        if type(self.position) != Node:
                            
                            if type(self.next_position) != Node:
                                
                                source_ival = Interval(1,  2 * self.environment.resolution**2)
                                target_ival = Interval(self._max_velocity, self._min_velocity)
                                val = int(round(Interval.remap(source_ival, target_ival, curr_people_pos, bounded=True)))
                                max_density = 2 * self.environment.resolution**2
                                
                                #if next_people_pos > max_density and next_people_npos > max_density:
                                #    max_density *= 2
                                
                                if curr_people_npos >= max_density or next_people_npos >= max_density:
                                    if not next_people_pos >= max_density:
                                                                                
                                        self.shift()
                                        
                            elif type(self.next_position) == Node:
                                                              
                                capacity = self.next_position.get_attribute('capacity')
                                max_density = int(capacity) if capacity != None else float('inf')
                                
                                if curr_people_npos >= max_density or next_people_npos >= max_density:
                                    self.shift()
                        
                        
                        self.history.append(self.position)
                        self.age+=1
                        
                    else:
                        
                        if type(self.get_position(self.age-1)) != Node:
                            self.set_state('waiting')
                         
                        elif type(self.get_position(self.age-1)) == Node:
                            self.set_state('ready')
                                
                        if self.is_complete:
                            self.set_state('complete')
                            self.toggle_active()

class Environment():
    
    def __init__(self, resolution=30):
        self._entities = defaultdict(list)
        self._agents = []
        self._graph = Graph()
        self._graph_paths = {}
        self._resolution = resolution
    
    def __repr__(self):
        return 'Environment: {0} agents, {1} nodes, {2} floors'.format(len(self.agents), len(self.graph.nodes), len(self.floors))
    
    @property
    def resolution(self):
        return self._resolution
    
    @property
    def entities(self):
        return self._entities
     
    def add_entity(self, entity):
        self.entities[entity.type].append(entity)
    
    def add_entities(self, entities):
        
        def _add_floor(entity):
            entity = Floor(entity['geometry'], entity['profile'])
            self.add_floor(entity)
            self.add_entity(entity)
        
        def _add_node(entity):
            entity = Node(entity['position'], entity['profile'])
            _msg = self.add_node(entity)
            if _msg:
                return _msg
            else:
                self.add_entity(entity)
            
        def _add_template(entity):
            entity = Template(entity['profile'])
            self.add_template(entity)
            self.add_entity(entity)
        
        def _add_barrier(entity):
            entity = Barrier(entity['geometry'], entity['profile'])
            self.add_barrier(entity)
            self.add_entity(entity)
        
        def _add_agent(entity):
            entity = Agent(attr=entity['profile'])
            self.add_agent(entity)
            self.add_entity(entity)
        
        dict = defaultdict(list)
        for entity in entities:
            dict[entity['type']].append(entity)
        
        if len(dict['floor']):
            for  floor in dict['floor']:
                _add_floor(floor)
        else:
            e = gh.GH_RuntimeMessageLevel.Error
            ghenv.Component.AddRuntimeMessage(e, 'component needs at least one floor')
            return
        
        if len(dict['barrier']):
            for barrier in dict['barrier']:
                _add_barrier(barrier)
        
        for floor in self.entities['floor']:
            #pass
            floor.add_edge_map()
            
        if len(dict['node']) > 1:

            if PARALLEL: 
                _err = ghpythonlib.parallel.run(_add_node, dict['node'], False)
            else:
                _err = [_add_node(node) for node in dict['node']]
                
            if any( _err):
                for _msg in _err:
                    e = e = gh.GH_RuntimeMessageLevel.Error
                    ghenv.Component.AddRuntimeMessage(e, _msg)
                return
        else:
            e = gh.GH_RuntimeMessageLevel.Error
            ghenv.Component.AddRuntimeMessage(e, 'component needs at least two nodes')
            return
              
        if len(dict['template']):
            for template in dict['template']:
                _add_template(template)
        else: self.add_default_template()
            
        if len(dict['agent']):
            for agent in dict['agent']:
                _add_agent(agent)
        else:
            w = gh.GH_RuntimeMessageLevel.Warning
            ghenv.Component.AddRuntimeMessage(w, 'no agents in environment')
            
    @property
    def graph(self):
        return self._graph
    
    @property
    def graph_paths(self):
        return self._graph_paths
    
    def get_graph_path(self, n1, n2):
        """
            TODO - if n1 and n2 are on different floors -> handle graph links
                - nodes need a floor attribute
        """
        floor = self.floors[0]
        idx1 = floor.to_grid_index(n1.position)
        idx2 = floor.to_grid_index(n2.position)
        return floor.map.shortest_path(idx1, idx2, paths=self.graph_paths[n1])
    
    def set_graph_path(self, key, val):
        self._graph_paths[key] = val
    
    @property
    def templates(self):
        return [n for n in self.entities['template']]
    
    def add_template(self, template):
        for edge in template.edges:
            nodes = [n for n in self.nodes if n.position in edge]
            if len(nodes) == 2:
                try:
                    path = self.get_graph_path(nodes[0], nodes[1])
                except:
                    path = self.get_graph_path(nodes[1], nodes[0])
                    
                self.graph.add_edge(nodes[0], nodes[1], path,
                    directed=template.get_attribute('directed'))
    
    def add_default_template(self):
        for n1 in self.graph.nodes:
            for n2 in self.graph.nodes:
                if not n1 == n2: 
                    path = self.get_graph_path(n1, n2)
                    self.graph.add_edge(n1, n2, path)
                    
    @property
    def agents(self):
        return self._agents
        
    def add_agent(self, agent, other=None):
        agent.set_environment(self)
        self.agents.append(agent)
    
    def agents_at_position(self, position, gen=0):
        return [a for a in self.agents if a.get_position(gen) == position]
        
    @property
    def nodes(self):
        return [n for n in self.entities['node']]
    
    def add_node(self, node):
        self.graph.add_node(node)
        """
            TODO - nodes need a floor attribute
        """
        if self.floors[0].contains_pt(node.position):
            djk = self.floors[0].map.dijsktra(self.floors[0].to_grid_index(node.position))
            self.set_graph_path(node, djk[1])
        else:
            return node.name +' was flagged as not on a floor'

    def get_nodes_with_value(self, val):
        return [n for n in self.nodes if n.has_attribute_value(val)]
        
    @property
    def floors(self):
        return [n for n in self.entities['floor']]
    
    def add_floor(self, floor):
        floor.set_grid(self.resolution)
    
    def set_grid(self, grid_size):
        """
            TODO - implement more complexity
            grids will need to match up between floors
               - maybe 1 unified dictionary to hold graphs?
        """
        for floor in self.floors: floor.set_grid(grid_size)
        
    @property
    def barriers(self):
        return [n for n in self.entities['barriers']]
    
    def add_barrier(self, barrier):
        for floor in self.floors:
            if barrier.floor == floor.name:
                floor.add_barrier_map(barrier)
                
    @property
    def paths(self):
        return [a.path for a in self.agents]
        
    def generation(self, gen):
        return [a.get_position(gen) for a in self.agents]

    def step(self):
        
        def _func(agent):
            if agent.is_active:
                agent.step()
                   
        if PARALLEL:
            ghpythonlib.parallel.run(_func, self.agents, False)
        else:
            for i, agent in enumerate(self.agents):
                _func(agent)
        
    def run(self):
        count = 0
        while len([a for a in self.agents if a.is_active]) and count < 1000:
            self.step()
            count+=1
            
        if count == 1000: print ">>>>>>>>>>>>>>>>>>>>>>>>> broke outer while loop"
        
PARALLEL = False
if build :
    if len(entities) != 0 and resolution != None:
        environment = Environment(resolution=resolution)
        environment.add_entities([e for e in entities if e != None])
        
        a = environment
# ---------- end env_2 ----------
dam = DataDam(DataA=env_2.a, BufferDelay=2500000, BufferMode=0)
python = PythonScript(env=env_2.a)  # -> out, a
# ---------- python: Python ----------
print env.floors[0].map.density_map.values()
# ---------- end python ----------
run = PythonScript(env=dam, run=Toggle(True))  # -> out, paths, activity_map, occupancy_map, density_map, barrier_map, mesh
# ---------- run: Python ----------
import clr
clr.AddReference("Grasshopper")
from Grasshopper import DataTree
from Grasshopper.Kernel.Data import GH_Path
from itertools import chain
import copy

path_tree = DataTree[object]()
density_tree = DataTree[object]()

mesh = env.floors[0].mesh

if env != None:

    barrier_map = env.floors[0].map.get_barrier_map()

    if run:
    
        env = copy.deepcopy(env)
        env.run()
        
        for i, path in enumerate(env.paths):
            gh_path = GH_Path(i)
            for p in path: path_tree.Add(p, gh_path)
        
        activity = [0] * len(env.floors[0].grid)
        occupancy = [0] * len(env.floors[0].grid)
    
        for gen in env.floors[0].map.density_map.keys():
            
            gh_path = GH_Path(gen)
            
            d_map = env.floors[0].map.get_density_map_at(gen)
            for i, m in enumerate(d_map):
                activity[i] += m
                density_tree.Add(m, gh_path)
                
            o_map = env.floors[0].map.get_occupancy_map_at(gen)
            for j, n in enumerate(o_map):
                occupancy[j] += n
                
        
        activity_map = activity
        occupancy_map = occupancy
        density_map = density_tree
        paths = path_tree
# ---------- end run ----------
panel_4 = Panel(python.out)
explode = MeshExplode(Mesh=run.mesh, Interpolate=False)
timer = Timer(TimerInterval=100, Target=counter)  # disabled
pline = PolyLine(Vertices=run.paths, Closed=False)
preview = CustomPreview(
    Geometry=pline,
    Shader={ambient=RGB(0, 0, 0), diffuse=RGB(255, 105, 180), emission=RGB(76, 32, 54), shine=0.5, specular=RGB(255, 255, 255), transparency=0})
counter = Counter(Reset=Button())

gradient = Gradient(LowerLimit=0, UpperLimit=1, Parameter=run.barrier_map, stops=[0: RGB(0, 0, 0), 1: RGB(255, 255, 255)])
facen = FaceNormals(Mesh=run.mesh)  # -> Centers, Normals
lng = ListLength(List=facen.Centers)
series = Series(Start=0, Step=1, Count=lng)
int = Integer(series)
preview_2 = CustomPreview(Geometry=flatten(explode), Shader=gradient)
tag = TextTag3D(Location=facen.Centers, Text=int, Size=Slider(0.38, range=0..1), Justification=7)

# ---- group: activity map
num = Number(expr("x/2", number_slider))
gradient_2 = Gradient(
    LowerLimit=num,
    UpperLimit="0",
    Parameter=run.activity_map,
    stops=[0: RGB(234, 38, 0), 0.25: RGB(234, 126, 0), 0.5: RGB(254, 244, 84), 0.75: RGB(173, 203, 249), 1: RGB(75, 107, 169)])
preview_3 = CustomPreview(Geometry=explode, Shader=gradient_2)

# ---- group: occupancy map
gradient_3 = Gradient(
    LowerLimit="1000",
    UpperLimit="0",
    Parameter=run.occupancy_map,
    stops=[0: RGB(234, 38, 0), 0.25: RGB(234, 126, 0), 0.5: RGB(254, 244, 84), 0.75: RGB(173, 203, 249), 1: RGB(75, 107, 169)])
preview_4 = CustomPreview(Geometry=explode, Shader=gradient_3)

# ---- group: density map
branch = TreeBranch(Tree=run.density_map, Path=Slider(14, range=0..100), MaintainPaths=True)
lng_2 = ListLength(List=explode)
bnd = Bounds(Numbers=branch)
num_2 = Number(expr("4*x*x+1", number_slider_2))
series_2 = Series(Start=0, Step=1, Count=lng_2)
panel_5 = Panel(bnd)
gradient_4 = Gradient(
    LowerLimit=num_2,
    UpperLimit="0",
    Parameter=branch,
    stops=[0: RGB(18, 140, 105), 0.0137: RGB(234, 38, 0), 0.25: RGB(234, 126, 0), 0.5: RGB(254, 244, 84), 0.75: RGB(173, 203, 249), 1: RGB(75, 107, 169)])
popgeo = PopulateGeometry(Geometry=explode, Count=branch, Seed=series_2)
preview_5 = CustomPreview(Geometry=explode, Shader=gradient_4)

# ----
cir = Circle(Plane=popgeo, Radius="0.25")
mesh = Mesh(cir)

# ---- group: density map (continued)
preview_6 = CustomPreview(Geometry=mesh, Shader=graft(gradient_4))

# ==== cluster Node
capacity = ClusterInput()
position = ClusterInput()
name = ClusterInput()
node = PythonScript(position=flatten(position), name=flatten(name), capacity=flatten(capacity))  # -> out, node; inputs position: list, name: list, capacity: list
# ---------- node: Python ----------
import rhinoscriptsyntax as rs
import Grasshopper.Kernel as gh

entities = []

if (len(name) != 0 and
    len(position) != 0 and
    name != None and
    position != None):
    
    capacity = [None] if (len(capacity) == 0 or capacity == 0) else capacity
    
    position.reverse()
    name.reverse()
    capacity.reverse()
    
    for p in position:
        
        entity = {
            'position':rs.coerce3dpoint(p),
            'type': 'node',
            'profile': {
                'name': name[-1],
                'capacity': capacity[-1]
            }
        }
        
        if len(name) > 1: name.pop()
        if len(capacity) > 1: capacity.pop()
        entities.append(entity)

    for e in entities: print e

if len([p for p in position if not p == None]) == 0:
    e = gh.GH_RuntimeMessageLevel.Warning
    ghenv.Component.AddRuntimeMessage(e, 'no position detected')

if len([n for n in name if not n == None]) == 0:
    e = gh.GH_RuntimeMessageLevel.Warning
    ghenv.Component.AddRuntimeMessage(e, 'no name detected')


node = entities
# ---------- end node ----------
info = Data(node.out)
node_2 = ClusterOutput(node.node)
info_2 = ClusterOutput(info)

# ==== cluster Barrier
boundary = ClusterInput()
floor = ClusterInput()
barrier = PythonScript(boundary=flatten(boundary), floor=flatten(floor))  # -> out, barrier; inputs boundary: list, floor: list
# ---------- barrier: Python ----------
import rhinoscriptsyntax as rs
import Grasshopper.Kernel as gh

entities = []

if (len(floor) != 0 and
    len(boundary) != 0 and
    boundary != None and
    floor != None):
    
    boundary.reverse()
    
    for curve in boundary:
        if curve != None:
        
            crv = rs.coercecurve(curve)
    
            if crv.IsClosed:
                
                entity = {
                    'geometry' : crv,
                    'type' : 'barrier',
                    'profile' : {
                        'name' : None,
                        'floor' : floor[-1]
                    }
                }
                if len(floor) > 1: floor.pop()
                entities.append(entity)
            
            else: print 'curve not closed... ignoring'
    
    for e in entities: print e

if len([b for b in boundary if not b == None]) == 0:
    e = gh.GH_RuntimeMessageLevel.Warning
    ghenv.Component.AddRuntimeMessage(e, 'no boundary detected')

if len([f for f in floor if not f == None]) == 0:
    e = gh.GH_RuntimeMessageLevel.Warning
    ghenv.Component.AddRuntimeMessage(e, 'no floor detected')

barrier = entities
# ---------- end barrier ----------
info = Data(barrier.out)
barrier_2 = ClusterOutput(barrier.barrier)
info_2 = ClusterOutput(info)

# ==== cluster Floor
name = ClusterInput()
boundary = ClusterInput()
floor = PythonScript(boundary=flatten(boundary), name=flatten(name))  # -> out, floor; inputs boundary: list, name: list
# ---------- floor: Python ----------
import rhinoscriptsyntax as rs
import Grasshopper.Kernel as gh

entities = []

if (len(name) != 0 and
    len(boundary) != 0 and
    boundary != None and
    name != None) :
        
    boundary.reverse()
    name.reverse()
    
    for curve in boundary:
        if curve != None:
        
            crv = rs.coercecurve(curve)
            
            if crv.IsClosed:
            
                entity = {
                    'geometry' : rs.coercecurve(curve),
                    'type' : 'floor',
                    'profile' : {
                        'name' : name[-1]
                    }
                }
                
                if len(name) > 1: name.pop()
                entities.append(entity)
            
            else: print 'curve not closed... ignoring'
    
    for e in entities: print e

if len([b for b in boundary if not b == None]) == 0:
    e = gh.GH_RuntimeMessageLevel.Warning
    ghenv.Component.AddRuntimeMessage(e, 'no boundary detected')

if len([n for n in name if not n == None]) == 0:
    e = gh.GH_RuntimeMessageLevel.Warning
    ghenv.Component.AddRuntimeMessage(e, 'no name detected')
    
floor = entities
# ---------- end floor ----------
floor_2 = ClusterOutput(floor.floor)
info = Data(floor.out)
info_2 = ClusterOutput(info)
