# Grasshopper definition test.gh (Grasshopper 0.9.76)
# plug-ins: MeshEdit Components, Human, Circulation

number_slider = Slider(0.1, range=0..0.1)
geo = Geometry(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)
settings = NodeSettings(DistributionInterval="5 to 10", Geometry=geo)
pt = Point(Point(8.684374329, 7.436666626, 0))
geo_2 = Geometry(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)
geo_3 = Geometry(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)
pt_2 = Point(Point(9.633571104, 1.884290981, 0))
pt_3 = Point(Point(12.24529194, 21.03679894, 0))
node = Node(Position=pt, Name="dwell", Floor="floor", Settings=settings)
barrier = Barrier(Boundary=geo_2, Floor="floor")
floor = Floor(Boundary=geo_3, Name="floor")
node_2 = Node(Position=pt_2, Name="start", Floor="floor")
node_3 = Node(Position=pt_3, Name="end", Floor="floor")
number_slider_2 = Slider(500, range=0..1000)
settings_2 = AgentSettings(
    PathNodes="dwell",
    NodePropensities=Slider(1, range=0..1),
    QueuingPropensity=Slider(0, range=0..1),
    AgentCount=Slider(100, range=0..100))
agent = Agent(Name="agent", Origin="start", Destination="end", Settings=settings_2)
env = Environment(Entities=[barrier, node, node_2, node_3, agent, floor], Resolution=Slider(1, range=0..10), Run=Toggle(True))
number_slider_3 = Slider(13, range=0..100)
panel = Panel(env)

bmap = BarrierMap(Environment=env, FloorName="floor")  # -> Mesh, Values
gradient = Gradient(LowerLimit=0, UpperLimit=1, Parameter=bmap.Values, stops=[0: RGB(0, 128, 0), 0.5: RGB(255, 255, 0), 1: RGB(255, 0, 0)])
explode = MeshExplode(Mesh=bmap.Mesh, Interpolate=False)
preview = CustomPreview(Geometry=explode, Shader=gradient)

nmap = NodeMap(Environment=env, NodeName="dwell", Generation=number_slider_3)  # -> Mesh, Values
gradient_2 = Gradient(
    LowerLimit=1,
    UpperLimit=0,
    Parameter=nmap.Values,
    stops=[0: RGB(234, 38, 0), 0.25: RGB(234, 126, 0), 0.5: RGB(254, 244, 84), 0.75: RGB(173, 203, 249), 1: RGB(75, 107, 169)])
explode_2 = MeshExplode(Mesh=nmap.Mesh, Interpolate=False)
preview_2 = CustomPreview(Geometry=explode_2, Shader=gradient_2)

dmap = DensityMap(Environment=env, FloorName="floor", Generation=number_slider_3)  # -> Mesh, Values
gradient_3 = Gradient(
    LowerLimit=1,
    UpperLimit=0,
    Parameter=dmap.Values,
    stops=[0: RGB(255, 0, 255), 0.25: RGB(234, 126, 0), 0.5: RGB(254, 244, 84), 0.75: RGB(173, 203, 249), 1: RGB(75, 107, 169)])
explode_3 = MeshExplode(Mesh=dmap.Mesh, Interpolate=False)
preview_3 = CustomPreview(Geometry=explode_3, Shader=gradient_3)

panel_2 = Panel(nmap.Values)

apaths = AgentPaths(Environment=env, AgentName="agent")  # -> Mesh, Indexes, Log
facen = FaceNormals(Mesh=apaths.Mesh)  # -> Centers, Normals
item = ListItem(List=facen.Centers, Index=apaths.Indexes, Wrap=True)
pline = PolyLine(Vertices=item, Closed=False)  # -> flatten(Polyline)
number_slider_4 = Slider(100, range=0..100)
item_2 = ListItem(List=pline, Index=Slider(241, range=0..1000), Wrap=True)
previewlw = CustomPreviewLineweights(
    Geometry=item_2,
    Shader={ambient=RGB(0, 0, 0), diffuse=RGB(255, 105, 180), emission=RGB(76, 32, 54), shine=0.5, specular=RGB(255, 255, 255), transparency=0},
    Thickness=Slider(3, range=0..10),
    Absolute=False)
