# Grasshopper definition test1.gh (Grasshopper 0.9.76)
# plug-ins: MeshEdit Components, Circulation, Kangaroo Components

pt = Point([Point(6, 60, 0), Point(73, 96, 0), Point(49, 7, 0)])
settings = NodeSettings(Capacity=Slider(2, range=0..10), Distribution="10 to 20")
pt_2 = Point([Point(53, 69, 0), Point(74, 28, 0)])
settings_2 = NodeSettings(Capacity=Slider(2, range=0..10), Distribution="5 to 10")
pt_3 = Point(Point(13.50043802, 27.45374379, 0))
geo = Geometry([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])
geo_2 = Geometry(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)
pt_4 = Point(Point(8, 93, 0))
node = Node(Position=pt_4, Name="start1", Floor="floor1")
node_2 = Node(Position=pt_3, Name="end1", Floor="floor1")
node_3 = Node(Position=pt, Name="dwell1", Floor="floor1", Settings=settings)
floor = Floor(Boundary=geo_2, Name="floor1")
barrier = Barrier(Boundary=geo, Floor="floor1")
node_4 = Node(Position=pt_2, Name="dwell2", Floor="floor1", Settings=settings_2)
settings_3 = AgentSettings(PathNodes="dwell1", NodePropensities=Slider(0.6, range=0..1), Distribution="0 to 10", Count=Slider(500, range=0..1000))
settings_4 = AgentSettings(PathNodes="dwell2", NodePropensities=Slider(0.5, range=0..1), Distribution="0 to 20", Count=Slider(500, range=0..1000))
agent = Agent(Name="agent1", Origin="start1", Destination="end1", Settings=settings_3)
agent_2 = Agent(Name="agent2", Origin="end1", Destination="start1", Settings=settings_4)
ln = Line(StartPoint=pt_4)
ln_2 = Line(EndPoint=pt_3)
number_slider = Slider(1, range=0..10)
template = Template(Lines=[ln, ln_2], Directed=Toggle(True))
env = Environment(Entities=[floor, node, node_2, node_3, agent, barrier, agent_2, node_4], Resolution=number_slider, Run=Toggle(True))
number_slider_2 = Slider(95, range=0..100)
timer = Timer(TimerInterval=20, Target=counter)  # disabled
counter = Counter(Reset=Button())

dmap = DensityMap(Environment=env, FloorName="floor1", NonZero=Toggle(True))  # -> Mesh, Values
gradient = Gradient(
    LowerLimit="1",
    UpperLimit="0",
    Parameter=dmap.Values,
    stops=[0: RGB(234, 38, 0), 0.25: RGB(234, 126, 0), 0.5: RGB(254, 244, 84), 0.75: RGB(173, 203, 249), 1: RGB(75, 107, 169)])
explode = MeshExplode(Mesh=dmap.Mesh, Interpolate=False)
preview = CustomPreview(Geometry=explode, Shader=gradient)

bmap = BarrierMap(Environment=env, FloorName="floor1")  # -> Mesh, Values
gradient_2 = Gradient(LowerLimit=0, UpperLimit=1, Parameter=bmap.Values, stops=[0: RGB(0, 128, 0), 0.5: RGB(255, 255, 0), 1: RGB(255, 0, 0)])
explode_2 = MeshExplode(Mesh=bmap.Mesh, Interpolate=False)
preview_2 = CustomPreview(Geometry=explode_2, Shader=gradient_2)

omap = OccupancyMap(Environment=env, FloorName="floor1", Generation=Slider(269, range=0..1000))  # -> Mesh, Values
sqr = Square(Value=number_slider)
bnd = Bounds(Numbers=omap.Values)
gradient_3 = Gradient(
    LowerLimit=sqr,
    UpperLimit="0",
    Parameter=omap.Values,
    stops=[0: RGB(255, 0, 255), 0.25: RGB(234, 126, 0), 0.5: RGB(254, 244, 84), 0.75: RGB(173, 203, 249), 1: RGB(75, 107, 169)])
panel = Panel(sqr)
panel_2 = Panel(bnd)
explode_3 = MeshExplode(Mesh=omap.Mesh, Interpolate=False)
preview_3 = CustomPreview(Geometry=explode_3, Shader=gradient_3)

faceb = FaceBoundaries(Mesh=explode_3)  # -> flatten(Boundaries)
pcen = PolygonCenter(Polyline=faceb)  # -> CenterV, CenterE, CenterA
scale = Scale(Geometry=faceb, Center=pcen.CenterV, Factor=0.5)  # -> Geometry, Transform
pop2d = Populate2D(Region=scale.Geometry, Count=omap.Values, Seed=1)
panel_3 = Panel("0.5")
cir = Circle(Plane=pop2d, Radius=Slider(0.2, range=0..1))  # disabled
boundary = BoundarySurfaces(Edges=cir)  # disabled
