# Grasshopper definition demo_file.ghx (Grasshopper 0.9.76)
# plug-ins: MeshEdit Components, Python Interpreter, Human, Kangaroo Components, Flux, Mesh Pipe

number_slider = Slider(5, range=0..10)  # disabled

outer = Geometry(<curve referenced from the Rhino model>)
inner = Geometry([<curve referenced from the Rhino model> x60])
boundary = BoundarySurfaces(Edges=inner)
cls = Closed(Curve=inner)  # -> Closed, Periodic
cull = CullPattern(List=inner, CullPattern=cls.Closed)
merge = Merge(Data1=outer, Data2=cull)  # -> flatten(Result)
bbox = BoundingBox(Content=outer, Plane=PlaneXY(0, 0, 0))  # -> Box, Box_2
area = Area(Geometry=bbox.Box)  # -> Area, Centroid
divlength = DivideLength(Curve=merge, Length=Slider(3, range=0..10))  # -> flatten(Points), Tangents, Parameters
scale = Scale(Geometry=bbox.Box, Center=area.Centroid, Factor=Slider(1.1, range=0..10))  # -> Geometry, Transform
cullpt = CullDuplicates(Points=divlength.Points, Tolerance=0.1, CullMode=3)  # -> Points, Indices, Valence
voronoi = Voronoi(Points=cullpt.Points, Boundary=scale.Geometry, BruteForceOverride=False)
Z = UnitZ(Factor=1)
explode = Explode(Curve=voronoi, Recursive=True)  # -> flatten(Segments), Vertices
cp = ControlPoints(Curve=explode.Segments)  # -> Points, Weights, Knots
mesh = Mesh(outer)
mesh_2 = Mesh(cull)
mjoin = MeshJoin(Meshes=mesh_2)
Z_2 = UnitZ(Factor=1)
meshray = MeshRay(Mesh=mesh, Point=cp.Points, Direction=Z)  # -> Point, Hit
clean = CleanTree(RemoveNulls=True, RemoveInvalid=True, RemoveEmpty=False, Tree=meshray.Point)
meshray_2 = MeshRay(Mesh=mjoin, Point=cp.Points, Direction=Z_2)  # -> Point, Hit
lng = ListLength(List=clean)
clean_2 = CleanTree(RemoveNulls=True, RemoveInvalid=True, RemoveEmpty=False, Tree=meshray_2.Point)
lng_2 = ListLength(List=clean_2)
equals = Equality(FirstNumber=lng, SecondNumber="2")  # -> Equality, Inequality
equals_2 = Equality(FirstNumber=lng_2, SecondNumber="0")  # -> Equality, Inequality
and = GateAnd(A=equals_2.Equality, B=equals.Equality)
cull_2 = CullPattern(List=graft(explode.Segments), CullPattern=and)
cull_3 = CullPattern(List=cp.Points, CullPattern=and)
sink_node = Point(Point(1366.164178, -1210.612106, 0))
gates = Point([Point(1499.766431, -1178.675443, 0), Point(1539.111759, -1218.02077, 0), Point(1562.053641, -1244.289225, 0), Point(1561.938931, -1274.34309, 0), Point(1561.699201, -1314.634285, 0), Point(1562.701558, -1356.151195, 0), Point(1564.033653, -1403.523539, 0), Point(1562.787507, -1487.419222, 0), Point(1562.949132, -1529.840683, 0), Point(1562.207526, -1561.414383, 0), Point(1522.244018, -1561.489643, 0), Point(1514.894708, -1500.501764, 0), Point(1528.505219, -1418.987934, 0), Point(1528.375116, -1326.492142, 0), Point(1438.227221, -1226.168181, 0)])
cp_2 = ClosestPoint(Point=gates, Cloud=flatten(cull_3))  # -> ClosestPoint, CPIndex, Distance
cp_3 = ClosestPoint(Point=sink_node, Cloud=flatten(cull_3))  # -> ClosestPoint, CPIndex, Distance
ln = Line(StartPoint=gates, EndPoint=cp_2.ClosestPoint)
ln_2 = Line(StartPoint=sink_node, EndPoint=cp_3.ClosestPoint)
merge_2 = Merge(Data1=ln_2, Data2=ln, Data3=cull_2)  # -> flatten(Result)

# ----
# this should be written as a possible set for more complex agents
panel = Panel("100")  # disabled
panel_2 = Panel("""wait1
wait2""")  # disabled
panel_3 = Panel("start")  # disabled
panel_4 = Panel("test")  # disabled
panel_5 = Panel("end")  # disabled
agent = PythonScript(name=panel_4, origin=panel_3, destination=panel_5, nodes=flatten(panel_2), vals=flatten(panel))  # -> out, a; inputs nodes: list, vals: list; disabled
# ---------- agent: Python ----------
import rhinoscriptsyntax as rs
import copy, random

           
if name != None and origin != None and destination != None:

    nodes.reverse()
    vals.reverse()

    entity = {
        'type': 'agent',
        'profile': {
            'name': name,
            'origin': origin,
            'destination': destination,
            'properties':{
            },
            'speed':{
                'min':0.5, #0.65
                'max':2, #2.05
                'default':1 # 1.35
            },
            'influence':{
                'queuing':50, #implement later
                'remainder':None # implement later
            }
        }
    }
    
    if len(nodes) > 0 and len(vals) > 0:
        count=0
        while len(nodes) and count < 100:
            count+=1
            entity['profile']['properties'][nodes.pop()] = vals.pop() if len(vals) > 1 else vals[-1]
    
    
    entity['profile']['properties'][origin] = 100
    entity['profile']['properties'][destination] = 100
    
    print entity
    a = [entity]
# ---------- end agent ----------
number_slider_2 = Slider(10, range=0..1000)  # disabled
dup = DuplicateData(Data=agent.a, Number=number_slider_2, Order=True)  # disabled
panel_6 = Panel(agent.out)  # disabled

panel_7 = Panel("wait1")  # disabled
pt = Point(Point(1538.23011, -1225.592674, 0))  # disabled
node = PythonScript(position=flatten(pt), name=flatten(panel_7), capacity=flatten(number_slider))  # -> out, a; inputs position: list, name: list, capacity: list; disabled
# ---------- node: Python ----------
import copy
import rhinoscriptsyntax as rs

if len(name) != 0 and position!= None:
    
    entities = []
    capacity = [None] if (len(capacity) == 0 or capacity == 0) else capacity
    
    position.reverse()
    name.reverse()
    capacity.reverse()
    
    for p in position:
        
        entity = {
            'position':rs.coerce3dpoint(p),
            'type': 'node',
            'profile': {
                'name': name[-1],
                'capacity': capacity[-1]
            }
        }
        if len(name) > 1: name.pop()
        if len(capacity) > 1: capacity.pop()
        entities.append(entity)

    for e in entities: print e
    a = entities
# ---------- end node ----------

panel_8 = Panel("start")  # disabled
pt_2 = Point([Point(1518.512731, -1559.08619, 0), Point(1532.35701, -1559.179105, 0), Point(1561.253457, -1558.807447, 0), Point(1562.275518, -1529.074768, 0), Point(1562.622975, -1486.987894, 0), Point(1562.095981, -1446.293488, 0), Point(1561.137274, -1402.708102, 0), Point(1562.021112, -1361.498453, 0), Point(1561.359329, -1318.870017, 0), Point(1563.718663, -1273.547687, 0), Point(1561.051776, -1237.884983, 0), Point(1539.349559, -1216.182766, 0), Point(1500.871655, -1179.734703, 0), Point(1438.022475, -1227.7102, 0), Point(1528.187775, -1327.529592, 0), Point(1528.000365, -1417.982633, 0), Point(1513.288306, -1499.413968, 0)])  # disabled
node_2 = PythonScript(position=flatten(pt_2), name=flatten(panel_8))  # -> out, a; inputs position: list, name: list, capacity: list; disabled; same code as node

panel_9 = Panel("end")  # disabled
pt_3 = Point(Point(1378.435974, -1209.228218, 0))  # disabled
node_3 = PythonScript(position=flatten(pt_3), name=flatten(panel_9))  # -> out, a; inputs position: list, name: list, capacity: list; disabled; same code as node

panel_10 = Panel("wait2")  # disabled
pt_4 = Point(Point(1535.957252, -1274.72138, 0))  # disabled
node_4 = PythonScript(position=flatten(pt_4), name=flatten(panel_10), capacity=flatten(number_slider))  # -> out, a; inputs position: list, name: list, capacity: list; disabled; same code as node

panel_11 = Panel("floor1")  # disabled
boundary_2 = Geometry(<curve referenced from the Rhino model>)  # disabled
floor = PythonScript(boundary=flatten(boundary_2), name=flatten(panel_11))  # -> out, a; inputs boundary: list, name: list; disabled
# ---------- floor: Python ----------
import rhinoscriptsyntax as rs
    
if len(name) != 0 and boundary != None:
    
    entities = []
    boundary.reverse()
    name.reverse()
    
    for curve in boundary:
        
        crv = rs.coercecurve(curve)
        if crv.IsClosed:
        
            entity = {
                'geometry':rs.coercecurve(curve),
                'type':'floor',
                'profile':{
                    'name': name[-1]
                }
            }
            if len(name) > 1: name.pop()
            entities.append(entity)
        
        else: print 'curve not closed... ignoring'
    
    for e in entities: print e
    a = entities
# ---------- end floor ----------

barriers = Geometry([<curve referenced from the Rhino model> x60])  # disabled
barrier = PythonScript(boundary=flatten(barriers), floor=flatten(panel_11))  # -> out, a; inputs boundary: list, floor: list; disabled
# ---------- barrier: Python ----------
import rhinoscriptsyntax as rs
import Rhino as rc
    
if len(floor) != 0 and boundary != None:
    
    entities = []
    boundary.reverse()
    
    for curve in boundary:
        
        crv = rs.coercecurve(curve)

        if crv.IsClosed:
            
            entity = {
                'geometry':crv,
                'type':'barrier',
                'profile':{
                    'name':None,
                    'floor':floor[-1]
                }
            }
            if len(floor) > 1: floor.pop()
            entities.append(entity)
        
        else: print 'curve not closed... ignoring'
    
    for e in entities: print e
    a = entities
# ---------- end barrier ----------

panel_12 = Panel("wall")  # disabled
panel_13 = Panel("concourse")  # disabled
panel_14 = Panel("name")  # disabled
panel_15 = Panel("name")  # disabled
attr = PythonScript(name=panel_14, value=panel_12)  # -> out, a; disabled
# ---------- attr: Python ----------
a = [{name: value}]
# ---------- end attr ----------
attr_2 = PythonScript(name=panel_15, value=panel_13)  # -> out, a; disabled; same code as attr
profile = PythonScript(attr=flatten(attr.a))  # -> out, a; inputs attr: list; disabled
# ---------- profile: Python ----------
profile = {
}

for attribute in attr:
    for key in attribute.keys():
        profile[key] = attribute[key]

print profile
a = [profile]
# ---------- end profile ----------
profile_2 = PythonScript(attr=flatten(attr_2.a))  # -> out, a; inputs attr: list; disabled; same code as profile
boundary_3 = Geometry(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)  # disabled
barriers_2 = Geometry([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])  # disabled
barrier_2 = PythonScript(boundary=flatten(barriers_2), profile=flatten(profile.a))  # -> out, a; inputs boundary: list, profile: list; disabled
# ---------- barrier_2: Python ----------
import rhinoscriptsyntax as rs
import Rhino as rc
    
if len(profile) != 0 and boundary != None:
    
    entities = []
    boundary.reverse()
    profile.reverse()
    
    for curve in boundary:
        
        crv = rs.coercecurve(curve)

        if crv.IsClosed:
            
            entity = {
                'geometry':crv,
                'type':'barrier',
                'profile':profile[-1]
            }
            if len(profile) > 1: profile.pop()
            entities.append(entity)
        
        else: print 'curve not closed... ignoring'
    
    a = entities
# ---------- end barrier_2 ----------
floor_2 = PythonScript(boundary=flatten(boundary_3), profile=flatten(profile_2.a))  # -> out, a; inputs boundary: list, profile: list; disabled
# ---------- floor_2: Python ----------
import rhinoscriptsyntax as rs
    
if len(profile) != 0 and boundary != None:
    
    entities = []
    boundary.reverse()
    profile.reverse()
    
    for curve in boundary:
        
        
        crv = rs.coercecurve(curve)

        if crv.IsClosed:
        
            entity = {
                'geometry':rs.coercecurve(curve),
                'type':'floor',
                'profile':profile[-1]
            }
            if len(profile) > 1: profile.pop()
            entities.append(entity)
        
        else: print 'curve not closed... ignoring'
    
    a = entities
# ---------- end floor_2 ----------

panel_16 = Panel("bathroom")  # disabled
panel_17 = Panel("2")  # disabled
panel_18 = Panel("capacity")  # disabled
panel_19 = Panel("name")  # disabled
attr_3 = PythonScript(name=panel_18, value=panel_17)  # -> out, a; disabled; same code as attr
attr_4 = PythonScript(name=panel_19, value=panel_16)  # -> out, a; disabled; same code as attr
profile_3 = PythonScript(attr=flatten([attr_4.a, attr_3.a]))  # -> out, a; inputs attr: list; disabled; same code as profile
pt_5 = Point([Point(-7.5, 62.6, 0), Point(35.9, 62.8, 0)])  # disabled
node_5 = PythonScript(position=flatten(pt_5), profile=flatten(profile_3.a))  # -> out, a; inputs position: list, profile: list; disabled
# ---------- node_5: Python ----------
import copy
import rhinoscriptsyntax as rs

if len(profile) != 0 and position!= None:
    
    entities = []
    position.reverse()
    profile.reverse()
    
    for p in position:
        entity = {
            'position':rs.coerce3dpoint(p),
            'type': 'node',
            'profile':profile[-1]
        }
        if len(profile) > 1: attr.pop()
        entities.append(entity)

    a = entities
# ---------- end node_5 ----------

test = Profile()  # -> out, a; disabled
# ---------- test: Python ----------
ghenv.Component.Name = "profile"
ghenv.Component.NickName = 'Profile'
ghenv.Component.Message = 'VER 0.0.1\nMAR_15_2016'
ghenv.Component.Category = "OptimalPath"
ghenv.Component.SubCategory = "00 | TEST | PATHSIM "

import Rhino as rc
import scriptcontext as sc
import rhinoscriptsyntax as rs
import os
import time
import System
import shutil
import Grasshopper.Kernel as gh
import math
from Grasshopper import DataTree
from Grasshopper.Kernel.Data import GH_Path




class Test():
    
    def __init__(self):
        pass
    
    def run(self, dict):
        ghenv.Component.NickName = dict['name']
        
        ghenv.Component.Params.Input[0].NickName = dict['prop']
        ghenv.Component.Params.Input[0].Name = dict['prop']


a = Test()
# ---------- end test ----------
number_slider_3 = Slider(376, range=0..1000)  # disabled
number_slider_4 = Slider(376, range=0..1000)  # disabled
python = PythonScript(name=number_slider_3)  # -> out, a; disabled
# ---------- python: Python ----------
profile.run({
    'name': 'test',
    'prop': 'position'
})
# ---------- end python ----------
python_2 = PythonScript(name=number_slider_4)  # -> out, a; disabled
# ---------- python_2: Python ----------
profile.run({
    'name': 'test',
    'prop': 'location'
})
# ---------- end python_2 ----------

number_slider_5 = Slider(200, range=0..1000)  # disabled
profile_4 = PythonScript()  # -> out, a; disabled
# ---------- profile_4: Python ----------
passenger_profile_departing = {
    'name':'passenger',
    'status': {
        'def':'departing',
        'origin':'curbside',
        'destination': 'gate'
    },
    'properties': {
        'curbside': 100,
        'bathroom':100,
        'security': 100,
        'gate': 100,
        'restaurant':100,
        'lounge': 50,
    },
    'influence':{
        'queuing':70,
        'remainder':120
    }
    
}

a = [passenger_profile_departing]
# ---------- end profile_4 ----------
dup_2 = DuplicateData(Data=profile_4.a, Number=number_slider_5, Order=True)  # disabled
agent_2 = PythonScript(profile=flatten(dup_2))  # -> out, a; inputs profile: list; disabled
# ---------- agent_2: Python ----------
import rhinoscriptsyntax as rs
import copy, random

           
if len(profile) != 0:

    entities = []
    profile.reverse()

    while len(profile) > 0:
        entity = {
            'type': 'agent',
            'profile':profile[-1]
        }
        profile.pop()
        entities.append(entity)
        
    a = entities
# ---------- end agent_2 ----------

# ---- group: graphsearch
python_3 = PythonScript()  # -> out, a
# ---------- python_3: Python ----------
from collections import defaultdict

class Graph(object):
    
    def __init__(self, nodes=set(), edges=defaultdict(set), distances={}):
        self.nodes = nodes
        self.edges = edges
        self.distances = distances 

    def add_node(self, value):
        self.nodes.add(value)
        
    def add_edge(self, from_node, to_node, distance):
        self.add_node(from_node)
        self.add_node(to_node)
        
        self.edges[from_node].add(to_node)
        self.edges[to_node].add(from_node)
        self.distances[(from_node, to_node)] = distance
        self.distances[(to_node, from_node)] = distance


def deepsearch(key, func, depth=0, visited={}, max_depth=10):
    print 'deep search', depth
    visited[key] = None 
    if func(dict[key]): visited[key] = depth
    elif depth < max_depth:
        for edge in graph.edges[key]:
            if not edge in visited:
                visited.update(deepsearch(edge, func, depth+1, visited))
    return visited

def shallowsearch(keys, func, depth=0, visited={}, max_depth=10):
    print 'shallow search', depth
    for key in keys:
        if not key in visited: visited[key] = None 
        if func(dict[key]):
            visited[key] = depth
            return visited
    if depth < max_depth:
        keys = set([k for key in keys for k in graph.edges[key]])
        return shallowsearch(keys, func, depth+1, visited)
        
graph = Graph()
dict = {
    'a':0,
    'b':0,
    'c':0,
    'd':1,
    'e':0,
    'f':1,
    'g':0,
    'h':1
}
graph.add_edge('a','b',1 )
graph.add_edge('a','c',1 )
graph.add_edge('c','d',1 )
graph.add_edge('b','e',1 )
graph.add_edge('e','f',1 )
graph.add_edge('e','g',1 )
graph.add_edge('g','h',1 )


def _func(num):
    if num == 1:return True
    return False

print deepsearch('a', _func)
print shallowsearch('a', _func)
# ---------- end python_3 ----------

# ----
panel_20 = Panel("""security
g1
concession""")  # disabled
panel_21 = Panel("""100
100
100""")  # disabled
profile_5 = PythonScript(attr=flatten(panel_20), val=flatten(panel_21))  # -> out, a; inputs attr: list, val: list; disabled
# ---------- profile_5: Python ----------
if len(attr) and len(val) and len(attr) == len(val):
    
    profile= {
        'properties': {
        } 
    }
    
    for i, att in enumerate(attr):
        profile['properties'][att] = val[i]
    
    for p in profile['properties']:
        print p ,":", profile['properties'][p] 

    a = [profile]
# ---------- end profile_5 ----------
panel_22 = Panel("security")  # disabled
panel_23 = Panel("dep1")  # disabled
panel_24 = Panel("g1")  # disabled
agent_3 = PythonScript(name=panel_23, origin=panel_22, destination=panel_24, profile=flatten(profile_5.a))  # -> out, a; inputs profile: list; disabled
# ---------- agent_3: Python ----------
import rhinoscriptsyntax as rs
import copy, random

           
if len(profile) != 0 and origin != None and destination != None:

    entities = []
    profile.reverse()

    while len(profile) > 0:
        
        if profile[-1] != None:
            
            entity = {
                'type': 'agent',
                'profile':profile[-1],
                'influence':{
                    'queuing':100,
                    'remainder':None # implement later
                }
            }
            """
                TODO - make class : this is not good
            """
            entity['profile']['name'] = name
            entity['profile']['origin'] = origin
            entity['profile']['destination'] = destination
            
            entity['profile']['properties'][origin] = 100
            entity['profile']['properties'][destination] = 100
            
            entities.append(entity)
        
        profile.pop()
        
        
    for e in entities: print e
    a = entities
# ---------- end agent_3 ----------

panel_25 = Panel("2")  # disabled
panel_26 = Panel("capacity")  # disabled
attr_5 = PythonScript(name=panel_26, value=panel_25)  # -> out, a; disabled; same code as attr

panel_27 = Panel("curbside")  # disabled
panel_28 = Panel("security")  # disabled
panel_29 = Panel("gate")  # disabled
panel_30 = Panel("name")  # disabled
panel_31 = Panel("name")  # disabled
panel_32 = Panel("name")  # disabled
attr_6 = PythonScript(name=panel_30, value=panel_29)  # -> out, a; disabled; same code as attr
attr_7 = PythonScript(name=panel_31, value=panel_27)  # -> out, a; disabled; same code as attr
attr_8 = PythonScript(name=panel_32, value=panel_28)  # -> out, a; disabled; same code as attr
profile_6 = PythonScript(attr=flatten(attr_6.a))  # -> out, a; inputs attr: list; disabled; same code as profile
profile_7 = PythonScript(attr=flatten(attr_7.a))  # -> out, a; inputs attr: list; disabled; same code as profile
profile_8 = PythonScript(attr=flatten([attr_8.a, attr_5.a]))  # -> out, a; inputs attr: list; disabled; same code as profile
pt_6 = Point([Point(4.265214634, 53.54037396, 0), Point(22.98931928, 53.39255208, 0)])  # disabled
pt_7 = Point(Point(14.87710684, 79.93414297, 0))  # disabled
pt_8 = Point([Point(2.579222705, 2.45101553, 0), Point(15.42154413, 2.526116825, 0), Point(26.68673837, 2.45101553, 0)])  # disabled
node_6 = PythonScript(position=flatten(pt_6), profile=flatten(profile_8.a))  # -> out, a; inputs position: list, profile: list; disabled; same code as node_5
node_7 = PythonScript(position=flatten(pt_7), profile=flatten(profile_6.a))  # -> out, a; inputs position: list, profile: list; disabled; same code as node_5
node_8 = PythonScript(position=flatten(pt_8), profile=flatten(profile_7.a))  # -> out, a; inputs position: list, profile: list; disabled; same code as node_5

toggle = BooleanToggle(False)  # disabled
ln_3 = Line(StartPoint=pt, EndPoint=pt_4)  # disabled
ln_4 = Line(StartPoint=pt_2, EndPoint=pt_3)  # disabled
ln_5 = Line(StartPoint=graft([pt_2, pt_3]), EndPoint=[pt, pt_4])  # disabled
template = PythonScript(lines=flatten([ln_5, ln_4, ln_3]), directed=toggle)  # -> out, a; inputs lines: list of Curve, directed: Boolean; disabled
# ---------- template: Python ----------
import rhinoscriptsyntax as rs
import Rhino as rc


if len(lines):

    entities = []
    for line in lines:
        entities.append([rs.CurveEndPoint(line), rs.CurveStartPoint(line)])
    entity = {
        'type': 'template',
        'profile': {
            'edges': entities,
            'directed': directed if directed else False
        }
    }
    print entity
    a = [entity]
# ---------- end template ----------
number_slider_6 = Slider(3, range=0..10)  # disabled
flux_projects = FluxProjects()  # disabled
env = PythonScript(entities=flatten([node_2.a, node_3.a, floor.a, barrier.a, dup, node.a, template.a, node_4.a]), res=number_slider_6)  # -> out, a; inputs entities: list; disabled
# ---------- env: Python ----------
from collections import defaultdict
import rhinoscriptsyntax as rs
import Rhino as rc
import scriptcontext as sc
import random, copy
from itertools import permutations
import math as m
import Grasshopper.Kernel as gh

import ghpythonlib.parallel

class Graph(object):
    
    def __init__(self, nodes=None, edges=None, distances=None):
        self.nodes = nodes if nodes else set()
        self.edges = edges if edges else defaultdict(set)
        self.distances = distances if distances else dict()

    def __repr__(self):
        return "Graph: {0} nodes, {1} edges".format(len(self.nodes), len(self.edges))
    
    def add_node(self, value):
        self.nodes.add(value)
        
    def add_edge(self, from_node, to_node, distance, directed=False):
        self.add_node(from_node)
        self.add_node(to_node)
        
        self.edges[from_node].add(to_node)
        self.distances[(from_node, to_node)] = distance
        if directed:
            self.edges[to_node].add(from_node)
            self.distances[(to_node, from_node)] = distance
    
    def get_distance(self, key, gen=0):
        return self.distances[key]
    
    def get_step(self, initial, goal_position, route):
        return
    
    def deepsearch(self, key, func, depth=0, visited=None, max_depth=10):
        if not visited: visited = {}
        visited[key] = None
        if func(key): visited[key] = depth
        elif depth < max_depth:
            for edge in self.edges[key]:
                if not edge in visited:
                    visited.update(self.deepsearch(edge, func, depth+1, visited))
        return visited
    
    def shallowsearch(self, keys, func, depth=0, visited=None, max_depth=float('inf')):
        if not visited: visited = {}
        for key in keys:
            if not key in visited: visited[key] = None
            if func(key):
                visited[key] = depth
                return visited
        if depth < max_depth:
            keys = set([k for key in keys for k in self.edges[key]])
            visited.update(self.shallowsearch(keys, func, depth+1, visited))
        return visited
            
    """
        INFO - 
        dijsktra modified from:
        https://gist.github.com/econchick/4666413
    """
    def dijsktra(self, initial, goal_position=None, start_idx=0):

        visited = {initial: 0}
        path = {}
        nodes = set(self.nodes)
        
        while nodes:
            min_node = None
            for node in nodes:
                if node in visited:
                    if min_node is None:
                        min_node = node
                    elif visited[node] < visited[min_node]:
                        min_node = node
            if min_node is None:
                break
            nodes.remove(min_node)
            current_weight = visited[min_node]

            gen = self.get_step(min_node, initial, path)

            for edge in self.edges[min_node]:
                distance = self.get_distance((min_node, edge), gen+start_idx)
                weight = current_weight + distance
                if edge not in visited or weight < visited[edge]:
                    
                    visited[edge] = weight
                    path[edge] = min_node
                    
                if goal_position != None and edge == goal_position: return visited, path
                        
        return visited, path

    def shortest_path(self, initial_node, goal_position_node, start_idx=0, paths=None):
        
        if paths == None:
            distances, paths = self.dijsktra(initial_node, goal_position_node, start_idx)
            
        route = [goal_position_node]
        while goal_position_node != initial_node:
            route.append(paths[goal_position_node])
            goal_position_node = paths[goal_position_node]
        route.reverse()
        return route

class Map(Graph):
    
    def __init__(self, floor):
        super(Map, self).__init__()
        self._floor = floor
        self._barrier_map = defaultdict(float)
        self._density_map = defaultdict(lambda : defaultdict(int))
        self._occupancy_map = defaultdict(lambda : defaultdict(int))
        
    @property
    def barrier_map(self):
        return self._barrier_map
    
    def set_barrier(self, key, val):
        self.barrier_map[key] += val
   
    def get_barrier_map(self):
        return [self.barrier_map[k] for k in self.barrier_map.keys()]
        
    @property
    def density_map(self):
        return self._density_map
    
    def get_density(self, key, gen):
        return self.density_map[gen][key]
    
    def get_density_map_at(self, gen):
        return [self.get_density(k, gen) for k in range(len(self.floor.grid))]
    
    def add_density(self, key, gen):
        self.density_map[gen][key] += 1
        
    @property
    def occupancy_map(self):
        return self._occupancy_map
    
    def get_occupancy(self, key, gen):
        return self.occupancy_map[gen][key]
    
    def get_occupancy_map_at(self, gen):
        return [self.get_occupancy(k, gen) for k in range(len(self.floor.grid))]
    
    def add_occupancy(self, key, gen):
        self.occupancy_map[gen][key] += 1
        
    @property
    def floor(self):
        return self._floor
    
    def filter(self, key):
        return self.barrier_map[key]
    
    def get_step(self, initial, goal_position, route):
        path = [initial]
        while initial != goal_position:
            path.append(route[initial])
            initial = route[initial]
        curr_gen = len(path)
        return curr_gen
    
    def get_distance(self, key, gen):
        dist = self.distances[key]
        denom = 2 * (self.floor.grid_size)**2
        density  = self.get_density(key[1], gen) / denom
        overlays = self.filter(key[1])
        return dist + overlays + density

class Bounds2d():
    
    def __init__(self, **kwargs):
                
        if 'geo' in kwargs:
            self.geo_pts = rs.CurvePoints(kwargs['geo'])

            self._bds = [self.bds_x(self.geo_pts), self.bds_y(self.geo_pts)]
            self._origin = rc.Geometry.Point3d(self.bds[0][0], self.bds[1][0], 0)
            
            self._dim_x = self._bds[0][1] - self._bds[0][0]
            self._dim_y = self._bds[1][1] - self._bds[1][0]
            
        elif 'pts' and 'dim_x' and 'dim_y' in kwargs:
            self.geo_pts = kwargs['pts']
            
            self._bds = [self.bds_x(self.geo_pts), self.bds_y(self.geo_pts)]
            self._origin = rc.Geometry.Point3d(self.bds[0][0], self.bds[1][0], 0)
            
            self.dim_x = kwargs['dim_x']
            self.dim_y = kwargs['dim_y']
            
    @property
    def pts(self):
        return [ rc.Geometry.Point3d(self.bds[0][0], self.bds[1][0], 0),
            rc.Geometry.Point3d(self.bds[0][1], self.bds[1][0], 0),
            rc.Geometry.Point3d(self.bds[0][1], self.bds[1][1], 0),
            rc.Geometry.Point3d(self.bds[0][0], self.bds[1][1], 0)]
    
    @property
    def bds(self):
        return self._bds
    
    @property
    def origin(self):
        return self._origin
    
    def set_origin(self, pt):
        self._origin = pt
    
    @property
    def plane(self):
        return rc.Geometry.Plane(self.origin, rc.Geometry.Vector3d(0,0,1))
    
    @property
    def x(self):
        return self.bds[0][0]
    
    @property
    def y(self):
        return self.bds[1][0]
    
    def bds_x(self, pts):
        pts.sort(key = lambda pt: pt.X)
        return (pts[0].X, pts[-1].X)
    
    def bds_y(self, pts):
        pts.sort(key = lambda pt: pt.Y)
        return (pts[0].Y, pts[-1].Y)
   
    @property
    def dim_x(self):
        return self._dim_x
    
    @property
    def dim_y(self):
        return self._dim_y
    
    @property
    def centroid(self):
        x_average = self.x + self.dim_x/2
        y_average = self.y + self.dim_y/2
        return rc.Geometry.Point3d(x_average, y_average, 0)
    
    def to_rect(self):
        return rc.Geometry.Rectangle3d(self.plane, self.dim_x, self.dim_y)
    
    def to_grid(self, grid_size):
        
        def mesh_from_rect(rect, grid_size):
            mesh_params = rc.Geometry.MeshingParameters.Default
            mesh_params.MaximumEdgeLength = grid_size
            mesh_params.MinimumEdgeLength = grid_size
            mesh_params.GridAspectRatio = 1

            rect = rc.Geometry.Rectangle3d.ToNurbsCurve(rect)
            return rc.Geometry.Mesh.CreateFromPlanarBoundary(rect, mesh_params)
        
        return mesh_from_rect(self.to_rect(), grid_size)
    
    def contains_pt(self, pt):
        pt = rs.coerce3dpoint(pt)
        if pt.X < self.x or pt.X > (self.x + self.dim_x) or pt.Y < self.y or pt.Y > (self.y + self.dim_y):
            return False
        return True
    
    def intersects(self, other):
        """
            TODO - push this into the Interval Class
        """
        if (((self.origin.X < other.origin.X and self.origin.X + self.dim_x > other.origin.X + other.dim_x) or 
            (other.origin.X < self.origin.X and other.origin.X + other.dim_x > self.origin.X + self.dim_x) or
            (self.origin.X < other.origin.X and self.origin.X + self.dim_x > other.origin.X) or
            (other.origin.X < self.origin.X and other.origin.X + other.dim_x > self.origin.X)) and 
            ((self.origin.Y < other.origin.Y and self.origin.Y + self.dim_y > other.origin.Y + other.dim_y) or 
            (other.origin.Y < self.origin.Y and other.origin.Y + other.dim_y > self.origin.Y + self.dim_y) or
            (self.origin.Y < other.origin.Y and self.origin.Y + self.dim_y > other.origin.Y) or
            (other.origin.Y < self.origin.Y and other.origin.Y + other.dim_y > self.origin.Y))):
                return True
        return False
        
    @classmethod
    def from_center_pt(cls, pt, dim_x, dim_y):
        pt = rs.coerce3dpoint(pt)
        geo_pts = [rc.Geometry.Point3d(pt.X+dim_x/2, pt.Y+dim_y/2, pt.Z),
            rc.Geometry.Point3d(pt.X+dim_x/2, pt.Y-dim_y/2, pt.Z),
            rc.Geometry.Point3d(pt.X-dim_x/2, pt.Y-dim_y/2, pt.Z),
            rc.Geometry.Point3d(pt.X-dim_x/2, pt.Y+dim_y/2, pt.Z)]
        
        return cls(pts=geo_pts, dim_x=dim_x, dim_y=dim_y)

class Interval():
    
    def __init__(self, a,b):
        self._a = a
        self._b = b
        
    def __repr__(self):
        return str((self.a, self.b))
    
    @property
    def a(self):
        return self._a
    
    @property
    def b(self):
        return self._b
    
    @property
    def min(self):
        return min([self.a, self.b])
    
    @property
    def max(self):
        return max([self.a, self.b])
    
    @property
    def irange(self):
        return m.fabs(self._a - self._b)
    
    def includes(self, other):
        pass
    
    def intersects(self, other):
        pass
        
    @staticmethod
    def remap(source_ival, target_ival, num, bounded=False):
        if source_ival.irange == 0: return target_ival.min
        else:
            ret = (((num - source_ival.min) * target_ival.irange) / source_ival.irange) + target_ival.min
            if bounded:
                if ret > target_ival.max : return target_ival.max
                elif ret < target_ival.min: return target_ival.min
            return ret

class Entity(object):
    
    def __init__(self, attr):
        self._pos = dict()
        self._attr = attr
        self._type = 'entity'
    
    def __repr__(self):
        return "Environment Entity: {0} : {1} ".format(self.type, self.name)

    @property
    def name(self):
        return self.get_attribute('name')

    @property
    def position(self):
        return self._pos[0]
    
    def set_position(self, pos, gen=0):
        self._pos[gen] = pos
    
    def get_position(self, gen=0):
        try:
            return self._pos[gen]
        except:
            return None
    
    @property
    def type(self):
        return self._type
    
    def set_type(self, type):
        self._type = type
    
    @property
    def attributes(self): return self._attr
    
    def set_attribute(self, key, value):
        self._attr[key] = value
    
    def get_attribute(self, key):
        
        def _finditem(obj, key):
            if key in obj: return obj[key]
            for k, v in obj.items():
                if isinstance(v,dict):
                    item = _finditem(v, key)
                    if item is not None:
                        return item
                        
        return _finditem(self.attributes, key)
    
    def has_attribute_value(self, val):
        
        def _findvalue(obj, val):
            if val in obj.values(): return True
            for k,v in obj.items():
                if isinstance(v,dict):
                    value = _findvalue(v, val)
                    if value is not None:
                        return True
            return False
        
        return _findvalue(self.attributes, val)

class Node(Entity):
    
    def __init__(self, pos, attr={}):
        super(Node, self).__init__(attr)
        self.set_position(pos)
        self.set_type('node')

class Template(Entity):
    
    def __init__(self, attr={}):
        super(Template, self).__init__(attr)
        self.set_type('template')
    
    @property
    def edges(self):
        return self.get_attribute('edges')

class Floor(Entity):
    
    def __init__(self, geo, attr={}):
        super(Floor, self).__init__(attr)
        self._geo = rs.coercecurve(geo)
        self._bds = Bounds2d(geo=geo)
        self._map = None
        self._msh = None
        self._grid = None
        self._grid_size = None
        self._coords = {}
        
        self.set_position(self.bounds.origin)
        self.set_type('floor')
        
    @property
    def geo(self):
        return self._geo
    
    @property
    def bounds(self):
        return self._bds
    
    @property
    def mesh(self):
        return self._msh
        
    @property
    def map(self):
        return self._map
    
    @property
    def grid(self):
        return self._grid
        
    def set_grid(self, grid_size):
        
        indexes = []
        denom = m.sqrt(2*(grid_size**2))
        t_mesh = rs.coercemesh(rs.AddPlanarMesh(self.geo))
        self._msh = self.bounds.to_grid(grid_size)
        self._map = Map(self)
        self._grid_size = grid_size
        
        for i, cpt in enumerate(rs.MeshFaceCenters(self.mesh)):
            line = rc.Geometry.Line(cpt, rc.Geometry.Vector3d(0,0,1))
            if not rc.Geometry.Intersect.Intersection.MeshLine(t_mesh, line)[1]:
                indexes.append(i)

        self.mesh.Faces.DeleteFaces(indexes)
        self._grid = rs.MeshFaceCenters(self.mesh)
        
        for i, pt in enumerate(self.grid):
            self.set_coord(self.to_grid_coord(pt), i)
        
        for i, vertex in enumerate(self.mesh.Vertices):

            edges = self.mesh.TopologyVertices.ConnectedFaces(i)
            for e1 in edges:
                for e2 in edges:
                    if not e1 == e2:
                        weight = rs.Distance(self._grid[e1], self._grid[e2])/denom
                        self.map.add_edge(e1,e2, weight)
                        
    @property
    def grid_size(self):
        return self._grid_size
    
    @property
    def coords(self):
        return self._coords
    
    def set_coord(self, key, val):
        self._coords[key] = val
    
    def get_neighbors_at_coord(self, key):
        return [(key[0]+i, key[1]+j) for i in range(-1,2) for j in range(-1, 2)]
    
    def get_index_at_coord(self, key, pt):
        
        def _search(key):
            """
                TODO - make this a full search
            """
            _neighbors = self.get_neighbors_at_coord(key)
            _vals = [(n, self.to_grid_point(n)) for n in _neighbors if n in self._coords]
            _vals.sort(key = lambda tup: rs.Distance(pt, tup[1]))
            if _vals: return _vals[0][0]
            
        if key in self._coords:
            return self._coords[key]
        else:
            return self._coords[_search(key)]
    
    def to_grid_coord(self, pt):
        
        grid_x = self.bounds.dim_x / m.floor(self.bounds.dim_x / self.grid_size)
        grid_y = self.bounds.dim_y / m.floor(self.bounds.dim_y / self.grid_size)
        
        cs_x = m.floor(self.bounds.dim_x / grid_x)
        cs_y = m.floor(self.bounds.dim_y / grid_y)

        pt_x = m.floor((pt.X - self.position.X)/ grid_x)
        pt_y = m.floor((pt.Y - self.position.Y)/ grid_y)
        
        return (pt_x, pt_y)
    
    def to_grid_index(self, pt):
        
        coord = self.to_grid_coord(pt)
        return self.get_index_at_coord(coord, pt)
    
    def to_grid_bounds(self, pt):
        return Bounds2d.from_center_pt(pt, self.grid_size, self.grid_size)
    
    def to_grid_point(self, key):
        return self.grid[self.coords[key]]
    
    def contains_pt(self, pt):
        if self.bounds.contains_pt(pt):
            if rs.PointInPlanarClosedCurve(pt, self.geo): return True
        return False
    
    def add_edge_map(self):
        
        def _func(key):
            edges = [self.map.barrier_map[k] for k in self.map.edges[key]]
            if len(edges) != 8 or float('inf') in edges:
                return True
            return False
        
        def _search(i):
            if not self.map.barrier_map[i] == float('inf'):
                _vals = [v for v in self.map.shallowsearch([i], _func).values() if not v==None]
                _vals.sort()
                if _vals:
                    _weight = 1 / (self.grid_size*(_vals[0]+1))**2
                    self.map.set_barrier(i, _weight)
                    
        if PARALLEL:
            ghpythonlib.parallel.run(_search, range(len(self.grid)), False)
        else:
            for i, pt in enumerate(self.grid):
                _search(i)
        
    def add_barrier_map(self, barrier):
        
        for i, pt in enumerate(self.grid):
            if barrier.bounds.contains_pt(pt):
                if rs.PointInPlanarClosedCurve(pt, barrier.geo):
                    self.map.set_barrier(i, float('inf'))
            
            else:
                bds = self.to_grid_bounds(pt)
                if barrier.bounds.intersects(bds):
                    for pt in bds.geo_pts:
                        """
                            TODO - this can probably be done more effectively without rhinoscript
                        """
                        if rs.PointInPlanarClosedCurve(pt, barrier.geo):
                            self.map.set_barrier(i, float('inf'))
                            break
            
class Barrier(Entity):
    
    def __init__(self, geo, attr={}):
        super(Barrier, self).__init__(attr)
        self._geo = rs.coercecurve(geo)
        self._bds = Bounds2d(geo=geo)
        
        self.set_position(self.bounds.origin)
        self.set_type('barrier')
        
    @property
    def geo(self):
        return self._geo
    
    @property
    def bounds(self):
        return self._bds
    
    @property
    def floor(self):
        return self.get_attribute('floor')
        
class Agent(Entity):
    
    def __init__(self, pos=None, attr={}, env=None):
        super(Agent, self).__init__(attr)
        self._attr = attr
        self._env = env
        
        self._history = []
        self._path = []
        
        self.set_position(pos)
        self.set_type('agent')
        
        self._speed = float(self.get_attribute('speed')['default'])
        self._velocity = int(m.floor(self.environment.resolution / self.speed)) if env else None
        self._min_velocity = None
        self._max_velocity = None
        self._state = None
        
        self.age = 0
        self.is_active = True
        self.is_complete = False
        
        self.goal_position = None
        self.next_position = None
                
    @property
    def position(self):
        return self.get_position(self.age)
        
    @property
    def speed(self):
        return self._speed
    
    @property
    def velocity(self):
        return self._velocity
        
    def shift(self, num=1):
        
        for r in range(num):
            
            self._path[-1].insert(self._path[-1].index(self.position), self.position)
            self.history.append(self.position)
            self.state.append(self.next_position)
            self.environment.floors[0].map.add_occupancy(self.position, self.age)
    
            keys = [k for k in sorted(self._pos.keys()) if k >= self.age][::-1]
            for ki in range(len(keys)):
                try: self.environment.floors[0].map.density_map[keys[ki]+1][self._pos[keys[ki]+1]] -= 1
                except: pass
                self.environment.floors[0].map.density_map[keys[ki]+1][self._pos[keys[ki]]] += 1
                self._pos[keys[ki]+1] = self._pos[keys[ki]]
    
    @property
    def grid_index(self):
        return self.environment.floors[0].to_grid_index(self.position.position)
    
    @property
    def state(self):
        return self._state
    
    def set_state(self, state):
        self._state = state
    
    @property
    def destination(self):
        val = self.get_attribute('destination')
        return random.choice(self.environment.get_nodes_with_value(val))
    
    @property
    def path(self):
        _path = sum([p for p in self._path], [])
        _dict = {idx: self.environment.floors[0].grid[idx] for idx in set(_path)}
        return [_dict[p] for p in _path]
    
    def add_path(self, path):
        self._path.append(copy.deepcopy(path))    
    
    @property
    def history(self):
        return self._history
    
    @property
    def visited(self):
        return [n.name for n in self.history if not type(n) == int]
    
    @property
    def environment(self):
        return self._env
    
    def set_environment(self, env):
        self._env = env
        self._velocity = int(m.floor(self.environment.resolution / self.speed))
        
    def toggle_active(self):
        self.is_active = not self.is_active
        
    def toggle_complete(self):
        self.is_complete = not self.is_complete
    
    def step(self):        
        
        def wait(time):
            return self.goal_position, [self.goal_position] * time
            
        def move(lst):
            
            lst = [l for l in lst if not l.get_attribute('name') in self.visited]
            
            if len(lst):
            
                properties = self.get_attribute('properties')
                keys = properties.keys()
                n_percs = [k for k in keys if random.randint(0,100) <= float(properties[k])]
                
                lst = [(l, self.environment.graph.get_distance((self.position, l))) for l in lst if l.get_attribute('name') in n_percs]
            
                if len(lst):
                    
                    lst.sort(key = lambda tup: len(tup[1]), reverse = True)
                    
                    while len(lst):
                        
                        tup = lst.pop()
                        n_choice = tup[0]
                        n_path = tup[1] # TEMP
                        num_people = len([a for a in self.environment.agents if self.goal_position == a.goal_position and a != self])
                        capacity = n_choice.get_attribute('capacity')

                        if capacity != None:
                            if num_people < float(capacity):
                                break
                            else:
                                if random.randint(0,100) < float(self.get_attribute('queuing')):
                                    break
                                else: 
                                    continue
                        else:
                            break
                else:
                    n_choice = self.destination
                    n_path = self.environment.graph.get_distance((self.position, n_choice))
            else:
                n_choice = self.destination
                try: n_path = self.environment.graph.get_distance((self.position, n_choice))
                except: n_path = self.environment.graph.get_distance((n_choice, self.position))[::-1]
                self.toggle_complete()
            
            """
                TODO - replace with entity.to_grid_index(environment)
                    nodes need floor property !! important
            """ 
            """
            n_index = self.environment.floors[0].to_grid_index(n_choice.position)
            n_path = self.environment.floors[0].map.shortest_path(self.grid_index, n_index, start_idx=self.age+1)
            """
            return n_choice, n_path

        if self.state == None:

            start_node = self.get_attribute('origin')
            start_positions = self.environment.get_nodes_with_value(start_node)
            start_position = random.choice(start_positions)
            
            self._min_velocity = int(m.floor(self.environment.resolution / float(self.get_attribute('speed')['min'])))
            self._max_velocity = int(m.floor(self.environment.resolution / float(self.get_attribute('speed')['max'])))
            
            self.goal_position = start_position
            self.set_state('waiting')
            
        else:

            if self.is_active:
                
                if self.state == 'ready':
                    
                    self.goal_position, path = move(self.environment.graph.edges[self.position])
                    self.add_path(path)
                    path = [self.position] + path + [self.goal_position]
                    
                    for pi in range(len(path)):
                        self.environment.floors[0].map.add_density(path[pi], self.age+pi)
                        self.set_position(path[pi], self.age+pi)
                    
                    path.reverse()
                    self.set_state(path[:-1])
                    
               
                elif self.state == 'waiting':
                    
                    wait_time = 1 if len(self._path) != 0 else random.randint(1,10)
                    
                    self.goal_position, path = wait(wait_time)
                    self.add_path([self.environment.floors[0].to_grid_index(self.goal_position.position)] * (wait_time))                    
                    path = [self.goal_position] + path + [self.goal_position]
                    
                    for pi in range(len(path)):
                        self.environment.floors[0].map.add_density(path[pi], self.age+pi)
                        self.set_position(path[pi], self.age+pi)
                    
                    path.reverse()
                    self.set_state(path[:-1])
                      
                else:

                    if len(self.state):
                         
                        self.next_position = self.state.pop()
                        
                        """
                        curr_people_pos = len(self.environment.agents_at_position(self.position, self.age))
                        next_people_pos = len(self.environment.agents_at_position(self.position, self.age+1))
                        
                        curr_people_npos = len(self.environment.agents_at_position(self.next_position, self.age))
                        next_people_npos = len(self.environment.agents_at_position(self.next_position, self.age+1))
                                                                       
                        
                        if type(self.position) != Node:
                            
                            if type(self.next_position) != Node:
                                
                                source_ival = Interval(1,  2 * self.environment.resolution**2)
                                target_ival = Interval(self._max_velocity, self._min_velocity)
                                val = int(round(Interval.remap(source_ival, target_ival, curr_people_pos, bounded=True)))
                                max_density = 2 * self.environment.resolution**2
                                
                                if next_people_pos > max_density and next_people_npos > max_density:
                                    max_density *= 2
                                
                                if curr_people_npos >= max_density or next_people_npos >= max_density:
                                    if not next_people_pos >= max_density:
                                        self.shift()
                                        
                            elif type(self.next_position) == Node:
                                                              
                                capacity = self.next_position.get_attribute('capacity')
                                max_density = int(capacity) if capacity != None else float('inf')
                                
                                if curr_people_npos >= max_density or next_people_npos >= max_density:
                                    self.shift()
                        """
                        
                        self.history.append(self.position)
                        self.age+=1
                        
                    else:
                        
                        if type(self.get_position(self.age-1)) != Node:
                            self.set_state('waiting')
                         
                        elif type(self.get_position(self.age-1)) == Node:
                            self.set_state('ready')
                                
                        if self.is_complete:
                            self.set_state('complete')
                            self.toggle_active()

class Environment():
    
    def __init__(self, resolution=30):
        self._entities = defaultdict(list)
        self._agents = []
        self._graph = Graph()
        self._graph_paths = {}
        self._resolution = resolution
    
    def __repr__(self):
        return 'Environment: {0} agents, {1} nodes, {2} floors'.format(len(self.agents), len(self.graph.nodes), len(self.floors))
    
    @property
    def resolution(self):
        return self._resolution
    
    @property
    def entities(self):
        return self._entities
     
    def add_entity(self, entity):
        self.entities[entity.type].append(entity)
    
    def add_entities(self, entities):
        
        def _add_floor(entity):
            entity = Floor(entity['geometry'], entity['profile'])
            self.add_floor(entity)
            self.add_entity(entity)
        
        def _add_node(entity):
            entity = Node(entity['position'], entity['profile'])
            _msg = self.add_node(entity)
            if _msg:
                return _msg
            else:
                self.add_entity(entity)
            
        def _add_template(entity):
            entity = Template(entity['profile'])
            self.add_template(entity)
            self.add_entity(entity)
        
        def _add_barrier(entity):
            entity = Barrier(entity['geometry'], entity['profile'])
            self.add_barrier(entity)
            self.add_entity(entity)
        
        def _add_agent(entity):
            entity = Agent(attr=entity['profile'])
            self.add_agent(entity)
            self.add_entity(entity)
        
        dict = defaultdict(list)
        for entity in entities:
            dict[entity['type']].append(entity)
        
        if len(dict['floor']):
            for  floor in dict['floor']:
                _add_floor(floor)
        else:
            e = gh.GH_RuntimeMessageLevel.Error
            ghenv.Component.AddRuntimeMessage(e, 'component needs at least one floor')
            return
        
        if len(dict['barrier']):
            for barrier in dict['barrier']:
                _add_barrier(barrier)
        
        for floor in self.entities['floor']:
            #pass
            floor.add_edge_map()
            
        if len(dict['node']) > 1:

            if PARALLEL: 
                _err = ghpythonlib.parallel.run(_add_node, dict['node'], False)
            else:
                _err = [_add_node(node) for node in dict['node']]
                
            if any( _err):
                for _msg in _err:
                    e = e = gh.GH_RuntimeMessageLevel.Error
                    ghenv.Component.AddRuntimeMessage(e, _msg)
                return

        else:
            e = gh.GH_RuntimeMessageLevel.Error
            ghenv.Component.AddRuntimeMessage(e, 'component needs at least two nodes')
            return
              
        if len(dict['template']):
            for template in dict['template']:
                _add_template(template)
        else: self.add_default_template()
            
        if len(dict['agent']):
            for agent in dict['agent']:
                _add_agent(agent)
        else:
            w = gh.GH_RuntimeMessageLevel.Warning
            ghenv.Component.AddRuntimeMessage(w, 'no agents in environment')
            
    @property
    def graph(self):
        return self._graph
    
    @property
    def graph_paths(self):
        return self._graph_paths
    
    def get_graph_path(self, n1, n2):
        """
            TODO - if n1 and n2 are on different floors -> handle graph links
                - nodes need a floor attribute
        """
        floor = self.floors[0]
        idx1 = floor.to_grid_index(n1.position)
        idx2 = floor.to_grid_index(n2.position)
        return floor.map.shortest_path(idx1, idx2, paths=self.graph_paths[n1])
    
    def set_graph_path(self, key, val):
        self._graph_paths[key] = val
    
    @property
    def templates(self):
        return [n for n in self.entities['template']]
    
    def add_template(self, template):
        for edge in template.edges:
            nodes = [n for n in self.nodes if n.position in edge]
            if len(nodes) == 2:
                try:
                    path = self.get_graph_path(nodes[0], nodes[1])
                except:
                    path = self.get_graph_path(nodes[1], nodes[0])
                    
                self.graph.add_edge(nodes[0], nodes[1], path,
                    directed=template.get_attribute('directed'))
    
    def add_default_template(self):
        for n1 in self.graph.nodes:
            for n2 in self.graph.nodes:
                if not n1 == n2: 
                    path = self.get_graph_path(n1, n2)
                    self.graph.add_edge(n1, n2, path)
                    
    @property
    def agents(self):
        return self._agents
        
    def add_agent(self, agent, other=None):
        agent.set_environment(self)
        self.agents.append(agent)
    
    def agents_at_position(self, position, gen=0):
        return [a for a in self.agents if a.get_position(gen) == position]
        
    @property
    def nodes(self):
        return [n for n in self.entities['node']]
    
    def add_node(self, node):
        self.graph.add_node(node)
        """
            TODO - nodes need a floor attribute
        """
        if self.floors[0].contains_pt(node.position):
            djk = self.floors[0].map.dijsktra(self.floors[0].to_grid_index(node.position))
            self.set_graph_path(node, djk[1])
        else:
            return node.name +' was flagged as not on a floor'

    def get_nodes_with_value(self, val):
        return [n for n in self.nodes if n.has_attribute_value(val)]
        
    @property
    def floors(self):
        return [n for n in self.entities['floor']]
    
    def add_floor(self, floor):
        floor.set_grid(self.resolution)
    
    def set_grid(self, grid_size):
        """
            TODO - implement more complexity
            grids will need to match up between floors
               - maybe 1 unified dictionary to hold graphs?
        """
        for floor in self.floors: floor.set_grid(grid_size)
        
    @property
    def barriers(self):
        return [n for n in self.entities['barriers']]
    
    def add_barrier(self, barrier):
        for floor in self.floors:
            if barrier.floor == floor.name:
                floor.add_barrier_map(barrier)
                
    @property
    def paths(self):
        return [a.path for a in self.agents]
        
    def generation(self, gen):
        return [a.get_position(gen) for a in self.agents]

    def step(self):
        
        def _func(agent):
            if agent.is_active:
                agent.step()
                   
        if PARALLEL:
            ghpythonlib.parallel.run(_func, self.agents, False)
        else:
            for i, agent in enumerate(self.agents):
                _func(agent)
        
    def run(self):
        count = 0
        while len([a for a in self.agents if a.is_active]) and count < 1000:
            self.step()
            count+=1
            
        if count == 1000: print ">>>>>>>>>>>>>>>>>>>>>>>>> broke outer while loop"
        
PARALLEL = False

if len(entities) != 0 and res != None:
    environment = Environment(resolution=res)
    environment.add_entities([e for e in entities if e != None])
    
    a = environment
# ---------- end env ----------
select_from_list = SelectFromList(flux_projects, SelectedItem="aVZJo6oBeDLGRjkW2")  # disabled
dam = DataDam(DataA=env.a, BufferDelay=2500000, BufferMode=0)  # disabled
toggle_2 = BooleanToggle(True)  # disabled

geo = Geometry(flatten([pt_7, pt_5]))  # disabled
geo_2 = Geometry(graft([pt_7, pt_5]))  # disabled
ln_6 = Line(StartPoint=graft(pt_8), EndPoint=pt_6)  # disabled
ln_7 = Line(StartPoint=geo, EndPoint=geo_2)  # disabled
ln_8 = Line(StartPoint=geo_2, EndPoint=pt_6)  # disabled
template_2 = PythonScript(lines=flatten([ln_6, ln_8, ln_7]))  # -> out, a; inputs lines: list of Curve; disabled
# ---------- template_2: Python ----------
import rhinoscriptsyntax as rs
import Rhino as rc


if len(lines):
    
    entities = []
    for line in lines:
        entities.append([rs.CurveEndPoint(line), rs.CurveStartPoint(line)])
    entity = {
        'type': 'template',
        'profile': {
            'edges': entities,
            'directed': False
        }
    }
    a = [entity]
# ---------- end template_2 ----------

run = PythonScript(env=dam, run=toggle_2)  # -> out, paths, activity_map, occupancy_map, density_map, barrier_map, mesh; disabled
# ---------- run: Python ----------
import clr
clr.AddReference("Grasshopper")
from Grasshopper import DataTree
from Grasshopper.Kernel.Data import GH_Path
from itertools import chain
import copy

path_tree = DataTree[object]()
density_tree = DataTree[object]()

mesh = env.floors[0].mesh

if env != None:

    barrier_map = env.floors[0].map.get_barrier_map()

    if run:
    
        env = copy.deepcopy(env)
        env.run()
        
        for i, path in enumerate(env.paths):
            gh_path = GH_Path(i)
            for p in path: path_tree.Add(p, gh_path)
        
        activity = [0] * len(env.floors[0].grid)
        occupancy = [0] * len(env.floors[0].grid)
    
        for gen in env.floors[0].map.density_map.keys():
            
            gh_path = GH_Path(gen)
            
            d_map = env.floors[0].map.get_density_map_at(gen)
            for i, m in enumerate(d_map):
                activity[i] += m
                density_tree.Add(m, gh_path)
                
            o_map = env.floors[0].map.get_occupancy_map_at(gen)
            for j, n in enumerate(o_map):
                occupancy[j] += n
                
        
        activity_map = activity
        occupancy_map = occupancy
        density_map = density_tree
        paths = path_tree
# ---------- end run ----------
number_slider_7 = Slider(10, range=0..100)  # disabled
data_keys = DataKeys(select_from_list)  # disabled

select_from_list_2 = SelectFromList(flux_projects, SelectedItem="aZqAjjXYqpywx2pAQ")  # disabled
data_keys_2 = DataKeys(select_from_list_2)  # disabled
select_from_list_3 = SelectFromList(data_keys_2, SelectedItem="409cad866ad63b95ba118fd0ac2427ff")  # disabled
select_from_list_4 = SelectFromList(data_keys_2, SelectedItem="408e6079a65a917363efab70b6a24c58")  # disabled
flow_control = FlowControl({"Once", "Constantly"}, selected="Once")  # disabled
from_flux = FromFlux(
    Key=select_from_list_3,
    Mode=flow_control,
    keyId="409cad866ad63b95ba118fd0ac2427ff",
    mode="Once",
    Branch0_Path="{0;0}",
    Branch0_Item0_EdgeIndex=-1,
    Branch0_Item0_TypeName="Grasshopper.Kernel.Types.GH_Curve",
    Branch0_Item1_EdgeIndex=-1,
    Branch0_Item1_TypeName="Grasshopper.Kernel.Types.GH_Curve")  # disabled
from_flux_2 = FromFlux(
    Key=select_from_list_4,
    Mode=flow_control,
    keyId="408e6079a65a917363efab70b6a24c58",
    mode="Once",
    Branch0_Path="{0;0}",
    Branch0_Item0_TypeName="Grasshopper.Kernel.Types.GH_Mesh",
    Branch0_Item1_TypeName="Grasshopper.Kernel.Types.GH_Mesh",
    Branch0_Item2_TypeName="Grasshopper.Kernel.Types.GH_Mesh",
    Branch0_Item3_TypeName="Grasshopper.Kernel.Types.GH_Mesh",
    Branch0_Item4_TypeName="Grasshopper.Kernel.Types.GH_Mesh",
    Branch0_Item5_TypeName="Grasshopper.Kernel.Types.GH_Mesh",
    Branch0_Item6_TypeName="Grasshopper.Kernel.Types.GH_Mesh",
    Branch0_Item7_TypeName="Grasshopper.Kernel.Types.GH_Mesh",
    Branch0_Item8_TypeName="Grasshopper.Kernel.Types.GH_Mesh",
    Branch0_Item9_TypeName="Grasshopper.Kernel.Types.GH_Mesh",
    Branch0_Item10_TypeName="Grasshopper.Kernel.Types.GH_Mesh",
    Branch0_Item11_TypeName="Grasshopper.Kernel.Types.GH_Mesh",
    Branch0_Item12_TypeName="Grasshopper.Kernel.Types.GH_Mesh",
    Branch0_Item13_TypeName="Grasshopper.Kernel.Types.GH_Mesh",
    Branch0_Item14_TypeName="Grasshopper.Kernel.Types.GH_Mesh",
    Branch0_Item15_TypeName="Grasshopper.Kernel.Types.GH_Mesh",
    Branch0_Item16_TypeName="Grasshopper.Kernel.Types.GH_Mesh",
    Branch0_Item17_TypeName="Grasshopper.Kernel.Types.GH_Mesh",
    Branch0_Item18_TypeName="Grasshopper.Kernel.Types.GH_Mesh",
    Branch0_Item19_TypeName="Grasshopper.Kernel.Types.GH_Mesh",
    Branch0_Item20_TypeName="Grasshopper.Kernel.Types.GH_Mesh",
    Branch0_Item21_TypeName="Grasshopper.Kernel.Types.GH_Mesh",
    Branch0_Item22_TypeName="Grasshopper.Kernel.Types.GH_Mesh",
    Branch0_Item23_TypeName="Grasshopper.Kernel.Types.GH_Mesh",
    Branch0_Item24_TypeName="Grasshopper.Kernel.Types.GH_Mesh",
    Branch0_Item25_TypeName="Grasshopper.Kernel.Types.GH_Mesh",
    Branch0_Item26_TypeName="Grasshopper.Kernel.Types.GH_Mesh"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)  # disabled

profile_9 = PythonScript()  # -> out, a; disabled
# ---------- profile_9: Python ----------
passenger_profile_departing = {
    'name':'passenger',
    'status': {
        'def':'departing',
        'origin':'curbside',
        'destination': 'gate'
    },
    'properties': {
        'curbside': 100,
        'bathroom':100,
        'security': 100,
        'gate': 100
    },
    'influence':{
        'queuing':0,
        'remainder':120
    }
    
}

a = [passenger_profile_departing]
# ---------- end profile_9 ----------
explode_2 = MeshExplode(Mesh=run.mesh, Interpolate=False)  # disabled
button = Button()  # disabled
dup_3 = DuplicateData(Data=profile_9.a, Number=number_slider_7, Order=True)  # disabled
number_slider_8 = Slider(24, range=0..100)  # disabled
pline = PolyLine(Vertices=run.paths, Closed=False)  # disabled
timer = Timer(TimerInterval=20, Target=counter)  # disabled
agent_4 = PythonScript(profile=flatten(dup_3))  # -> out, a; inputs profile: list; disabled; same code as agent_2
preview = CustomPreview(
    Geometry=pline,
    Shader={ambient=RGB(0, 0, 0), diffuse=RGB(255, 105, 180), emission=RGB(76, 32, 54), shine=0.5, specular=RGB(255, 255, 255), transparency=0})  # disabled
counter = Counter(Reset=button)  # disabled
number_slider_9 = Slider(6, range=0..10)  # disabled

select_from_list_5 = SelectFromList(data_keys, SelectedItem="4049a82c26666323d9b1a2c46a81ac3d")  # disabled
select_from_list_6 = SelectFromList(data_keys, SelectedItem="409a544385f4a048b9b94d0375513dc5")  # disabled
select_from_list_7 = SelectFromList(data_keys, SelectedItem="40ccb0349fe7012ab98a941e40aa6ce3")  # disabled
flow_control_2 = FlowControl({"Once", "Constantly"}, selected="Constantly")  # disabled
start_node = Geometry(gates)  # disabled
from_flux_3 = FromFlux(
    Key=select_from_list_5,
    Mode=flow_control_2,
    keyId="4049a82c26666323d9b1a2c46a81ac3d",
    mode="Constantly",
    Branch0_Path="{0}",
    Branch0_Item0_null_string=False,
    Branch0_Item0_string="Gate 1",
    Branch0_Item0_TypeName="Grasshopper.Kernel.Types.GH_String",
    Branch0_Item1_number=10,
    Branch0_Item1_TypeName="Grasshopper.Kernel.Types.GH_Integer",
    Branch1_Path="{1}",
    Branch1_Item0_null_string=False,
    Branch1_Item0_string="Gate 2",
    Branch1_Item0_TypeName="Grasshopper.Kernel.Types.GH_String",
    Branch1_Item1_number=20,
    Branch1_Item1_TypeName="Grasshopper.Kernel.Types.GH_Integer",
    Branch2_Path="{2}",
    Branch2_Item0_null_string=False,
    Branch2_Item0_string="Gate 3",
    Branch2_Item0_TypeName="Grasshopper.Kernel.Types.GH_String",
    Branch2_Item1_number=45,
    Branch2_Item1_TypeName="Grasshopper.Kernel.Types.GH_Integer",
    Branch3_Path="{3}",
    Branch3_Item0_null_string=False,
    Branch3_Item0_string="Gate 4",
    Branch3_Item0_TypeName="Grasshopper.Kernel.Types.GH_String",
    Branch3_Item1_number=63,
    Branch3_Item1_TypeName="Grasshopper.Kernel.Types.GH_Integer",
    Branch4_Path="{4}",
    Branch4_Item0_null_string=False,
    Branch4_Item0_string="Gate 5",
    Branch4_Item0_TypeName="Grasshopper.Kernel.Types.GH_String"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)  # disabled
lng_3 = ListLength(List=start_node)  # disabled
pt_9 = Point(start_node)  # disabled
series = Series(Start=0, Step=1, Count=lng_3)  # disabled
item = ListItem(List=from_flux_3, Index=0, Wrap=True)  # -> flatten(Item); disabled
int = Integer(series)  # disabled
item_2 = ListItem(List=item, Index=int, Wrap=True)  # -> flatten(Item); disabled
flow_control_3 = FlowControl({"Once", "Constantly"}, selected="Constantly")  # disabled
flow_control_4 = FlowControl({"Once", "Constantly"}, selected="Constantly")  # disabled
swatch = ColourSwatch(SwatchColor=RGB(255, 255, 255))  # disabled
to_flux = ToFlux(Key=select_from_list_7, Value=pt_9, Mode=flow_control_3, mode="Constantly")  # disabled
tag = TextTag3D(Location=pt_9, Text=item_2, Size=number_slider_9, Colour=swatch, Justification=7)  # disabled
to_flux_2 = ToFlux(Key=select_from_list_6, Value=item_2, Mode=flow_control_4, mode="Constantly")  # disabled

# ---- group: density map
branch = TreeBranch(Tree=run.density_map, Path=counter, MaintainPaths=True)  # disabled
lng_4 = ListLength(List=explode_2)  # disabled
bnd = Bounds(Numbers=branch)  # disabled
num = Number(expr("4*x*x+1", number_slider_6))  # disabled
panel_33 = Panel("0")  # disabled
series_2 = Series(Start=0, Step=1, Count=lng_4)  # disabled
panel_34 = Panel(bnd)  # disabled
gradient = Gradient(
    LowerLimit=num,
    UpperLimit=panel_33,
    Parameter=branch,
    stops=[0: RGB(18, 140, 105), 0.0137: RGB(234, 38, 0), 0.25: RGB(234, 126, 0), 0.5: RGB(254, 244, 84), 0.75: RGB(173, 203, 249), 1: RGB(75, 107, 169)])  # disabled
popgeo = PopulateGeometry(Geometry=explode_2, Count=branch, Seed=series_2)  # disabled
preview_2 = CustomPreview(Geometry=explode_2, Shader=gradient)  # disabled
preview_3 = CustomPreview(Geometry=popgeo, Shader=graft(gradient))  # disabled

# ----
swatch_2 = ColourSwatch(SwatchColor=RGB(255, 255, 255))  # disabled

end_node = Geometry(sink_node)  # disabled
select_from_list_8 = SelectFromList(data_keys, SelectedItem="40b0b548afa0cbaee272887dd22e88f7")  # disabled
flow_control_5 = FlowControl({"Once", "Constantly"}, selected="Constantly")  # disabled
pt_10 = Point(end_node)  # disabled
panel_35 = Panel("sink_node")  # disabled
to_flux_3 = ToFlux(Key=select_from_list_8, Value=pt_10, Mode=flow_control_5, mode="Constantly")  # disabled
tag_2 = TextTag3D(Location=pt_10, Text=panel_35, Size=number_slider_9, Colour=swatch_2, Justification=9)  # disabled

gradient_2 = Gradient(LowerLimit=0, UpperLimit=1, Parameter=run.barrier_map, stops=[0: RGB(0, 0, 0), 1: RGB(255, 255, 255)])  # disabled
facen = FaceNormals(Mesh=run.mesh)  # -> Centers, Normals; disabled
lng_5 = ListLength(List=facen.Centers)  # disabled
number_slider_10 = Slider(0.38, range=0..1)  # disabled
series_3 = Series(Start=0, Step=1, Count=lng_5)  # disabled
int_2 = Integer(series_3)  # disabled
preview_4 = CustomPreview(Geometry=flatten(explode_2), Shader=gradient_2)  # disabled
tag_3 = TextTag3D(Location=facen.Centers, Text=int_2, Size=number_slider_10, Justification=7)  # disabled

# ---- group: activity map
num_2 = Number(expr("x/2", number_slider_2))  # disabled
panel_36 = Panel("0")  # disabled
gradient_3 = Gradient(
    LowerLimit=num_2,
    UpperLimit=panel_36,
    Parameter=run.activity_map,
    stops=[0: RGB(234, 38, 0), 0.25: RGB(234, 126, 0), 0.5: RGB(254, 244, 84), 0.75: RGB(173, 203, 249), 1: RGB(75, 107, 169)])  # disabled
preview_5 = CustomPreview(Geometry=explode_2, Shader=gradient_3)  # disabled

# ---- group: occupancy map
panel_37 = Panel("1000")  # disabled
panel_38 = Panel("0")  # disabled
gradient_4 = Gradient(
    LowerLimit=panel_37,
    UpperLimit=panel_38,
    Parameter=run.occupancy_map,
    stops=[0: RGB(234, 38, 0), 0.25: RGB(234, 126, 0), 0.5: RGB(254, 244, 84), 0.75: RGB(173, 203, 249), 1: RGB(75, 107, 169)])  # disabled
preview_6 = CustomPreview(Geometry=explode_2, Shader=gradient_4)  # disabled

# ----
geo_3 = Geometry(simplify(merge_2))  # disabled
crv = Curve(flatten(geo_3))  # disabled
select_from_list_9 = SelectFromList(data_keys, SelectedItem="408a2aa6e09d1d4660c0a1dec7fe85be")  # disabled
flow_control_6 = FlowControl({"Once", "Constantly"}, selected="Constantly")  # disabled
panel_39 = Panel(crv)  # disabled

select_from_list_10 = SelectFromList(data_keys, SelectedItem="40a647bc6b7726f714249ff1e6a7a6af")  # disabled
flow_control_7 = FlowControl({"Once", "Constantly"}, selected="Constantly")  # disabled
to_flux_4 = ToFlux(Key=select_from_list_10, Value=crv, Mode=flow_control_7, mode="Constantly")  # disabled

from_flux_4 = FromFlux(
    Key=select_from_list_9,
    Mode=flow_control_6,
    keyId="408a2aa6e09d1d4660c0a1dec7fe85be",
    mode="Constantly",
    Branch0_Path="{0}",
    Branch0_Item0_number=558,
    Branch0_Item0_TypeName="Grasshopper.Kernel.Types.GH_Integer",
    Branch0_Item1_number=10,
    Branch0_Item1_TypeName="Grasshopper.Kernel.Types.GH_Integer",
    Branch0_Item2_number=20,
    Branch0_Item2_TypeName="Grasshopper.Kernel.Types.GH_Integer",
    Branch0_Item3_number=45,
    Branch0_Item3_TypeName="Grasshopper.Kernel.Types.GH_Integer",
    Branch0_Item4_number=63,
    Branch0_Item4_TypeName="Grasshopper.Kernel.Types.GH_Integer",
    Branch0_Item5_number=12,
    Branch0_Item5_TypeName="Grasshopper.Kernel.Types.GH_Integer",
    Branch0_Item6_number=20,
    Branch0_Item6_TypeName="Grasshopper.Kernel.Types.GH_Integer",
    Branch0_Item7_number=100,
    Branch0_Item7_TypeName="Grasshopper.Kernel.Types.GH_Integer",
    Branch0_Item8_number=120,
    Branch0_Item8_TypeName="Grasshopper.Kernel.Types.GH_Integer",
    Branch0_Item9_number=5,
    Branch0_Item9_TypeName="Grasshopper.Kernel.Types.GH_Integer",
    Branch0_Item10_number=10,
    Branch0_Item10_TypeName="Grasshopper.Kernel.Types.GH_Integer",
    Branch0_Item11_number=15,
    Branch0_Item11_TypeName="Grasshopper.Kernel.Types.GH_Integer",
    Branch0_Item12_number=10,
    Branch0_Item12_TypeName="Grasshopper.Kernel.Types.GH_Integer",
    Branch0_Item13_number=20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)  # disabled
panel_40 = Panel(from_flux_4)  # disabled
number_slider_11 = Slider(5, range=0..10)  # disabled
number_slider_12 = Slider(0, range=0..100)  # disabled
number_slider_13 = Slider(114, range=0..1000)  # disabled
number_slider_14 = Slider(100, range=0..100)  # disabled
division = Division(A=from_flux_4, B=number_slider_13)  # disabled
mpipe = MeshPipe(Curve=crv, Radius=division, Accuracy=0.2, Rotation=0, Segments=number_slider_11, Caps=number_slider_12)  # disabled

swatch_3 = ColourSwatch(SwatchColor=RGB(255, 255, 255))  # disabled
round = Round(Number=division)  # -> Nearest, Floor, Ceiling; disabled
previewlw = CustomPreviewLineweights(Geometry=crv, Shader=swatch_3, Thickness=round.Ceiling)  # disabled

preview_7 = CustomPreview(Geometry=mpipe, Shader=swatch_3)  # disabled
