# Grasshopper definition skeleton.ghx (Grasshopper 0.9.76)
# plug-ins: Python Interpreter

panel = Panel("-1")  # disabled
panel_2 = Panel("-1")  # disabled
geo = Geometry(<curve referenced from the Rhino model>)  # disabled
geo_2 = Geometry(<curve referenced from the Rhino model>)  # disabled
geo_3 = Geometry(<curve referenced from the Rhino model>)
cp = ControlPoints(Curve=geo)  # -> Points, Weights, Knots; disabled
cp_2 = ControlPoints(Curve=geo_2)  # -> Points, Weights, Knots; disabled
cp_3 = ControlPoints(Curve=geo_3)  # -> Points, Weights, Knots
cull_i = CullIndex(List=cp.Points, Indices=panel, Wrap=True)  # disabled
cull_i_2 = CullIndex(List=cp_2.Points, Indices=panel_2, Wrap=True)  # disabled
cull_i_3 = CullIndex(List=cp_3.Points, Indices="-1", Wrap=True)
python = PythonScript(pts=cull_i)  # -> out, a, b; inputs pts: list; disabled
# ---------- python: Python ----------
import rhinoscriptsyntax as rs

class Skeleton():
    
    def __init__(self, pts):
        
        self._slav = [pts] # double connected circular list of active vertices
        self._incident_edges = {} # incident edges
        self._vertex_angle_bisectors = {} # vertex angle bisectors
        self._priority_queue = [] # bisector intersections / priority queue
        self._pointers = {} # bisector intersection origin pointers
        self._skeleton = []
    
    @property
    def lav(self):
        return self._slav[-1]
    
    @property
    def skeleton(self):
        return self._skeleton
    
    def add_vertex_angle_bisector(self, vi, i):
        l1, l2 = self.lav[1:] + [self.lav[0]], [self.lav[-1]] + self.lav[:-1]
        self._incident_edges[vi] = [(vi, l1[i]),(vi, l2[i])]
        self._vertex_angle_bisectors[vi] = rs.VectorAdd(
            rs.VectorUnitize(rs.VectorCreate(l1[i], vi)),
            rs.VectorUnitize(rs.VectorCreate(l2[i], vi)))
    
    def set_incident_edges(self):
        for i, vi in enumerate(self.lav):
            self.add_vertex_angle_bisector(vi, i)

    def add_pointer(self, v):
        vli = rs.AddLine(v, v+self._vertex_angle_bisectors[v])
        for ve in [self._incident_edges[v][0][1], self._incident_edges[v][1][1]]:
            vex = rs.LineLineIntersection(
                rs.AddLine(ve, ve+self._vertex_angle_bisectors[ve]),
                vli)
            if vex:
                self._priority_queue.append((vex[0], rs.Distance(
                    rs.LineClosestPoint(
                        rs.AddLine(self._incident_edges[v][0][0],
                            self._incident_edges[v][0][1]),
                        vex[0]),
                    vex[0])))
                self._pointers[vex[0]] = (v, ve)
    
    def set_priority_queue(self):
        for v in self.lav:
            self.add_pointer(v)
        self._priority_queue.sort(key=lambda tup: tup[1])
        
    def compute_skeleton(self):
        while self._priority_queue:
            vi = self._priority_queue.pop()[0]
            va, vb= self._pointers[vi][0], self._pointers[vi][1]
            if va == None or vb == None: continue
            if self.lav[self.lav.index(va)-2] == vb: continue
            
            self._skeleton.append(rs.AddLine(va,vi))
            self._skeleton.append(rs.AddLine(vb,vi))
            
            
            self._pointers[vi] = (None, None)
            #self._slav[-1][idx] = vi
            #self._slav[-1].remove(vb)
            """
            self._incident_edges[vi] = ((vi, self._incident_edges[va][0][1]), (vi, self._incident_edges[vb][1][1]))
            self._incident_edges[self._incident_edges[va][0][1]] = (self._incident_edges[va][0], (va, vi))
            self._incident_edges[self._incident_edges[vb][1][1]] = ((vb, vi), self._incident_edges[vb][1])
            print vi
            self.add_vertex_angle_bisectors(vi, idx)
            self.add_pointer(vi)
            """
            
    
_temp = []
skel = Skeleton(rs.coerce3dpointlist(pts))
skel.set_incident_edges()
skel.set_priority_queue()
skel.compute_skeleton()
a = skel.skeleton
b = _temp
# ---------- end python ----------
python_2 = PythonScript(pts=cull_i_2)  # -> out, a, b; inputs pts: list; disabled
# ---------- python_2: Python ----------
import rhinoscriptsyntax as rs

class Skeleton():
    
    def __init__(self, pts):
        
        self._slav = [pts] # double connected circular list of active vertices
        self._ie = {} # incident edges
        self._vab = {} # vertex angle bisectors
        self._bix = [] # bisector intersections / priority queue
        self._bo = {} # bisector origin pointers
    
    @property
    def lav(self):
        return self._slav[-1]
    
    @property
    def ie(self):
        return self._ie
    
    @property
    def vab(self):
        return self._vab
    
    @property
    def bix(self):
        return self._bix

    def set_ie_vab(self):
        l1, l2 = self.lav[1:] + [self.lav[0]], [self.lav[-1]] + self.lav[:-1]
        for i, pt in enumerate(self.lav):
            
            self._ie[pt] = [(pt, l1[i]),(pt, l2[i])]
            self._vab[pt] = rs.VectorAdd(
                rs.VectorUnitize(rs.VectorCreate(l1[i], pt)),
                rs.VectorUnitize(rs.VectorCreate(l2[i], pt)))
    
    def set_bix_priority_queue(self):
        for i, v in enumerate(self.lav):
            vli = rs.AddLine(v, v+self.vab[v])
            for ve in [self.ie[v][0][1], self.ie[v][1][1]]:
                vex = rs.LineLineIntersection(
                    rs.AddLine(ve, ve+self.vab[ve]),
                    vli)
                if vex:
                    self._bix.append((vex[0], rs.Distance(
                        rs.LineClosestPoint(
                            rs.AddLine(self.ie[v][0][0],
                                self.ie[v][0][1]),
                            vex[0]),
                        vex[0])))
                    self._bo[vex[0]] = (v, ve)
        self._bix.sort(key=lambda tup: tup[1])
        
    
    def compute_skeleton(self):
        pass
    
_temp = []
skel = Skeleton(rs.coerce3dpointlist(pts))
skel.set_ie_vab()
skel.set_bix_priority_queue()
a = [v[0] for v in skel.bix]
b = _temp
# ---------- end python_2 ----------
python_3 = PythonScript(pts=cull_i_3)  # -> out, a, b; inputs pts: list
# ---------- python_3: Python ----------
import rhinoscriptsyntax as rs

class Skeleton():
    
    def __init__(self, verts):
        
        self._slav = self.compute_slav(verts)
        self._priority_queue = []
        

    def compute_slav(self, lst):
       _lst = [lst[-1]]+lst+[lst[0]]
       return {_lst[vi]:[(_lst[vi-1], _lst[vi+1]),True] for vi in range(1,len(_lst)-1)}
    
    def compute_skeleton(self):
        
        def prev(v): return self._slav[v][0][0]
        def next(v): return self._slav[v][0][1]
        def is_active(v): return self._slav[v][1]
        def toggle_active(v): self._slav[v][1] = not self._slav[v][1]
        def bisector(v):
            return rs.VectorAdd(
                rs.VectorUnitize(rs.VectorCreate(prev(v), v)),
                rs.VectorUnitize(rs.VectorCreate(next(v), v)))
        def line(v): return rs.AddLine(v, v+bisector(v))
        
        for v in self._slav:
            self._priority_queue.append(sorted([
                rs.LineLineIntersection(line(v), line(prev(v)))[0],
                rs.LineLineIntersection(line(v), line(next(v)))[0]],
                key = lambda pt: rs.Distance(v,pt))[0])
        
        return self._priority_queue
            
    
temp = Skeleton(rs.coerce3dpointlist(pts))
a = temp.compute_skeleton()
# ---------- end python_3 ----------
geo_4 = Geometry(python.b)  # disabled
panel_3 = Panel(python.a)  # disabled
geo_5 = Geometry(python_2.b)  # disabled
geo_6 = Geometry(python_3.b)
panel_4 = Panel(python_2.a)  # disabled
panel_5 = Panel(python_3.a)
vdis = VectorDisplay(Anchor=geo_6, Vector=python_3.a)
